# Grasshopper definition MT1463_HullGenerator_V3.34_Gr98V3.0.gh (Grasshopper 1.0.8)

# ---- group: Stern manipulation
length_aft_shoulder = Slider(50, range=10..90)
lpp_l0_85h = Slider(0.98, range=0.94..0.98)
input_stern_curve = Curve(<curve referenced from the Rhino model>)

# ---- group: Input
# Resistance prediction by Holtrop & Mennen
toggle_holtrop_mennen_prediction = BooleanToggle(False)
entrance_angle_factor_of_bwl = Slider(30, range=0..50)
design_speed_kn = Slider(14, range=6..30)
maximum_speed_above_design_for_resistanc = Slider(2, range=1..40)  # "Maximum speed above design for resistance table [kn]"
steps_per_knot_kn = Slider(1, range=1..2, expression="if(x=1,1,10)")
afterbody_form_coefficient_cstern = Slider(-10, range=-25..10)
method_selection_wet_shell_area = Slider(1, range=1..2)
method_selection_half_entrance_angle_ie = Slider(3, range=1..3)
addition = Addition(A=design_speed_kn, B=maximum_speed_above_design_for_resistanc)
eval = Evaluate(
    F="if(x=1,\"IE regressive approach 1984\",if(x=2,\"IE regressive approach 1978\", \"IE from Rhino model\"))",
    x=method_selection_half_entrance_angle_ie)
panel = Panel(eval)
eval_2 = Evaluate(F="if(x=1,\"S_wet from Rhino model\",\"S_Wet HM regressive approach\")", x=method_selection_wet_shell_area)
panel_2 = Panel(eval_2)

# ---- group: Box shape or hull shape
# INPUT
toggle_ship_true_or_box_shaped_barge = BooleanToggle(True)

# ---- group: main particulars (L, B, T, D)
height_waterline_from_keel_true_or_deck = BooleanToggle(True)
length_loa_m = Slider(150, range=20..150)
depth_doa_m = Slider(8, range=5..25)
breadth_boa_m = Slider(18, range=8..30)
waterline_m = Slider(5, range=0.1..22)

# ---- group: Heel and trim settings (only valid for angles <7 degrees)
heel_deg = Slider(0, range=-7..7)
trim_deg = Slider(0, range=-7..7)

# ---- group: Option to select solution-states from another grasshopper file
# The 'simple hull' Generator for MT1463 & MT1466
# TU DELFT with a start by Rhinocentre.nl
# DISCLAIMER
# Version 3.34 (3 feb 2026)
# This grasshopper script is developed by Rhinocentre
# and the Technical Univercity Delft 3ME.
# 
# 
# This rapid ship hull modeling script is open
# source for anyone with good intentions.
# You are invited to share your developments.
# 
# The module Holtrop and Mennen is written in GH-Python by Jelle Woudstra
# 
# b.goris@tudelft.nl
# or gerard@rhinocentre.nl
# See: https://discourse.mcneel.com/t/can-i-copy-or-export-a-state-to-another-file/101928
path_of_another_gh_file = FilePath("C:\Users\bgoris\OneDrive - Delft University of Technology\MT1463\Voorbeeldschepen\Voorbeeldschip Sjoerd 2025_26\VoorbeeldschipV2\MT1463_HullGenerator_V3.33 (1).gh")
c_script = CSharpScript(fp=path_of_another_gh_file)  # -> out; inputs fp: String; disabled
# ---------- c_script: C# ----------
// Grasshopper Script Instance
#region Usings
using System;
using System.Linq;
using System.Collections;
using System.Collections.Generic;
using System.Drawing;

using Rhino;
using Rhino.Geometry;

using Grasshopper;
using Grasshopper.Kernel;
using Grasshopper.Kernel.Data;
using Grasshopper.Kernel.Types;
#endregion

public class Script_Instance : GH_ScriptInstance
{
    #region Notes
    /* 
      Members:
        RhinoDoc RhinoDocument
        GH_Document GrasshopperDocument
        IGH_Component Component
        int Iteration

      Methods (Virtual & overridable):
        Print(string text)
        Print(string format, params object[] args)
        Reflect(object obj)
        Reflect(object obj, string method_name)
    */
    #endregion

    private void RunScript(string fp)
    {
    var io = new GH_DocumentIO();
    io.Open(fp);
    var doc = io.Document;
    var states = doc.StateServer;
    GrasshopperDocument.StateServer.AddRange(states);
    }
}
# ---------- end c_script ----------

# ---- group: Midship manipulation
midshiplength_of_lpp = Slider(35.4, range=5..70)
parallel_midship_combinations = Slider(0, range=0..2)
location_of_midship_of_lpp = Slider(48, range=30..70)
bilge_radius_m = Slider(5.2, range=0.4..10)
side_flare_rotation_point = Slider(0.2, range=0..1)
side_flare = Slider(0, range=0..1)

# ---- group: Data with respect to Global Strength
toggle_data_wrt_global_strength = BooleanToggle(False)
mean_shell_thickness_mm = Slider(1, range=0..100)

# ---- group: Bow manipulation
length_fwd_shoulder = Slider(30, range=10..90)
input_bow_intermediate_curve = Curve(<curve referenced from the Rhino model>)
bow_rounding_value_deg = Slider(1, range=1..70)
location_of_bow_intermediate_curve = Slider(55, range=25..95)
input_bow_cl_curve = Curve(<curve referenced from the Rhino model>)

# ----
# LINES PLAN
toggle_lines_plan = BooleanToggle(True)
ordinates = Slider(24, range=2..80)
waterlines = Slider(8, range=1..10)
buttocks = Slider(8, range=1..10)
sent_count = Slider(1, range=1..9)
sent_dictance_mm = Slider(2, range=1..5, expression="x*500")
toggle_show_loft_curves = BooleanToggle(False)

# ---- group: Colour & settings
nr_of_digits_output = Slider(4, range=0..10)
tekst_size_m = Slider(1.5, range=1..10, expression="x")
dimension_line_size = Slider(10, range=1..10)
output_dimension = ValueList({"mm": 1, "m": 1000}, selected="m")

# ---- group: Miscellanious
toggle_calculate_at_least_the_buoyant_vo = BooleanToggle(True)  # "Toggle Calculate at least the buoyant volume"
toggle_show_waterline_angle = BooleanToggle(False)
tankheight_deduction_for_tank_diagrams = Slider(10, range=1..200)
x_division_method = Slider(1, range=1..2)
reference_rectangle_bxd = Curve(<curve referenced from the Rhino model>)
flip_loft_surface = Slider(0, range=0..1)
plate_thickness_scale_model_mm_fixed = Number(0)
panel_3 = Panel(plate_thickness_scale_model_mm_fixed)

# ---- group: Volume Related functions
toggle_volume_related_output = BooleanToggle(True)
toggle_cross_area_curves = BooleanToggle(False)

# ---- group: Water Ballast Tanks
# Water ballast tanks
toggle_tank_diagrams_volume_data = BooleanToggle(True)
fillingheight_of_tank_1_in_of_h = Slider(50, range=0..100)
brep_wb_tank2 = Brep(<brep referenced from the Rhino model>)
brep_wb_tank3 = Brep(<brep referenced from the Rhino model>)
fillingheight_of_tank_3_in_of_h = Slider(50, range=0..100)
toggle_show_tank_cov_curves = BooleanToggle(False)
toggle_show_tanks = BooleanToggle(True)
brep_wb_tank1 = Brep(<brep referenced from the Rhino model>)
fillingheight_of_tank_2_in_of_h = Slider(88.5744, range=0..100)
toggle_show_wp_sections_for_tankdiagrams = BooleanToggle(False)
no_of_planes_tankdiagrams = Slider(6, range=3..18)
toggle_tank_diagrams_waterplane_data = BooleanToggle(True)

# ----
sift = SiftPattern(List=no_of_planes_tankdiagrams, SiftPattern=toggle_tank_diagrams_volume_data)  # -> Output0, Output1
rad = Radians(Degrees=heel_deg)
rad_2 = Radians(Degrees=trim_deg)
dam = DataDam(DataA=sift.Output1, BufferDelay=20000000, BufferMode=2)

# ---- group: Scaling for scale model
toggle_scale_large_model = BooleanToggle(False)
scale_1_xx_fixed = Integer(80)
panel_4 = Panel(scale_1_xx_fixed)

# ----
vec = VectorXYZ(XComponent=0, YComponent=0, ZComponent=0)  # -> Vector, Length
panel_5 = Panel("""1
1
1
1
0
0""")
panel_6 = Panel("""0
0
1
1
0
1""")
loft_opt = LoftOptions(Closed=False, Adjust=False, Rebuild=0, Refit=0, Type=1)
colour_frames = ColourSwatch(SwatchColor=RGB(0, 94, 36))
colour_waterlines = ColourSwatch(SwatchColor=RGB(0, 208, 255))
colour_buttocks = ColourSwatch(SwatchColor=RGB(189, 80, 8))

# ---- group: DEZE OPTIE WERKT NOG NIET
toggle_solidhull_direct_from_rhino = BooleanToggle(False)
brep_solid_hull = Brep(<brep referenced from the Rhino model>)

# ----
bool_volume_related_output = Boolean(toggle_volume_related_output)
button_show_centers = Button()
and = GateAnd(ToggleVolumeRelatedOutput=toggle_volume_related_output, ToggleCrossAreaCurves=toggle_cross_area_curves)
button_show_cross_sections = Button()

# ---- group: handmatige controle invoer true=aan
centroid_height_bulb_transverse_area_m2 = Slider(4, range=0..10)
manual_input = BooleanToggle(False)
transom_area_m2 = Slider(16, range=0..40)
breadth_m = Slider(32, range=0..40)
draft_aft_m = Slider(10, range=0..40)
draft_forward_m = Slider(10, range=0..40)
mainframe_coefficient_c_m = Slider(0.98, range=0..1)
waterline_angle_of_entrance = Slider(12.08, range=0..25)
transverse_area_bulb_m2 = Slider(20, range=0..50)
waterline_length_m = Slider(205, range=0..300)
displacement_m3 = Slider(37500, range=0..400000)
waterplane_area_m2 = Slider(4920, range=0..10000)
lcb = Slider(-0.75, range=-25..25)
wet_hull_area_m2 = Slider(7381.5, range=0..20000)
merge = Merge(
    Data1=flatten(waterline_length_m),
    Data2=flatten(breadth_m),
    Data3=flatten(draft_aft_m),
    Data4=flatten(draft_forward_m),
    Data5=flatten(displacement_m3),
    Data6=flatten(mainframe_coefficient_c_m),
    Data7=flatten(waterplane_area_m2),
    Data8=flatten(lcb),
    Data9=flatten(wet_hull_area_m2),
    Data10=flatten(waterline_angle_of_entrance),
    Data11=flatten(transom_area_m2),
    Data12=flatten(transverse_area_bulb_m2),
    Data13=flatten(centroid_height_bulb_transverse_area_m2))  # -> flatten(Result)

# ---- group: NVT voor MT1458 / Oppervlakken en weerstand coefficient van appendages [m2]
# Info appendage weerstand: Appendage resistance:
# For each appendage type, the first slider allows for the coefficient to be set followed by the submerged area with the second slider.
# 
# Use values given in the publications.
bilge_keels = Slider(1.4, range=1.4..1.401)
stabilizer_fins = Slider(2.8, range=2.8..2.801)
area = Slider(0, range=0..20)
area_2 = Slider(0, range=0..20)
skeg = Slider(2, range=1.5..2)
shafts = Slider(2, range=2..4)
area_3 = Slider(0, range=0..20)
dome = Slider(2.7, range=2.7..2.701)
area_4 = Slider(0, range=0..80)
shaft_brackets = Slider(3, range=3..3.001)
area_5 = Slider(0, range=0..20)
area_6 = Slider(0, range=0..20)
twin_screw_balance_rudders = Slider(2.8, range=2.8..3)
area_7 = Slider(0, range=0..20)
area_8 = Slider(0, range=0..20)
strut_bossings = Slider(3, range=3..3.001)
area_9 = Slider(0, range=0..20)
hull_bossings = Slider(2, range=2..2.001)
rudder_behind_skeg = Slider(2, range=1.5..2)
area_10 = Slider(0, range=0..80)
rudder_behind_stern = Slider(1.3, range=1.3..1.5)
area_11 = Slider(0, range=0..80)
merge_2 = Merge(
    Data1=rudder_behind_skeg,
    Data2=area_10,
    Data3=rudder_behind_stern,
    Data4=area_11,
    Data5=twin_screw_balance_rudders,
    Data6=area_4,
    Data7=shaft_brackets,
    Data8=area_7,
    Data9=skeg,
    Data10=area_8,
    Data11=strut_bossings,
    Data12=area_9,
    Data13=hull_bossings,
    Data14=area_5,
    Data15=shafts,
    Data16=area_6,
    Data17=stabilizer_fins,
    Data18=area_3,
    Data19=dome,
    Data20=area,
    Data21=bilge_keels,
    Data22=area_2)
python = GhPythonScript(k2_matrix=merge_2)  # -> k2, S_app; inputs k2_matrix: list
# ---------- python: Python ----------
__author__ = "jlwou"
__version__ = "2020.02.12"

import rhinoscriptsyntax as rs
table1=k2_matrix[0]
table2=k2_matrix[2]
table3=k2_matrix[4]
table4=k2_matrix[6]
table5=k2_matrix[8]
table6=k2_matrix[10]
table7=k2_matrix[12]
table8=k2_matrix[14]
table9=k2_matrix[16]
table10=k2_matrix[18]
table11=k2_matrix[20]

A_table1=k2_matrix[1]
A_table2=k2_matrix[3]
A_table3=k2_matrix[5]
A_table4=k2_matrix[7]
A_table5=k2_matrix[9]
A_table6=k2_matrix[11]
A_table7=k2_matrix[13]
A_table8=k2_matrix[15]
A_table9=k2_matrix[17]
A_table10=k2_matrix[19]
A_table11=k2_matrix[21]

S_app=A_table1 + A_table2 + A_table3 + A_table4 + A_table5 + A_table6 + A_table7 + A_table8 + A_table9 + A_table10 + A_table11
if S_app==0:
    k2=0
else:
    k2=-1+(table1*A_table1 + table2*A_table2 + table3*A_table3 +table4*A_table4 +table5*A_table5 + table6*A_table6 + table7*A_table7 + table8*A_table8 + table9*A_table9 + table10*A_table10 + table11*A_table11)/(S_app)
# ---------- end python ----------
concat = Concatenate(FragmentA=python.k2, FragmentC=", ", FragmentB=python.S_app)
k2_s_app = Panel(concat)

# ---- group: NVT voor MT1458
hoogteligging_van_zwaartepunt_transverse = Slider(0, range=0..10)  # "Hoogteligging van zwaartepunt transverse area bulb [m]"
transverse_oppervlak_bulb_m2 = Slider(0, range=0..50)
bulb = BooleanToggle(False)

# ---- group: NVT voor MT1458 / Boegschroef
bow_thruster = BooleanToggle(False)
resistance_coefficient_bow_thruster = Slider(0.012, range=0..0.012)
nr_of_bow_thrusters = Slider(1, range=0..5)
diameter_bow_thruster_tunnel_m = Slider(5, range=0..7)

# ---- group: NVT voor MT1458 / Schroef
diameter_prop_m = Slider(8, range=0..10)
nr_of_props = Slider(1, range=1..5)

# ---- group: output m or mm
txt_mm = Text("mm")
txt_m = Text("m")
eval_3 = Evaluate(F="if(output=1,B,A)", output=output_dimension, A=txt_m, B=txt_mm)

# ----
# OUTPUT
# Right click on the above.
# Choose "Bake".
# Select the layer to bake in
# OPTION 1: EXPORT DATA to CSV files
# OPTION 2: COPY DATA TO EXCELL
# Set all toggles on true, otherwise some data will be missing. Right mouse click in the output panel below and choose 'Copy Data Only' and paste this in spreadsheet or a text file.
# Use the function Text to Columns in Excel>Tab Data. Use comma (,) as delimiter and a point (.) as decimal qualifier.
subversion_number = Slider(0, range=0..99)
version_number = Slider(3, range=1..99)
write_csv_files = BooleanToggle(True)
group_number = Slider(98, range=1..99)

# ---- group: Delay of data, right click to change the time delay
dam_2 = DataDam(DataA=toggle_ship_true_or_box_shaped_barge, BufferDelay=20000000, BufferMode=2)
dam_3 = DataDam(
    DataA=midshiplength_of_lpp,
    DataB=parallel_midship_combinations,
    DataC=location_of_midship_of_lpp,
    DataD=bilge_radius_m,
    DataE=side_flare,
    DataF=side_flare_rotation_point,
    BufferDelay=20000000,
    BufferMode=2)  # -> DataA, DataB, DataC, DataD, DataE, DataF
dam_4 = DataDam(DataA=lpp_l0_85h, DataB=length_aft_shoulder, BufferDelay=20000000, BufferMode=2)  # -> DataA, DataB
dam_5 = DataDam(
    DataA=length_fwd_shoulder,
    DataB=location_of_bow_intermediate_curve,
    DataC=bow_rounding_value_deg,
    BufferDelay=20000000,
    BufferMode=2)  # -> DataA, DataB, DataC
dam_6 = DataDam(DataA=input_bow_intermediate_curve, DataB=input_bow_cl_curve, BufferDelay=20000000, BufferMode=2)  # -> DataA, DataB
dam_7 = DataDam(DataA=rad, DataB=rad_2, BufferDelay=20000000, BufferMode=2)  # -> DataA, DataB
dam_8 = DataDam(DataA=input_stern_curve, BufferDelay=20000000, BufferMode=2)
dam_9 = DataDam(DataA=mean_shell_thickness_mm, BufferDelay=20000000, BufferMode=2)
dam_10 = DataDam(
    DataA=ordinates,
    DataB=waterlines,
    DataC=buttocks,
    DataD=sent_count,
    DataE=sent_dictance_mm,
    BufferDelay=20000000,
    BufferMode=2)  # -> DataA, DataB, DataC, DataD, DataE
dam_11 = DataDam(
    DataA=length_loa_m,
    DataB=breadth_boa_m,
    DataC=depth_doa_m,
    DataD=height_waterline_from_keel_true_or_deck,
    DataE=waterline_m,
    BufferDelay=20000000,
    BufferMode=2)  # -> DataA, DataB, DataC, DataD, DataE
dam_12 = DataDam(DataA=brep_wb_tank1, DataB=brep_wb_tank2, DataC=brep_wb_tank3, BufferDelay=20000000, BufferMode=2)  # -> DataA, DataB, DataC
dam_13 = DataDam(
    DataA=fillingheight_of_tank_1_in_of_h,
    DataB=fillingheight_of_tank_2_in_of_h,
    DataC=fillingheight_of_tank_3_in_of_h,
    BufferDelay=20000000,
    BufferMode=2)  # -> DataA, DataB, DataC
dam_14 = DataDam(DataA=group_number, BufferDelay=20000000, BufferMode=2)
dam_15 = DataDam(DataA=version_number, BufferDelay=20000000, BufferMode=2)
dam_16 = DataDam(DataA=subversion_number, BufferDelay=20000000, BufferMode=2)

# ----
and_2 = GateAnd(A=dam_2, B=toggle_show_loft_curves)

# ---- group: scaling
sift_2 = SiftPattern(List=1, SiftPattern=toggle_scale_large_model)  # -> Output0, Output1
sift_3 = SiftPattern(List=scale_1_xx_fixed, SiftPattern=toggle_scale_large_model)  # -> Output0, Output1
combine = CombineData(Input0=sift_2.Output0, Input1=sift_3.Output1)  # -> Result, Index
division = Division(A=1, B=combine.Result)
drec = DeconstuctRectangle(Rectangle=reference_rectangle_bxd)  # -> BasePlane, XInterval, YInterval
end = EndPoints(Curve=dam_6.DataB)  # -> Start, End
scale = Scale(Geometry=reference_rectangle_bxd, Center=drec.BasePlane, Factor=division)  # -> Geometry, Transform
scale_2 = Scale(Geometry=dam_8, Center=drec.BasePlane, Factor=division)  # -> Geometry, Transform
scale_3 = Scale(Geometry=dam_6.DataB, Center=end.Start, Factor=division)  # -> Geometry, Transform
scale_4 = Scale(Geometry=dam_6.DataA, Center=drec.BasePlane, Factor=division)  # -> BowIntermediateCurve, Transform

# ----
eval_4 = Evaluate(F="m*1000/scale", m=tekst_size_m, scale=combine.Result)
eval_5 = Evaluate(F="m*1000/scale", m=dimension_line_size, scale=combine.Result)

# ---- group: from m to mm
eval_6 = Evaluate(F="m*1000/scale", m=dam_11.DataC, scale=combine.Result)
eval_7 = Evaluate(F="m*1000/scale", m=dam_11.DataE, scale=combine.Result)
eval_8 = Evaluate(F="m*1000/scale", m=dam_11.DataB, scale=combine.Result)
eval_9 = Evaluate(
    F="if(toggle=true,t_scale,t/scale)",
    t=dam_9,
    scale=combine.Result,
    t_scale=plate_thickness_scale_model_mm_fixed,
    toggle=toggle_scale_large_model)
eval_10 = Evaluate(F="m*1000/scale", m=dam_11.DataA, scale=combine.Result)
eval_11 = Evaluate(F="m*1000/scale", m=dam_3.DataD, scale=combine.Result)

# ---- group: Check if the first three points of the bow curve are on Z=0
cp = ControlPoints(Curve=dam_6.DataB)  # -> Points, Weights, Knots
item = ListItem(List=cp.Points, Index=0, Wrap=True)  # -> Item, Item1, Item2
pt2num = PointsToNumbers(Points=flatten([item.Item, item.Item1, item.Item2]), Mask=11)  # -> expr("round(x,3)", Numbers)
equals = Equality(FirstNumber=pt2num, SecondNumber=0)  # -> Equality, Inequality
ma = MassAddition(Input=flatten(equals.Inequality))  # -> Result, PartialResults
eval_12 = Evaluate(F="IF(x>0,\"WARNING: The Z value of point 1-3 of the bowcurve is not zero\",\"\")", x=ma.Result)

# ---- group: Check if the first three points of the bow intermediate curve are on Z=0
cp_2 = ControlPoints(Curve=dam_6.DataA)  # -> Points, Weights, Knots
item_2 = ListItem(List=cp_2.Points, Index=0, Wrap=True)  # -> Item, Item1, Item2
pt2num_2 = PointsToNumbers(Points=flatten([item_2.Item, item_2.Item1, item_2.Item2]), Mask=11)  # -> expr("round(x,3)", Numbers)
equals_2 = Equality(FirstNumber=pt2num_2, SecondNumber=0)  # -> Equality, Inequality
ma_2 = MassAddition(Input=flatten(equals_2.Inequality))  # -> Result, PartialResults
eval_13 = Evaluate(F="IF(x>0,\"WARNING: The Z value of point 1-3 of the bow intermediate curve is not zero\",\"\")", x=ma_2.Result)

# ---- group: Design waterplane
tdesign_depth_loadlineratio = Number(0.85)
eval_14 = Evaluate(F="Doa*Td_D-t_plate", Doa=eval_6, Td_D=tdesign_depth_loadlineratio, t_plate=eval_9)
pt2num_3 = NumbersToPoints(Numbers=eval_14, Mask=11)
xy = XYPlane(Origin=pt2num_3)

# ----
depth = Number(expr("x*1000", dam_11.DataC))
pt = ConstructPoint(XCoordinate=0, YCoordinate=0, ZCoordinate=depth)
xy_2 = XYPlane(Origin=pt)

# ---- group: Settings Writing File
extension_csv_or_txt = BooleanToggle(True)
relative = BooleanToggle(True)
overwrite = BooleanToggle(True)
append = BooleanToggle(True)
subversion = Data(dam_16)
item_3 = ListItem(List=[".txt", ".csv"], Index=extension_csv_or_txt, Wrap=True)

# ---- group: Group & Version naming
concat_group_version_number = Concatenate(FragmentA=" Group ", FragmentB=dam_14, FragmentC="; Version ", FragmentE=dam_15, FragmentF=".", FragmentD=subversion)
panel_7 = Panel(concat_group_version_number)

# ---- group: Visual check of intersection of tanks
sint = SolidIntersection(BrepsA=dam_12.DataA, BrepsB=dam_12.DataB)
sint_2 = SolidIntersection(BrepsA=dam_12.DataA, BrepsB=dam_12.DataC)
sint_3 = SolidIntersection(BrepsA=dam_12.DataB, BrepsB=dam_12.DataC)
preview = CustomPreview(
    Geometry=[sint, sint_2, sint_3],
    Material={diffuse=RGB(221, 160, 221), emission=RGB(66, 48, 66), shine=0.5, specular=RGB(255, 255, 255), transparency=0})

# ----
volume = Volume(Geometry=[sint, sint_2, sint_3])  # -> Volume, Centroid

# ---- group: Visual check of intersection of tanks (continued)
null = NullItem(Item=volume.Volume)  # -> NullFlags, InvalidFlags, Description
int = Integer(null.NullFlags)
eval_15 = Evaluate(F="IF(x≠1,\"WARNING: TANKS ARE INTERSECTING\",\"\")", x=int)

# ---- group: Check if end points of curves are inside the reference rectangle BH
X = UnitX(Factor=expr("-120000", dam_11.DataA))
end_2 = EndPoints(Curve=dam_6.DataB)  # -> Start, End
end_3 = EndPoints(Curve=[dam_8, dam_6.DataA])  # -> Start, End
move = Move(Geometry=reference_rectangle_bxd, Motion=Vector(10000, 0, 0))  # -> Geometry, Transform
pt2num_4 = PointsToNumbers(Points=end_2.Start, Mask=11)
extr = Extrude(Base=move.Geometry, Direction=X)
cap = CapHoles(Brep=extr)
equals_3 = Equality(FirstNumber=expr("round(x)", pt2num_4), SecondNumber=0)  # -> Equality, Inequality
brepinc = PointInBrep(Brep=cap, Point=flatten([end_3.Start, end_3.End]), Strict=False)
ma_3 = MassAddition(Input=flatten([equals_3.Inequality, brepinc]))  # -> Result, PartialResults
eval_16 = Evaluate(F="IF(x>0,\"WARNING: an endpoint of a curve is inside the rectangle BH\",\"\")", x=ma_3.Result)

# ----
equals_4 = Equality(FirstNumber=expr("round(x)", [ma_3.Result, ma.Result, ma_2.Result]), SecondNumber=0)  # -> Equality, Inequality
dispatch = Dispatch(List=[eval_16, eval_12, eval_13], DispatchPattern=equals_4.Inequality)  # -> ListA, ListB

# ---- group: Check if end points of curves are inside the reference rectangle BH (continued)
warnings = Panel([dispatch.ListA, eval_15])

# ---- group: Bow curve scaling & placement
x_tremez = Extremes(Curve=scale_3.Geometry, Plane=PlaneXY(0, 0, 0))  # -> Highest, Lowest
pdecon = Deconstruct(Point=[x_tremez.Lowest, x_tremez.Highest])  # -> XComponent, YComponent, ZComponent
movetoplane = MoveToPlane(Geometry=scale_3.Geometry, Plane=PlaneXY(0, 0, 0), Above=True, Below=True)  # -> Geometry, Transform
sort = SortList(Keys=pdecon.ZComponent)  # -> Keys, ValuesA
item_4 = ListItem(List=sort.Keys, Index=0, Wrap=True)  # -> Item1, Item
subtraction = Subtraction(A=item_4.Item1, B=item_4.Item)

# ---- group: Moulded start and endpoints
num = Number(0)
eval_17 = Evaluate(F="Doa-t_plate", Doa=eval_6, t_plate=eval_9)
eval_18 = Evaluate(
    F="if(toggle_T_f=TRUE,MIN(Doa-Minimum,MAX(T_or_f-t_plate,Minimum)),MAX(Doa-T_or_f-t_plate,Minimum))",
    Doa=eval_6,
    T_or_f=eval_7,
    t_plate=eval_9,
    toggle_T_f=dam_11.DataD,
    Minimum=num)
eval_19 = Evaluate(F="Boa-2*t_plate", Boa=eval_8, t_plate=eval_9)
division_2 = Division(A=eval_19, B=2)

# ----
subtraction_2 = Subtraction(A=eval_8, B=eval_19)
panel_8 = Panel(subtraction_2)

dom = ConstructDomain(DomainStart=expr("-1.1*X", division_2), DomainEnd=expr("1.1*X", division_2))
dom_2 = ConstructDomain(DomainStart=expr("-10", 0), DomainEnd=expr("1.1*X", eval_17))
multiplication = Multiplication(Depth=eval_17, B=1)
Z = UnitZ(Factor=multiplication)
xy_3 = XYPlane(Origin=Z)
dmoulded = Number(eval_17)

# ---- group: Bow curve scaling & placement (continued)
division_3 = Division(A=eval_17, B=subtraction)
scale_nu = ScaleNU(Geometry=movetoplane.Geometry, Plane=PlaneXY(0, 0, 0), ScaleX=division_3, ScaleY=1, ScaleZ=division_3)  # -> Geometry, Transform
pcx = CurvePlane(Curve=scale_nu.Geometry, Plane=xy)  # -> Points, ParamsC, ParamsP
x_tremez_2 = Extremes(Curve=scale_nu.Geometry, Plane=PlaneXY(0, 0, 0))  # -> Highest, Lowest
pdecon_2 = Deconstruct(Point=[x_tremez_2.Highest, x_tremez_2.Lowest])  # -> XComponent, YComponent, ZComponent
pt2num_5 = PointsToNumbers(Points=pcx.Points, Mask=1)
sort_2 = SortList(Keys=pdecon_2.ZComponent, ValuesA=[x_tremez_2.Highest, x_tremez_2.Lowest])  # -> Keys, ValuesA
subtraction_3 = Subtraction(Lpp0=eval_10, B=pt2num_5)
item_5 = ListItem(List=sort_2.ValuesA, Index=0, Wrap=True)  # -> Item1, Item
pt2num_6 = PointsToNumbers(Points=item_5.Item1, Mask=1)
subtraction_4 = Subtraction(A=pt2num_6, B=pt2num_5)
subtraction_5 = Subtraction(Loa1=eval_10, B=subtraction_4)
multiplication_2 = Multiplication(A=subtraction_5, B=dam_4.DataA)
subtraction_6 = Subtraction(A=multiplication_2, B=pt2num_5)

# ---- group: ALS STUDENT NIET VERANDEREN, keuze om de invoer lengte op Lpp of Loa te zetten
list = ValueList({"Invoer lengte is Lpp": 0, "Invoer lengte is Loa": 1}, selected="Invoer lengte is Loa")
filter_lpp_0_or_lpp_1 = StreamFilter(Gate=list, Stream0=eval_10, Stream1=multiplication_2)

# ----
multiplication_3 = Multiplication(A=filter_lpp_0_or_lpp_1, B=dam_3.DataA, C=0.01)
eval_20 = Evaluate(F="m/scale", m=multiplication_3, scale=combine.Result)

# ---- group: Bow curve scaling & placement (continued)
filter = StreamFilter(Gate=list, Stream0=subtraction_3, Stream1=subtraction_6)
X_2 = UnitX(Factor=filter)
move_2 = Move(Geometry=scale_nu.Geometry, Motion=X_2)  # -> Geometry, Transform

# ---- group: Moulded start and endpoints (continued)
division_4 = Division(A=filter_lpp_0_or_lpp_1, B=dam_4.DataA)
eval_21 = Evaluate(F="Lpp*LocM/100-LMidShip/2", Lpp=filter_lpp_0_or_lpp_1, LocM=dam_3.DataC, LMidShip=eval_20)
subtraction_7 = Subtraction(A=filter_lpp_0_or_lpp_1, B=division_4)
eval_22 = Evaluate(F="Lpp-Laft-LMidShip", Lpp=filter_lpp_0_or_lpp_1, Laft=eval_21, LMidShip=eval_20)
addition_2 = Addition(A=eval_21, B=eval_20)

# ---- group: Main frame generation
pts_of_bilge_curve = Point([Point(0, -3, 0), Point(0, -1.612248345, 0), Point(0, -1.104813525, 0), Point(0, -0.7190296233, 0), Point(0, -0.2595888586, 0.2595901177), Point(0, 6.968148227e-07, 0.7190303202), Point(0, 6.968148227e-07, 1.104814133), Point(0, 6.968148227e-07, 1.612249042), Point(0, 6.968148226e-07, 3)])
weight_numbers = Number([1, 1, 1, 1, 1, 1, 1, 1, 1])
lng = ListLength(List=pts_of_bilge_curve)
knots = KnotVector(Count=lng, Degree=3, Periodic=False)
nurbcrv = NurbsCurve(Points=pts_of_bilge_curve, Weights=weight_numbers, Knots=knots)  # -> Curve, Length, Domain
scale_5 = Scale(Geometry=nurbcrv.Curve, Center=Point(0, 0, 0), Factor=eval_11)  # -> Geometry, Transform
Y = UnitY(Factor=division_2)
multiplication_4 = Multiplication(Depth=eval_17, _11=1.1)
move_3 = Move(Geometry=scale_5.Geometry, Motion=Y)  # -> Geometry, Transform
X_3 = UnitX(Factor=eval_21)
cp_3 = ControlPoints(MainCurve=move_3.Geometry)  # -> Points, Weights, Knots

# ----
# Function if points of bilge radius become beyond midship or depth point.
item_6 = ListItem(List=cp_3.Points, Index=expr("x-1", lng), Wrap=True)
item_7 = ListItem(List=cp_3.Points, Index=0, Wrap=True)
pdecon_3 = Deconstruct(Point=item_7)  # -> XComponent, YComponent, ZComponent
pdecon_4 = Deconstruct(Point=item_6)  # -> XComponent, YComponent, ZComponent
eval_23 = Evaluate(F="if(y≤0,y-1,0)", y=pdecon_3.YComponent)
eval_24 = Evaluate(F="if(Zbilge≥Depth,Zbilge+1,Depth)", Depth=multiplication_4, Zbilge=pdecon_4.ZComponent)
merge_3 = Merge(Data1=0, Data2=lng)
base_pt = ConstructPoint(XCoordinate=0, YCoordinate=flatten(eval_23), ZCoordinate=0)
deck_pt = ConstructPoint(XCoordinate=0, YCoordinate=division_2, ZCoordinate=flatten(eval_24))
ins = InsertItems(List=cp_3.Points, Item=[base_pt, deck_pt], Indices=merge_3, Wrap=True)
ins_2 = InsertItems(List=cp_3.Weights, Item=1, Indices=merge_3, Wrap=True)
lng_2 = ListLength(List=ins)
knots_2 = KnotVector(Count=lng_2, Degree=3, Periodic=False)
nurbcrv_2 = NurbsCurve(Points=ins, Weights=ins_2, Knots=knots_2)  # -> CurveOut, Length, Domain

# ---- group: Set Y=0 of bow curve
mm = Slider(200, range=10..200)
cp_4 = ControlPoints(Curve=move_2.Geometry)  # -> Points, Weights, Knots
pt2num_7 = PointsToNumbers(Points=cp_4.Points, Mask=3)
division_5 = Division(A=mm, Scale=combine.Result)
pt2num_8 = NumbersToPoints(Numbers=pt2num_7, Mask=3)
split = SplitList(List=pt2num_8, Index=1)  # -> ListA, ListB
Y_2 = UnitY(Factor=division_5)  # -> expr("-x", UnitVector)
move_4 = Move(Geometry=split.ListA, Motion=Y_2)  # -> Geometry, Transform
nurbcrv_3 = NurbsCurve(Points=[move_4.Geometry, split.ListB], Weights=cp_4.Weights, Knots=cp_4.Knots)  # -> Curve, Length, Domain

# ---- group: Side Flare: Places the side of the mainframe at an angle. Factor based on half B minus bilge radius
subtraction_8 = Subtraction(HalfBm=division_2, BilgeRadius=eval_11)
subtraction_9 = Subtraction(Hm=eval_17, Tm=eval_18)
multiplication_5 = Multiplication(A=subtraction_9, B=dam_3.DataF)
multiplication_6 = Multiplication(A=subtraction_8, B=dam_3.DataE)
subtraction_10 = Subtraction(A=eval_17, B=multiplication_5)
subtraction_11 = Subtraction(A=division_2, B=multiplication_6)
pt_2 = ConstructPoint(XCoordinate=0, YCoordinate=division_2, ZCoordinate=subtraction_10)
pt_3 = ConstructPoint(XCoordinate=0, YCoordinate=division_2, ZCoordinate=0)
pt_4 = ConstructPoint(XCoordinate=0, YCoordinate=subtraction_11, ZCoordinate=0)
xy_4 = XYPlane(Origin=pt_2)
shear = Shear(Geometry=nurbcrv_2.CurveOut, Base=xy_4, Grip=pt_3, Target=pt_4)  # -> Geometry, Transform

# ----
Y_3 = UnitY(Factor=division_5)  # -> expr("-x/2", UnitVector)

# ---- group: Set y value of control points to max half breadth
cp_5 = ControlPoints(MainCurve=shear.Geometry)  # -> Points, Weights, Knots
pdecon_5 = Deconstruct(Point=cp_5.Points)  # -> XComponent, YComponent, ZComponent
expression = Expression(B=division_2, y=pdecon_5.YComponent, Expression="if(y≤B,y,B)")
pt_5 = ConstructPoint(XCoordinate=pdecon_5.XComponent, YCoordinate=expression, ZCoordinate=pdecon_5.ZComponent)
nurbcrv_4 = NurbsCurve(Points=pt_5, Weights=cp_5.Weights, Knots=cp_5.Knots)  # -> CurveOut, Length, Domain

# ---- group: Midship
move_5 = Move(Geometry=nurbcrv_4.CurveOut, Motion=X_3)  # -> Geometry, Transform
X_4 = UnitX(Factor=eval_20)
crv_main_frame_aft = Curve(move_5.Geometry)
move_6 = Move(Geometry=crv_main_frame_aft, Motion=X_4)  # -> MainframeFwd, Transform

# ----
X_5 = UnitX(Factor=subtraction_7)
yz = YZPlane(Origin=X_5)
planesrf = PlaneSurface(Plane=yz, XSize=dom, YSize=dom_2)
input_cutting_stern = Brep(planesrf)

division_6 = Division(A=eval_10, B=1000)
multiplication_7 = Multiplication(A=eval_18, B=0.001)
division_7 = Division(A=multiplication_3, B=1000)
item_8 = ListItem(List=[0, 1], Index=dam_2, Wrap=True)
merge_4 = Merge(
    Data1=flatten(division_6),
    Data2=flatten(dam_11.DataB),
    Data3=flatten(dam_11.DataC),
    Data4=flatten(multiplication_7),
    Data5=flatten(dam_4.DataA),
    Data6=flatten(dam_4.DataB),
    Data7=flatten(division_7),
    Data8=flatten(dam_3.DataC),
    Data9=flatten(dam_3.DataD),
    Data10=flatten(dam_5.DataA),
    Data11=flatten(dam_5.DataB),
    Data12=flatten(dam_5.DataC),
    Data13=flatten(heel_deg),
    Data14=flatten(trim_deg),
    Data15=flatten(dam_9),
    Data16=flatten(dam_10.DataA),
    Data17=flatten(dam_10.DataB),
    Data18=flatten(dam_10.DataC),
    Data19=flatten(entrance_angle_factor_of_bwl),
    Data20=flatten(x_division_method),
    Data21=flatten(flip_loft_surface),
    Data22=flatten(fillingheight_of_tank_1_in_of_h),
    Data23=flatten(fillingheight_of_tank_2_in_of_h),
    Data24=flatten(fillingheight_of_tank_3_in_of_h),
    Data25=flatten(item_8))  # -> flatten(Result)
panel_9 = Panel("""Loa
Boa
Doa
Tm
Location factor App
% Length aft Shoulder
Midship Length
Location of midship
Bilge Radius
% Length fwd shoulder
Location of bow intermediate curve
Bow rounding value
heel
trim
mean shell thickness
Number of ordinates
number of waterlines
number of buttocks
Entrance angle factor
X division method
Flip loft surface
Filling Tank 1
Filling Tank 2
Filling Tank 3
Toggle 1_ship/0_barge""")
panel_10 = Panel("""Lpp
Boa
Doa
Tm
Location factor App
% Length aft Shoulder
Midship Length
Location of midship
Bilge Radius
% Length fwd shoulder
Location of bow intermediate curve
Bow Rounding Value
heel
trim
mean shell thickness
Number of ordinates
number of waterlines
number of buttocks
Entrance angle factor
X division method
Flip loft surface
Filling Tank 1
Filling Tank 2
Filling Tank 3
Toggle 1_ship/0_barge""")
filter_lpp1_of_lpp2 = StreamFilter(Gate=list, Stream0=panel_10, Stream1=panel_9)
panel_11 = Panel("""m
m
m
m
-
%
m
% of Lpp
m
%
%
deg
deg
deg
mm
-
-
-
% of Bwl
-
-
%h1
%h2
%h3
-""")
case = TextCase(Text="Input Data", Culture=127)  # -> UpperCase, LowerCase
eval_25 = Evaluate(F="round(x,z)", x=merge_4, z=nr_of_digits_output)
rep = ReplaceText(Text=panel_11, Find="m", Replace=eval_3, RecursiveReplace=False)
concat_2 = Concatenate(FragmentB=filter_lpp1_of_lpp2, FragmentA=" [", FragmentC=rep, FragmentD="],")
concat_3 = Concatenate(FragmentA=filter_lpp1_of_lpp2, FragmentE=" ", FragmentB=eval_25, FragmentC=" ", FragmentD=rep)
concat_4 = Concatenate(FragmentA=concat_2, FragmentB=eval_25)
concat_5 = Concatenate(FragmentB=case.UpperCase, FragmentC=concat_group_version_number)
input_data = Panel([case.UpperCase, concat_3])
input_data_2 = Panel([concat_5, concat_4, warnings])

# ---- group: Lpp barge or ship
multiplication_8 = Multiplication(A=eval_10, B=dam_4.DataA)
panel_12 = Panel(multiplication_8)
filter_lpp_0_or_lpp_1_2 = StreamFilter(Gate=list, Stream0=eval_10, Stream1=multiplication_8)
filter_lpp_barge_0_or_ship_1 = StreamFilter(Gate=dam_2, Stream0=filter_lpp_0_or_lpp_1_2, Stream1=filter_lpp_0_or_lpp_1)
lpp_ship = Panel(filter_lpp_0_or_lpp_1)
lpp = Panel(filter_lpp_barge_0_or_ship_1)

# ---- group: Sheared bow curve
mm_2 = Slider(10, range=1..10)
rad_3 = Radians(Degrees=dam_5.DataC)
prot = RotatePlane(Plane=split.ListA, Angle=rad_3)
deplane = DeconstructPlane(Plane=prot)  # -> Origin, XAxis, YAxis, ZAxis
split_2 = SplitList(List=pt2num_8, Index=1)  # -> ListA, ListB
pl = ConstructPlane(Origin=deplane.Origin, XAxis=deplane.XAxis, YAxis=deplane.ZAxis)
projecta = ProjectAlong(Geometry=split_2.ListB, Plane=pl, Direction=Vector(0, 1, 0))  # -> Geometry, Transform

# ----
division_8 = Division(A=mm_2, Scale=combine.Result)
move_7 = Move(Geometry=split_2.ListA, Motion=Y_3)  # -> Geometry, Transform

# ---- group: Sheared bow curve (continued)
X_6 = UnitX(Factor=division_8)  # -> expr("-X", UnitVector)
move_8 = Move(Geometry=move_7.Geometry, Motion=X_6)  # -> Geometry, Transform
nurbcrv_5 = NurbsCurve(Points=[move_8.Geometry, projecta.Geometry], Weights=cp_4.Weights, Knots=cp_4.Knots)  # -> Curve, Length, Domain
sift_4 = SiftPattern(List=[nurbcrv_5.Curve, nurbcrv_3.Curve], SiftPattern=and_2)  # -> Output0, Output1
pt2num_9 = PointsToNumbers(Points=move_8.Geometry, Mask=1)
preview_2 = CustomPreview(
    Geometry=sift_4.Output1,
    Shader={diffuse=RGB(255, 165, 0), emission=RGB(76, 76, 76), shine=0.5, specular=RGB(255, 255, 255), transparency=0})

# ----
subtraction_12 = Subtraction(A=pt2num_9, B=addition_2)

# ---- group: Set curves for fore and aft shoulder
shoulder_curve_ratio = Slider(4, range=2..10)
division_9 = Division(A=dam_5.DataA, B=100)
division_10 = Division(A=dam_4.DataB, B=100)

# ----
multiplication_9 = Multiplication(A=eval_21, B=division_10)
multiplication_10 = Multiplication(A=subtraction_12, B=division_9)
subtraction_13 = Subtraction(A=shoulder_curve_ratio, B=1)

# ---- group: Set curves for fore and aft shoulder (continued)
division_11 = Division(A=multiplication_10, B=shoulder_curve_ratio)
division_12 = Division(A=multiplication_9, B=shoulder_curve_ratio)
X_7 = UnitX(Factor=division_11)
X_8 = UnitX(Factor=division_12)  # -> expr("-X", UnitVector)
move_9 = Move(Geometry=move_6.MainframeFwd, Motion=X_7)  # -> Geometry, Transform
move_10 = Move(Geometry=crv_main_frame_aft, Motion=X_8)  # -> Geometry, Transform

# ----
multiplication_11 = Multiplication(A=subtraction_13, B=division_11)
multiplication_12 = Multiplication(A=subtraction_13, B=division_12)

# ---- group: Set curves for fore and aft shoulder (continued)
X_9 = UnitX(Factor=multiplication_11)
X_10 = UnitX(Factor=multiplication_12)  # -> expr("-X", UnitVector)
move_11 = Move(Geometry=move_9.Geometry, Motion=X_9)  # -> Geometry, Transform
move_12 = Move(Geometry=move_10.Geometry, Motion=X_10)  # -> Geometry, Transform

# ---- group: choose combinations of mainframe loft curves. 0=six curves (paralel midship); 4=two curves (Mainframe but no paralel midship
panel_13 = Panel("""1
0
1
1
0
0""")
panel_14 = Panel("""0
0
1
1
1
1""")
panel_15 = Panel("""0
0
1
1
0
0""")
panel_16 = Panel("""1
0
1
1
0
1""")
panel_17 = Panel("""1
1
1
1
1
1""")
filter_2 = StreamFilter(
    Gate=dam_3.DataB,
    Stream0=panel_15,
    Stream1=panel_16,
    Stream2=panel_17,
    Stream3=panel_13,
    Stream4=panel_5,
    Stream5=panel_6,
    Stream6=panel_14)
dispatch_2 = Dispatch(
    List=flatten([move_12.Geometry, move_10.Geometry, crv_main_frame_aft, move_6.MainframeFwd, move_9.Geometry, move_11.Geometry]),
    DispatchPattern=filter_2)  # -> ListA, ListB
sift_5 = SiftPattern(List=dispatch_2.ListA, SiftPattern=and_2)  # -> Output0, Output1

# ---- group: Trims the main frame curves just for the preview
vec_2 = VectorXYZ(XComponent=eval_10, YComponent=expr("x/2+1000", eval_8), ZComponent=eval_6)  # -> Vector, Length
pt_6 = ConstructPoint(XCoordinate=subtraction_7, YCoordinate=0, ZCoordinate=-1000)
box = Box2Pt(PointA=pt_6, PointB=vec_2.Vector, Plane=PlaneXY(0, 0, 0))
trim = TrimWithBrep(Curve=sift_5.Output1, Brep=box)  # -> Inside, Outside
preview_3 = CustomPreview(
    Geometry=trim.Inside,
    Shader={diffuse=RGB(245, 245, 245), emission=RGB(76, 76, 76), shine=0, specular=RGB(255, 255, 255), transparency=0})

# ---- group: scale factors for frames by hand
input_reference_bxd = Curve(scale.Geometry)
box_corners = BoxCorners(Box=input_reference_bxd)  # -> CornerA, CornerB, CornerC, CornerD, CornerE, CornerF, CornerG, CornerH
drec_2 = DeconstuctRectangle(Rectangle=input_reference_bxd)  # -> BasePlane, XInterval, YInterval

# ----
subtraction_14 = Subtraction(A=box_corners.CornerG, B=box_corners.CornerA)
rev = Reverse(Vector=box_corners.CornerA)

# ---- group: scale factors for frames by hand (continued)
pdecon_6 = Deconstruct(Point=subtraction_14)  # -> XComponent, YComponent, ZComponent
division_13 = Division(A=division_2, B=pdecon_6.YComponent)
division_14 = Division(A=eval_17, B=pdecon_6.ZComponent)

# ----
move_13 = Move(Geometry=scale_4.BowIntermediateCurve, Motion=rev)  # -> Geometry, Transform
move_14 = Move(Geometry=scale_2.Geometry, Motion=rev)  # -> Geometry, Transform

# ---- group: stern curve scaling and placement
scale_nu_2 = ScaleNU(Geometry=move_14.Geometry, Plane=PlaneXY(0, 0, 0), ScaleX=1, ScaleY=division_13, ScaleZ=division_14)  # -> Geometry, Transform
cp_6 = ControlPoints(Curve=scale_nu_2.Geometry)  # -> Points, Weights, Knots
pdecon_7 = Deconstruct(Point=cp_6.Points)  # -> XComponent, YComponent, ZComponent
pt_7 = ConstructPoint(XCoordinate=0, YCoordinate=pdecon_7.YComponent, ZCoordinate=pdecon_7.ZComponent)
nurbcrv_6 = NurbsCurve(Points=pt_7, Weights=cp_6.Weights, Knots=cp_6.Knots)  # -> Curve, Length, Domain
X_11 = UnitX(Factor=subtraction_7)
move_15 = Move(Geometry=nurbcrv_6.Curve, Motion=X_11)  # -> Geometry, Transform
sift_6 = SiftPattern(List=move_15.Geometry, SiftPattern=and_2)  # -> Output0, Output1
preview_4 = CustomPreview(
    Geometry=sift_6.Output1,
    Shader={diffuse=RGB(255, 0, 255), emission=RGB(255, 0, 255), shine=0, specular=RGB(255, 255, 255), transparency=0})

# ---- group: Intermediate bow curve scaling and placement
scale_nu_3 = ScaleNU(Geometry=move_13.Geometry, Plane=PlaneXY(0, 0, 0), ScaleX=1, ScaleY=division_13, ScaleZ=division_14)  # -> Geometry, Transform
addition_3 = Addition(A=multiplication_10, B=addition_2)
division_15 = Division(A=dam_5.DataB, B=100)

# ----
subtraction_15 = Subtraction(A=pt2num_9, B=addition_3)
multiplication_13 = Multiplication(A=subtraction_15, B=division_15)

# ---- group: Intermediate bow curve scaling and placement (continued)
addition_4 = Addition(A=addition_3, B=multiplication_13)
X_12 = UnitX(Factor=addition_4)
move_16 = Move(Geometry=scale_nu_3.Geometry, Motion=X_12)  # -> Geometry, Transform
sift_7 = SiftPattern(List=move_16.Geometry, SiftPattern=and_2)  # -> Output0, Output1
preview_5 = CustomPreview(
    Geometry=sift_7.Output1,
    Shader={diffuse=RGB(255, 0, 0), emission=RGB(255, 0, 0), shine=0.5, specular=RGB(255, 255, 255), transparency=0})

# ---- group: Sort loft curves by Xstart
crv = Curve(flatten([nurbcrv_3.Curve, nurbcrv_5.Curve, move_16.Geometry, move_15.Geometry, dispatch_2.ListA]))
end_4 = EndPoints(Curve=crv)  # -> Start, End
pdecon_8 = Deconstruct(Point=end_4.Start)  # -> XComponent, YComponent, ZComponent
sort_3 = SortList(Keys=pdecon_8.XComponent, ValuesA=crv)  # -> flatten(Keys), flatten(ValuesA)

# ---- group: Sort by X and Loft
loft = Loft(Curves=sort_3.ValuesA, Options=loft_opt)

# ----
bbox = BoundingBox(Content=loft, Plane=PlaneXY(0, 0, 0))  # -> Box, Box_2
box_corners_2 = BoxCorners(Box=bbox.Box)  # -> CornerA, CornerB, CornerC, CornerD, CornerE, CornerF, CornerG, CornerH
pt2num_10 = PointsToNumbers(Points=box_corners_2.CornerG, Mask=1)

# ---- group: Cutting Deck
dom_3 = ConstructDomain(DomainStart=expr("1.1*X", subtraction_7), DomainEnd=pt2num_10)
Z_2 = UnitZ(Factor=eval_17)
dom_4 = ConstructDomain(DomainStart=expr("-X", eval_19), DomainEnd=eval_19)
xy_5 = XYPlane(Origin=Z_2)
planesrf_2 = PlaneSurface(Plane=xy_5, XSize=dom_3, YSize=dom_4)

# ----
input_half_hull_surface = Brep(loft)
input_cutting_deck = Brep(planesrf_2)

# ----
# Set the surface direction to down and fwd.
# Needed for functions like
# solid intersection and solid difference.
example_direction = Guide(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)
example_direction_2 = Guide(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)
debrep = DeconstructBrep(Brep=input_cutting_stern)  # -> Faces, Edges, Vertices
debrep_2 = DeconstructBrep(Brep=input_cutting_deck)  # -> Faces, Edges, Vertices
flip = Flip(Surface=debrep.Faces, Guide=example_direction)  # -> Surface, Result
flip_2 = Flip(Surface=debrep_2.Faces, Guide=example_direction_2)  # -> Surface, Result

# ---- group: Flip surface
# Set the surface direction to outward.
# Needed for functions like
# solid intersection and solid difference.
sift_8 = SiftPattern(List=input_half_hull_surface, SiftPattern=flip_loft_surface)  # -> Output0, Output1
flip_3 = Flip(Surface=sift_8.Output0)  # -> Surface, Result
combine_2 = CombineData(Input0=flip_3.Surface, Input1=sift_8.Output1)  # -> Result, Index

# ----
# join hull surfaces if
# multiple Breps are used
join = BrepJoin(Breps=combine_2.Result)  # -> Breps, Closed
join_2 = BrepJoin(Breps=flip.Surface)  # -> Breps, Closed
join_3 = BrepJoin(Breps=flip_2.Surface)  # -> Breps, Closed

# ----
# Cuts the shell by the centerline plane and the deckplane and selects the shell by the location of the COA.
pxs = PlaneThroughShape(Plane=xy_3, Shape=join.Breps, Inflate=1, SectionLogic=False)
pxs_2 = PlaneThroughShape(Plane=Plane(origin=(0, 0, 0), x=(0, 0, 1), y=(1, 0, 0)), Shape=join.Breps, Inflate=1, SectionLogic=False)

area_12 = Area(Geometry=pxs_2)  # -> Area, Centroid
area_13 = Area(Geometry=pxs)  # -> Area, Centroid

scale_6 = Scale(Geometry=pxs_2, Center=area_12.Centroid, Factor=1.5)  # -> Geometry, Transform
scale_7 = Scale(Geometry=pxs, Center=area_13.Centroid, Factor=1.5)  # -> Geometry, Transform
split_3 = SplitBrep(Brep=join.Breps, Cutter=scale_6.Geometry)

split_4 = SplitBrep(Brep=split_3, Cutter=scale_7.Geometry)  # -> flatten(Result)

boxprop = BoxProperties(Box=split_4)  # -> Center, Diagonal, Area, Volume, Degeneracy

pdecon_9 = Deconstruct(Point=boxprop.Center)  # -> XComponent, YComponent, ZComponent
larger = LargerThan(FirstNumber=pdecon_9.YComponent, SecondNumber=0)  # -> LargerThan, OrEqualTo
smaller = SmallerThan(FirstNumber=pdecon_9.ZComponent, SecondNumber=multiplication)  # -> SmallerThan, OrEqualTo
and_3 = GateAnd(A=larger.LargerThan, B=smaller.SmallerThan)
dispatch_3 = Dispatch(List=split_4, DispatchPattern=and_3)  # -> ListA, ListB

# ----
# PS & SB Shell
mirror = Mirror(Geometry=dispatch_3.ListA, Plane=Plane(origin=(0, 0, 0), x=(0, 0, 1), y=(1, 0, 0)))  # -> Geometry, Transform
ps_sb_shell = Brep([mirror.Geometry, dispatch_3.ListA])
join_4 = BrepJoin(Breps=flatten(ps_sb_shell))  # -> Breps, Closed

# ----
# Selects the SB hull (Ysb<Yps)
bbox_2 = BoundingBox(Content=[dispatch_3.ListA, mirror.Geometry], Plane=PlaneXY(0, 0, 0))  # -> Box, Box_2
boxprop_2 = BoxProperties(Box=bbox_2.Box)  # -> Center, Diagonal, Area, Volume, Degeneracy
pt2num_11 = PointsToNumbers(Points=boxprop_2.Center, Mask=6)
list_2 = ValueList({"SB shell": 0, "PS shell": 1}, selected="SB shell")
sort_4 = SortList(Keys=pt2num_11, ValuesA=[dispatch_3.ListA, mirror.Geometry], ValuesB=bbox_2.Box)  # -> Keys, ValuesA, ValuesB
item_9 = ListItem(List=sort_4.ValuesA, Index=list_2, Wrap=True)

# ---- group: SELECTS SHIP SHAPED OR BOX SHAPED
group = Group(Objects=flatten(bbox_2.Box))
bbox_3 = BoundingBox(Content=group, Plane=PlaneXY(0, 0, 0))  # -> Box, Box_2
p_n_c_ship_or_box = PickNChoose(Pattern=dam_2, Stream0=bbox_3.Box, Stream1=join_4.Breps)
item_10 = ListItem(List=sort_4.ValuesB, Index=list_2, Wrap=True)
p_n_c_ship_or_box_2 = PickNChoose(Pattern=dam_2, Stream0=item_10, Stream1=item_9)

# ---- group: Waterplane at zero heel and trim
# Selects the hull cutted by a deck in rhino,
# or the hull by the depth of the loft curves
# (if the deck is not provided or
# if the deck does not intersect the hull.)
Z_3 = UnitZ(T_loading_condition=eval_18)
xy_6 = XYPlane(Origin=Z_3)
sec = BrepPlane(Brep=p_n_c_ship_or_box, Plane=xy_6)  # -> Curves, Points
end_5 = EndPoints(Curve=sec.Curves)  # -> Start, End
ln = Line(StartPoint=end_5.Start, EndPoint=end_5.End)
join_5 = JoinCurves(Curves=[sec.Curves, ln], Preserve=False)
boundary = BoundarySurfaces(Edges=join_5)

# ---- group: Shows solid contour lines
edges = BrepEdges(Brep=p_n_c_ship_or_box)  # -> Naked, Interior, NonManifold
sift_9 = SiftPattern(List=flatten([edges.Naked, edges.Interior]), SiftPattern=toggle_volume_related_output)  # -> Output0, Output1
preview_6 = CustomPreview(
    Geometry=sift_9.Output0,
    Material={diffuse=RGB(255, 255, 255), emission=RGB(76, 76, 76), shine=0, specular=RGB(255, 255, 255), transparency=0.7})

# ----
relay = Relay([edges.Naked, edges.Interior])
area_14 = Area(Geometry=boundary)  # -> Area, Centroid

# ---- group: Waterline with trim and heel
yz_2 = YZPlane(Origin=area_14.Centroid)
rotate = Rotate(Geometry=xy_6, Angle=dam_7.DataA, Plane=yz_2)  # -> Geometry, Transform
xz = XZPlane(Origin=area_14.Centroid)
rotate_2 = Rotate(Geometry=rotate.Geometry, Angle=dam_7.DataB, Plane=xz)  # -> Geometry, Transform
sec_2 = BrepPlane(Brep=p_n_c_ship_or_box, Plane=rotate_2.Geometry)  # -> Curves, Points

# ----
pt2num_12 = PointsToNumbers(Points=area_14.Centroid, Mask=1)

# ---- group: Calculation of Ta and Tf (at loadlines) and Tmirror
pcx_2 = CurvePlane(Curve=move_15.Geometry, Plane=Plane(origin=(0, 0, 0), x=(0, 0, 1), y=(1, 0, 0)))  # -> Points, ParamsC, ParamsP
pt2num_13 = PointsToNumbers(Points=pcx_2.Points, Mask=1)
lpp_2 = Number(flatten(filter_lpp_barge_0_or_ship_1))
eval_26 = Evaluate(F="T-tan(trim)*(x-y)", x=pt2num_12, y=pt2num_13, trim=dam_7.DataB, T=eval_18, Lpp=lpp_2)
eval_27 = Evaluate(F="T-tan(trim)*x", x=pt2num_12, trim=dam_7.DataB, T=eval_18, Lpp=lpp_2)
eval_28 = Evaluate(F="T+tan(trim)*(Lpp-x)", x=pt2num_12, trim=dam_7.DataB, T=eval_18, Lpp=lpp_2)

# ----
# LBH of Bounding Box of SB shell
# Check of Y value of cutting CL
# Should be almost zero
# PS =+
box_corners_3 = BoxCorners(Box=p_n_c_ship_or_box_2)  # -> CornerA, CornerB, CornerC, CornerD, CornerE, CornerF, CornerG, CornerH
pt2num_14 = PointsToNumbers(Points=box_corners_3.CornerE, Mask=11)  # -> expr("ABS(x)", HWrtZ0)
pt2num_15 = PointsToNumbers(Points=box_corners_3.CornerA, Mask=1)
pt2num_16 = PointsToNumbers(Points=box_corners_3.CornerC, Mask=6)

boxprop_3 = BoxProperties(Box=p_n_c_ship_or_box_2)  # -> Center, Diagonal, Area, Volume, Degeneracy
pdecon_10 = Deconstruct(Point=boxprop_3.Diagonal)  # -> XComponent, expr("ABS(x)", YComponent), expr("ABS(x)", ZComponent)

# ---- group: Lpp barge or ship (continued)
loa = Panel(pdecon_10.XComponent)

# ----
panel_18 = Panel(sec_2.Curves)

# ---- group: Shows Centre of Floatation
# Centre of Floatation untrimmed
pdecon_11 = Deconstruct(Point=area_14.Centroid)  # -> XComponent, YComponent, ZComponent; disabled
eval_29 = Evaluate(
    F="Format(\"2. COV_whole_ship_xyz {0:0.000}, {1:0.000}, {2:0.000} m\", x/1000, 0, z/1000)",
    x=pdecon_11.XComponent,
    y=pdecon_11.YComponent,
    z=pdecon_11.ZComponent)  # disabled
panel_19 = Panel("  COF WPA")  # disabled
pt_8 = ConstructPoint(XCoordinate=pdecon_11.XComponent, YCoordinate=0, ZCoordinate=pdecon_11.ZComponent)  # disabled
sift_10 = SiftPattern(List=pt_8, SiftPattern=button_show_centers)  # -> Output0, Output1; disabled
line = LineSDL(Start=sift_10.Output1, Direction=Vector(1196.036814, 0, 1196.036814), Length=expr("x*2", eval_4))  # disabled
panel_20 = Panel(eval_29)  # disabled
markdim = MarkerDimension(Line=line, Text=panel_19, Size=eval_4)  # disabled

# ----
# Waterline of loading condition
# Sorts the largest waterline
# in case of multiple closed waterlines
# Calculation of Lwl and Bwl
bbox_4 = BoundingBox(Content=sec_2.Curves, Plane=PlaneXY(0, 0, 0))  # -> Box, Box_2
boxprop_4 = BoxProperties(Box=bbox_4.Box)  # -> Center, Diagonal, Area, Volume, Degeneracy
sort_5 = SortList(Keys=boxprop_4.Diagonal, ValuesA=bbox_4.Box)  # -> Keys, ValuesA
item_11 = ListItem(List=sort_5.ValuesA, Index=-1, Wrap=True)
box_corners_4 = BoxCorners(Box=item_11)  # -> CornerA, CornerB, CornerC, CornerD, CornerE, CornerF, CornerG, CornerH
dist = Distance(PointA=box_corners_4.CornerA, PointB=box_corners_4.CornerB)  # -> flatten(Distance)
dist_2 = Distance(PointA=box_corners_4.CornerA, PointB=box_corners_4.CornerD)  # -> flatten(Distance)
lpp_3 = Number(flatten(filter_lpp_barge_0_or_ship_1))
eval_30 = Evaluate(F="Lpp*Bwl*T", Lpp=lpp_3, Bwl=dist_2, T=eval_18)
eval_31 = Evaluate(F="Lwl*Bwl*T", Lwl=dist, Bwl=dist_2, T=eval_18)

# ----
# Waterline_Loading_Condition
end_6 = EndPoints(Curve=sec_2.Curves)  # -> Start, End
ln_2 = Line(StartPoint=end_6.Start, EndPoint=end_6.End)
swatch_hull_below_wl = ColourSwatch(SwatchColor=RGB(0, 7, 255))
join_6 = JoinCurves(Curves=flatten([sec_2.Curves, ln_2]), Preserve=False)
waterline = CustomPreview(Geometry=[ln_2, sec_2.Curves], Shader=swatch_hull_below_wl)
bbox_5 = BoundingBox(Content=join_6, Plane=PlaneXY(0, 0, 0))  # -> Box, Box_2
boxprop_5 = BoxProperties(Box=bbox_5.Box)  # -> Center, Diagonal, Area, Volume, Degeneracy
sort_6 = SortList(Keys=boxprop_5.Diagonal, ValuesA=join_6)  # -> Keys, ValuesA
item_12 = ListItem(List=sort_6.ValuesA, Index=-1, Wrap=True)

# ----
# Loadline convention waterline at 0.85D
Z_4 = UnitZ(Tdesign=eval_14)  # disabled
xy_7 = XYPlane(Origin=Z_4)  # disabled
sec_3 = BrepPlane(Brep=p_n_c_ship_or_box_2, Plane=xy_7)  # -> Curves, Points; disabled
mirror_2 = Mirror(Geometry=sec_3.Curves, Plane=Plane(origin=(0, 0, 0), x=(0, 0, 1), y=(1, 0, 0)))  # -> Waterline, Transform; disabled
end_7 = EndPoints(Curve=sec_3.Curves)  # -> Start, End; disabled
end_8 = EndPoints(Curve=mirror_2.Waterline)  # -> Start, End; disabled
swatch_hull_below_wl_2 = ColourSwatch(SwatchColor=RGB(0, 183, 255))  # disabled
ln_3 = Line(StartPoint=end_7.Start, EndPoint=end_8.Start)  # disabled
waterline_2 = CustomPreview(Geometry=[mirror_2.Waterline, sec_3.Curves, ln_3], Shader=swatch_hull_below_wl_2)  # disabled

multiplication_14 = Multiplication(Hoa=pt2num_14, B0999=0.999)
multiplication_15 = Multiplication(Loa=pdecon_10.XComponent, B0999=0.999)
multiplication_16 = Multiplication(Boa=pdecon_10.YComponent, B0999=-0.999)

# ----
# LINESPLAN
panel_21 = Panel(pt2num_16)
sift_11 = SiftPattern(NrOfWL=dam_10.DataB, SiftPattern=toggle_lines_plan)  # -> Output0, Output1
sift_12 = SiftPattern(NrOfFrames=dam_10.DataA, SiftPattern=toggle_lines_plan)  # -> Output0, Output1
sift_13 = SiftPattern(NrOfButtocks=dam_10.DataC, SiftPattern=toggle_lines_plan)  # -> Output0, Output1
sift_14 = SiftPattern(SBShell=p_n_c_ship_or_box_2, SiftPattern=toggle_lines_plan)  # -> Output0, Output1
line_2 = LineSDL(StartPt=box_corners_3.CornerE, Direction=Vector(0, 0, -1), Length=multiplication_14)
line_3 = LineSDL(StartPt=box_corners_3.CornerA, Direction=Vector(1, 0, 0), Length=multiplication_15)
line_4 = LineSDL(StartPt=Point(0, 0, 0), Direction=Vector(0, 1, 0), Length=multiplication_16)
frm = PerpFrames(Curve=line_2, Number=sift_11.Output1, Align=True)  # -> Frames, Parameters
frm_2 = PerpFrames(Curve=line_3, Number=sift_12.Output1, Align=True)  # -> Frames, Parameters
frm_3 = PerpFrames(Curve=line_4, Number=sift_13.Output1, Align=True)  # -> Frames, Parameters
sec_frames = BrepPlane(Brep=sift_14.Output1, Plane=frm_2.Frames)  # -> Curves, Points
split_5 = SplitList(List=flatten(sec_frames.Curves), Index=expr("x/2", sift_12.Output1))  # -> ListA, ListB

# ----
# LBH of Bounding Box of Bare Hull
bbox_6 = BoundingBox(Content=p_n_c_ship_or_box, Plane=PlaneXY(0, 0, 0))  # -> Box, Box_2
box_corners_5 = BoxCorners(Box=bbox_6.Box)  # -> CornerA, CornerB, CornerC, CornerD, CornerE, CornerF, CornerG, CornerH
pdecon_12 = Deconstruct(Point=box_corners_5.CornerG)  # -> XComponent, YComponent, ZComponent
pdecon_13 = Deconstruct(Point=box_corners_5.CornerA)  # -> XComponent, YComponent, ZComponent

sift_15 = SiftPattern(List=p_n_c_ship_or_box, SiftPattern=toggle_volume_related_output)  # -> Output0, Output1
pt_max_xyz_of_bbox_of_bare_hull = Point(box_corners_5.CornerG)
brep_ps_sb_shell_joined = Brep(join_4.Breps)

merge_5 = Merge(Data1=flatten(eval_18), Data2=flatten(eval_27), Data3=flatten(eval_28))  # -> flatten(Result)
panel_22 = Panel("""T moulded
T aft
T fwd
heel""")
division_16 = Division(A=merge_5, B=output_dimension)
merge_6 = Merge(Data1=flatten(division_16), Data2=flatten(heel_deg))  # -> flatten(Result)
panel_23 = Panel("""m
m
m
deg""")
nullrep = ReplaceNulls(Items=merge_6, Replacements=0)  # -> Items, Count
rep_2 = ReplaceText(Text=panel_23, Find="m", Replace=eval_3, RecursiveReplace=False)
eval_32 = Evaluate(F="round(x,z)", x=nullrep.Items, z=nr_of_digits_output)
case_2 = TextCase(Text="Draught Data", Culture=127)  # -> UpperCase, LowerCase
concat_6 = Concatenate(FragmentB=panel_22, FragmentA=" [", FragmentC=rep_2, FragmentD="], ")
concat_7 = Concatenate(FragmentA=concat_6, FragmentB=eval_32)
concat_8 = Concatenate(FragmentA=panel_22, FragmentE=" ", FragmentB=eval_32, FragmentC=" ", FragmentD=rep_2)
loading_condition = Panel([case_2.UpperCase, concat_7])
loading_condition_2 = Panel([case_2.UpperCase, concat_8])

# ----
# Data collecting
panel_24 = Panel("MAIN DIMENSIONS")
merge_7 = Merge(
    Data1=flatten(pdecon_10.XComponent),
    Data2=flatten(eval_19),
    Data3=flatten(eval_17),
    Data4=flatten(filter_lpp_barge_0_or_ship_1),
    Data5=flatten(dist),
    Data6=flatten(eval_21),
    Data7=flatten(addition_2),
    Data8=flatten(eval_11))  # -> flatten(Result)
panel_25 = Panel("""Loa
B
H
Lpp
Lwl
X midship aft
X midship fwd
Bilge Radius""")
division_17 = Division(A=merge_7, B=output_dimension)
nullrep_2 = ReplaceNulls(Items=division_17, Replacements=0)  # -> Items, Count
panel_26 = Panel("""m
m
m
m
m
m
m
m""")
eval_33 = Evaluate(F="round(x,z)", x=nullrep_2.Items, z=nr_of_digits_output)
rep_3 = ReplaceText(Text=panel_26, Find="m", Replace=eval_3, RecursiveReplace=False)
concat_9 = Concatenate(FragmentB=panel_25, FragmentA="[", FragmentC=rep_3, FragmentD="],")
concat_10 = Concatenate(FragmentA=panel_25, FragmentE=" ", FragmentB=eval_33, FragmentC=" ", FragmentD=rep_3)
concat_11 = Concatenate(FragmentA=concat_9, FragmentB=eval_33)
concat_12 = Concatenate(FragmentA=panel_24, FragmentC=concat_group_version_number)
main_dimensions = Panel([panel_24, concat_10])
main_dimensions_2 = Panel([concat_12, concat_11])

# ---- group: LINESPLAN
crv_contour_lines = Curve(relay)

# ---- group: SENT
pt_9 = ConstructPoint(XCoordinate=0, YCoordinate=expr("-x", division_2), ZCoordinate=0)
pt_10 = ConstructPoint(XCoordinate=0, YCoordinate=0, ZCoordinate=eval_18)
X_13 = UnitX(Factor=1)
subtraction_16 = Subtraction(A=dam_10.DataD, B=1)
move_17 = Move(Geometry=pt_10, Motion=X_13)  # -> Geometry, Transform
multiplication_17 = Multiplication(A=subtraction_16, B=dam_10.DataE)
ln_4 = Line(StartPoint=pt_10, EndPoint=pt_9)
lnpt = LinePt(Line=ln_4, Point=move_17.Geometry)
neg = Negative(Value=multiplication_17)
Y_4 = UnitY(Factor=expr("-x", pt_10))
yz_3 = YZPlane(Origin=pt_10)
dom_5 = ConstructDomain(DomainStart=neg, DomainEnd=multiplication_17)
range = Range(Domain=dom_5, Steps=subtraction_16)
angle = Angle(VectorA=Y_4, VectorB=ln_4, Plane=yz_3)  # -> Angle, Reflex
pl_offset = PlaneOffset(BasePlane=lnpt, Offset=range)
combine_3 = CombineData(Input0=pl_offset, Input1=lnpt)  # -> Result, Index
colour_cent = ColourSwatch(SwatchColor=RGB(129, 7, 163))
Y_5 = UnitY(Factor=expr("-x*1.2", division_2))
Z_5 = UnitZ(Factor=expr("-x", eval_18))
addition_5 = Addition(A=Y_5, B=Z_5)
T = Text("Projected Sent")

# ----
# Bake your
# 3D lines plan
# over here
mirror_3 = Mirror(Geometry=split_5.ListA, Plane=Plane(origin=(0, 0, 0), x=(0, 0, 1), y=(1, 0, 0)))  # -> FramesAftShip, Transform
sec_buttocks = BrepPlane(Brep=sift_14.Output1, Plane=frm_3.Frames)  # -> Curves, Points
sec_waterlines = BrepPlane(Brep=sift_14.Output1, Plane=frm.Frames)  # -> Curves, Points
frames_foreship = Curve(split_5.ListB)
sec_sent = BrepPlane(Brep=sift_14.Output1, Plane=combine_3.Result)  # -> Curves, Points

merge_8 = Merge(Data1=mirror_3.FramesAftShip, Data2=frames_foreship)

# ---- group: SENT (continued)
project = Project(Geometry=sec_sent.Curves, Plane=lnpt)  # -> Geometry, Transform
rotate_3 = Rotate(Geometry=flatten(project.Geometry), Angle=expr("-x", angle.Angle), Plane=yz_3)  # -> Geometry, Transform
move_18 = Move(Geometry=rotate_3.Geometry, Motion=flatten(addition_5))  # -> Geometry, Transform
lng_3 = ListLength(List=move_18.Geometry)  # -> expr("x-1", Length)
division_18 = Division(A=lng_3, B=2)
round = Round(Number=division_18)  # -> Nearest, Floor, Ceiling
item_13 = ListItem(List=move_18.Geometry, Index=round.Floor, Wrap=True)
midpt = CurveMiddle(Curve=item_13)
preview_7 = CustomPreview(Geometry=[sec_sent.Curves, move_18.Geometry], Shader=colour_cent)
tag_sent = TextTag3D(Location=midpt, Text=T, Size=eval_4, Colour=colour_cent, Justification=2)

# ---- group: LINESPLAN (continued)
crv_waterlines = Curve(sec_waterlines.Curves)
crv_buttocks = Curve(sec_buttocks.Curves)
crv_sent = Curve([sec_sent.Curves, move_18.Geometry])
crv_frames_aft_fwd = Curve(merge_8)

# ----
preview_8 = CustomPreview(Geometry=sec_waterlines.Curves, Shader=colour_waterlines)
preview_9 = CustomPreview(Geometry=sec_buttocks.Curves, Shader=colour_buttocks)
preview_10 = CustomPreview(Geometry=merge_8, Shader=colour_frames)

# ----
# Angle measurement on Waterline
X_14 = UnitX(Factor=addition_2)
yz_4 = YZPlane(Origin=X_14)
pxs_3 = PlaneThroughShape(Plane=yz_4, Shape=item_12, Inflate=1, SectionLogic=False)
split_6 = SplitWithBrep(Curve=item_12, Brep=pxs_3)  # -> Curve, Points
midpt_2 = CurveMiddle(Curve=split_6.Curve)
division_19 = Division(A=entrance_angle_factor_of_bwl, B=100)
pt2num_17 = PointsToNumbers(Points=midpt_2, Mask=1)
sort_7 = SortList(Keys=pt2num_17, ValuesA=split_6.Curve)  # -> Keys, ValuesA
item_14 = ListItem(List=sort_7.ValuesA, Index=-1, Wrap=True)
pxs_4 = PlaneThroughShape(Plane=Plane(origin=(0, 0, 0), x=(0, 0, 1), y=(1, 0, 0)), Shape=item_14, Inflate=1, SectionLogic=False)
split_7 = SplitWithBrep(Curve=item_14, Brep=pxs_4)  # -> Curve, Points
midpt_3 = CurveMiddle(Curve=split_7.Curve)
pt2num_18 = PointsToNumbers(Points=midpt_3, Mask=11)
sort_8 = SortList(Keys=pt2num_18, ValuesA=split_7.Curve)  # -> Keys, ValuesA
item_15 = ListItem(List=sort_8.ValuesA, Index=-1, Wrap=True)
end_9 = EndPoints(Curve=item_15)  # -> Start, End
pt2num_19 = PointsToNumbers(Points=[end_9.Start, end_9.End], Mask=3)
pt2num_20 = NumbersToPoints(Numbers=pt2num_19, Mask=3)
dispatch_4 = Dispatch(List=pt2num_20, DispatchPattern=[True, False])  # -> ListA, ListB
ln_5 = Line(StartPoint=dispatch_4.ListB, EndPoint=dispatch_4.ListA)

multiplication_18 = Multiplication(HalfBm=division_2, B=division_19)

Y_6 = UnitY(Factor=expr("-x", multiplication_18))
Y_7 = UnitY(Factor=multiplication_18)
xz_2 = XZPlane(Origin=[Y_7, Y_6])
pcx_3 = CurvePlane(Curve=item_15, Plane=xz_2)  # -> Points, ParamsC, ParamsP
null_2 = NullItem(Item=flatten(pcx_3.ParamsC))  # -> NullFlags, InvalidFlags, Description
dispatch_5 = Dispatch(List=flatten(pcx_3.ParamsC), DispatchPattern=null_2.NullFlags)  # -> ListA, ListB
eval_34 = EvaluateCurve(Curve=item_15, Parameter=dispatch_5.ListB)  # -> Point, expr("-x", Tangent), Angle
line_5 = LineSDL(Start=eval_34.Point, Direction=eval_34.Tangent, Length=eval_5)
end_10 = EndPoints(Curve=line_5)  # -> Start, End
line_6 = LineSDL(Start=eval_34.Point, Direction=ln_5, Length=eval_5)
angle_2 = Angle(VectorA=eval_34.Tangent, VectorB=line_6)  # -> Angle, Reflex
deg = Degrees(Radians=angle_2.Angle)
end_11 = EndPoints(Curve=line_6)  # -> Start, End
sift_16 = SiftPattern(List=eval_34.Point, SiftPattern=toggle_show_waterline_angle)  # -> Output0, Output1
eval_35 = Evaluate(F="min(x,180-x)", x=deg)
angledim = AngularDimension(Center=sift_16.Output1, PointA=end_11.End, PointB=end_10.End, Reflex=False, Text="{0:0.00}°", Size=eval_4)

eval_36 = Evaluate(F="round(x,z)", x=eval_35, y=output_dimension, z=nr_of_digits_output)
eval_37 = Evaluate(F="round(x,z)", x=entrance_angle_factor_of_bwl, y=output_dimension, z=nr_of_digits_output)
eval_38 = Evaluate(F="round(x/(y^1),z)", x=eval_34.Point, y=output_dimension, z=nr_of_digits_output)
panel_27 = Panel("""Waterline Entrace angle
Location of WEA
XYZ location of WEA""")
merge_9 = Merge(Data1=flatten(eval_36), Data2=flatten(eval_37), Data3=flatten(eval_38))  # -> flatten(Result)
nullrep_3 = ReplaceNulls(Items=merge_9, Replacements=0)  # -> Items, Count
rep_4 = ReplaceText(Text=nullrep_3.Items, Find="{", RecursiveReplace=False)
panel_28 = Panel("""deg
%Bwl
m""")
rep_5 = ReplaceText(Text=rep_4, Find="}", RecursiveReplace=False)
case_3 = TextCase(Text="Waterline entrance angle", Culture=127)  # -> UpperCase, LowerCase
rep_6 = ReplaceText(Text=panel_28, Find="m", Replace=eval_3, RecursiveReplace=False)
concat_13 = Concatenate(FragmentB=panel_27, FragmentA=" [", FragmentC=rep_6, FragmentD="], ")
concat_14 = Concatenate(FragmentA=panel_27, FragmentE=" ", FragmentB=rep_5, FragmentD=" ", FragmentC=rep_6)
concat_15 = Concatenate(FragmentA=concat_13, FragmentB=rep_5)
waterline_entrance_angle = Panel([case_3.UpperCase, concat_15])
waterline_entrance_angle_2 = Panel([case_3.UpperCase, concat_14])

deck = Brep(join_3.Breps)
stern = Brep(join_2.Breps)

# ----
# LBH of Bounding Box of stern
bbox_7 = BoundingBox(Content=stern, Plane=PlaneXY(0, 0, 0))  # -> Box, Box_2
box_corners_6 = BoxCorners(Box=bbox_7.Box)  # -> CornerA, CornerB, CornerC, CornerD, CornerE, CornerF, CornerG, CornerH
pdecon_14 = Deconstruct(Point=box_corners_6.CornerG)  # -> XComponent, YComponent, ZComponent
pdecon_15 = Deconstruct(Point=box_corners_6.CornerA)  # -> XComponent, YComponent, ZComponent

# ----
# LBH of Bounding Box of deck
bbox_8 = BoundingBox(Content=deck, Plane=PlaneXY(0, 0, 0))  # -> Box, Box_2
box_corners_7 = BoxCorners(Box=bbox_8.Box)  # -> CornerA, CornerB, CornerC, CornerD, CornerE, CornerF, CornerG, CornerH
pdecon_16 = Deconstruct(Point=box_corners_7.CornerA)  # -> XComponent, YComponent, ZComponent
pdecon_17 = Deconstruct(Point=box_corners_7.CornerG)  # -> XComponent, YComponent, ZComponent

eval_39 = Evaluate(F="(X+Y)/2", x=pdecon_15.ZComponent, y=pdecon_13.ZComponent)
eval_40 = Evaluate(F="(X+Y)/2", x=pdecon_16.YComponent, y=pdecon_13.YComponent)
eval_41 = Evaluate(F="(X+Y)/2", x=pdecon_12.XComponent, y=pdecon_17.XComponent)
eval_42 = Evaluate(F="(X+Y)/2", x=pdecon_16.XComponent, y=pdecon_13.XComponent)
eval_43 = Evaluate(F="(X+Y)/2", x=pdecon_17.YComponent, y=pdecon_12.YComponent)
min = Minimum(A=pdecon_15.XComponent, B=pdecon_13.XComponent)
eval_44 = Evaluate(F="(X+Y)/2", x=pdecon_14.ZComponent, y=pdecon_13.ZComponent)
eval_45 = Evaluate(F="(X+Y)/2", x=pdecon_15.ZComponent, y=pdecon_13.ZComponent)
eval_46 = Evaluate(F="(X+Y)/2", x=pdecon_15.YComponent, y=pdecon_13.YComponent)
eval_47 = Evaluate(F="(X+Y)/2", x=pdecon_12.XComponent, y=pdecon_17.XComponent)
eval_48 = Evaluate(F="(X+Y)/2", x=pdecon_14.YComponent, y=pdecon_12.YComponent)
pt_11 = ConstructPoint(XCoordinate=expr("1.1*x", eval_41), YCoordinate=eval_43, ZCoordinate=pdecon_17.ZComponent)
pt_12 = ConstructPoint(XCoordinate=eval_42, YCoordinate=eval_40, ZCoordinate=pdecon_15.ZComponent)
pt_13 = ConstructPoint(XCoordinate=expr("1.1*x", eval_47), YCoordinate=eval_48, ZCoordinate=pdecon_14.ZComponent)
pt_14 = ConstructPoint(XCoordinate=min, YCoordinate=eval_46, ZCoordinate=eval_45)
box_2 = Box2Pt(PointA=pt_12, PointB=pt_11, Plane=PlaneXY(0, 0, 0))
box_3 = Box2Pt(PointA=pt_14, PointB=pt_13, Plane=PlaneXY(0, 0, 0))

# ----
# Box with stern
sdiff = SolidDifference(BrepsA=box_3, BrepsB=stern)

# ----
# Box with deck
sdiff_2 = SolidDifference(BrepsA=box_2, BrepsB=deck)

# ----
# Box with deck and stern
sint_4 = SolidIntersection(BrepsA=sdiff, BrepsB=sdiff_2)

# ----
# SOLID HULL
# Right click on the above.
# Choose "Bake".
# Select the layer to bake in
sint_5 = SolidIntersection(BrepsA=sint_4, BrepsB=sift_15.Output1)
filter_3 = StreamFilter(Gate=toggle_solidhull_direct_from_rhino, Stream0=sint_5, Stream1=brep_solid_hull)

# ---- group: Shows solid contour lines
edges_2 = BrepEdges(Brep=sint_5)  # -> Naked, Interior, NonManifold
preview_11 = CustomPreview(
    Geometry=edges_2.Interior,
    Material={diffuse=RGB(255, 255, 255), emission=RGB(0, 0, 0), shine=0, specular=RGB(255, 255, 255), transparency=0})

# ----
solid_hull = Brep(filter_3)

# ---- group: Box for draught
# Box for Draught
t_moulded_loading_condition = Number(eval_18)
pdecon_18 = Deconstruct(Point=box_corners_3.CornerA)  # -> XComponent, YComponent, ZComponent
pdecon_19 = Deconstruct(Point=box_corners_3.CornerG)  # -> XComponent, YComponent, ZComponent
pt_15 = ConstructPoint(
    XCoordinate=expr("x-20000", pdecon_18.XComponent),
    YCoordinate=expr("-x", pdecon_18.YComponent),
    ZCoordinate=t_moulded_loading_condition)
pt_16 = ConstructPoint(XCoordinate=pdecon_19.XComponent, YCoordinate=pdecon_18.YComponent, ZCoordinate=-20000)
box_4 = Box2Pt(PointA=pt_15, PointB=pt_16, Plane=PlaneXY(0, 0, 0))

# ----
pt_17 = ConstructPoint(XCoordinate=expr("x-20000", pdecon_18.XComponent), YCoordinate=0, ZCoordinate=t_moulded_loading_condition)

# ---- group: Box for draught (continued)
scale_nu_4 = ScaleNU(Geometry=box_4, Plane=pt_17, ScaleX=1.2, ScaleY=1.1, ScaleZ=1.1)  # -> Geometry, Transform

# ---- group: Simplified trim and heel. Only valid for small angles (<7 deg)
rotate_4 = Rotate(Geometry=scale_nu_4.Geometry, Angle=dam_7.DataA, Plane=yz_2)  # -> Geometry, Transform
rotate_5 = Rotate(Geometry=rotate_4.Geometry, Angle=dam_7.DataB, Plane=xz)  # -> Geometry, Transform

# ---- group: Box for draught (continued)
box_corners_8 = BoxCorners(Box=rotate_5.Geometry)  # -> CornerA, CornerB, CornerC, CornerD, CornerE, CornerF, CornerG, CornerH

# ---- group: Box of aft, mid, fore-ship over full Depth
xstern_startmidship_startforeship_lpp = Panel([subtraction_7, eval_21, addition_2, filter_lpp_0_or_lpp_1])
pdecon_20 = Deconstruct(Point=pt_max_xyz_of_bbox_of_bare_hull)  # -> XComponent, expr("-X", YComponent), ZComponent
item_16 = ListItem(List=xstern_startmidship_startforeship_lpp, Index=0, Wrap=True)
pt2num_21 = PointsToNumbers(Points=box_corners_8.CornerD, Mask=11)
pt_18 = ConstructPoint(XCoordinate=expr("x-1000", item_16), YCoordinate=0, ZCoordinate=pt2num_21)
pt_19 = ConstructPoint(
    XCoordinate=expr("X+1000", pdecon_20.XComponent),
    YCoordinate=expr("1.1*x", pdecon_20.YComponent),
    ZCoordinate=expr("x+1000", pdecon_20.ZComponent))
box_5 = Box2Pt(PointA=pt_18, PointB=pt_19, Plane=PlaneXY(0, 0, 0))

# ---- group: Only buoyant calculation
sift_17 = SiftPattern(List=sift_15.Output0, SiftPattern=toggle_calculate_at_least_the_buoyant_vo)  # -> Output0, Output1
sint_6 = SolidIntersection(BrepsA=sint_4, BrepsB=sift_17.Output1)
sint_7 = SolidIntersection(BrepsA=rotate_5.Geometry, SolidHull=sint_6)

# ----
# Half solid of under water hull
# Right click on the above.
# Choose "Bake".
# Select the layer to bake in
sint_8 = SolidIntersection(BrepsA=rotate_5.Geometry, SolidHull=filter_3)
# Whole hull
combine_4 = CombineData(Input0=sint_8, Input1=sint_7)  # -> Result, Index

# ----
# Note: A half hull requires less computational time
# Half solid of
# whole, aft, mid and fore ship
sift_18 = SiftPattern(List=box_5, SiftPattern=bool_volume_related_output)  # -> Output0, Output1
sint_9 = SolidIntersection(BrepsA=sift_18.Output1, SolidHull=filter_3)

# ----
# Buoyancy volume
# or Carene Volume
# Whole hull
volume_2 = Volume(Geometry=combine_4.Result)  # -> Volume, Centroid

# ---- group: Volume of selection
# Volume and .....
# Half whole hull
volume_3 = Volume(Geometry=sint_9)  # -> Volume, Centroid

# ----
# Cb by Lwl and Lpp
division_20 = Division(A=volume_2.Volume, LBT=eval_30)
division_21 = Division(A=volume_2.Volume, B=eval_31)

# ---- group: BoundingBox data of selections
bbox_9 = BoundingBox(Content=sint_8, Plane=PlaneXY(0, 0, 0))  # -> Box, Box_2
bbox_10 = BoundingBox(Content=sint_9, Plane=PlaneXY(0, 0, 0))  # -> Box, Box_2
box_corners_9 = BoxCorners(Box=bbox_9.Box)  # -> AMinXYZ, flatten(CornerB), CornerC, CornerD, CornerE, CornerF, GMaxXYZ, CornerH
box_corners_10 = BoxCorners(Box=bbox_10.Box)  # -> AMinXYZ, flatten(CornerB), CornerC, CornerD, CornerE, CornerF, GMaxXYZ, CornerH
pt2num_22 = PointsToNumbers(Points=[box_corners_9.AMinXYZ, box_corners_9.GMaxXYZ], Mask=1)
pt2num_23 = PointsToNumbers(Points=[box_corners_10.AMinXYZ, box_corners_10.GMaxXYZ], Mask=1)  # -> flatten(Numbers)

# ----
sift_19 = SiftPattern(List=sint_8, SiftPattern=and)  # -> Output0, Output1

# ---- group: X division method 1: evenly devided
number_of_segments_21_22_ordinates = Integer(21)
ln_6 = Line(StartPoint=box_corners_10.AMinXYZ, EndPoint=box_corners_10.CornerB)
ln_7 = Line(StartPoint=box_corners_9.AMinXYZ, EndPoint=box_corners_9.CornerB)
frm_4 = PerpFrames(Curve=ln_6, Number=number_of_segments_21_22_ordinates, Align=True)  # -> Frames, Parameters
frm_5 = PerpFrames(Curve=ln_7, Number=number_of_segments_21_22_ordinates, Align=True)  # -> Frames, Parameters

# ----
half_solid_of_under_water_hull = Brep(sint_8)

# ---- group: Centre of Buoyancy
pdecon_21 = Deconstruct(Point=volume_2.Centroid)  # -> XComponent, YComponent, ZComponent
pt_20 = ConstructPoint(XCoordinate=pdecon_21.XComponent, YCoordinate=0, ZCoordinate=pdecon_21.ZComponent)

# ----
sift_20 = SiftPattern(List=pt_20, SiftPattern=button_show_centers)  # -> Output0, Output1

# ---- group: Centre of Buoyancy (continued)
line_7 = LineSDL(Start=sift_20.Output1, Direction=Vector(1196.036814, 0, 1196.036814), Length=expr("x*2", eval_4))
markdim_2 = MarkerDimension(Line=line_7, Text="  COB whole ship", Size=eval_4)

# ---- group: Centre of volume
# Centre of Volume
pdecon_22 = Deconstruct(Point=volume_3.Centroid)  # -> XComponent, YComponent, ZComponent
pt_21 = ConstructPoint(XCoordinate=pdecon_22.XComponent, YCoordinate=0, ZCoordinate=pdecon_22.ZComponent)

# ----
sift_21 = SiftPattern(List=pt_21, SiftPattern=button_show_centers)  # -> Output0, Output1

# ---- group: Centre of volume (continued)
line_8 = LineSDL(Start=sift_21.Output1, Direction=Vector(1196.036814, 0, 1196.036814), Length=expr("x*2", eval_4))
markdim_3 = MarkerDimension(Line=line_8, Text="  COV whole ship", Size=eval_4)

# ----
eval_49 = Evaluate(F="round(x,z)", x=division_21, y=output_dimension, z=nr_of_digits_output)
eval_50 = Evaluate(F="round(x/(y^1),z)", x=pt_21, y=output_dimension, z=nr_of_digits_output)
eval_51 = Evaluate(F="round(x/(y^3),z)", x=volume_2.Volume, y=output_dimension, z=nr_of_digits_output)
eval_52 = Evaluate(F="round(x/(y^1),z)", x=pt_20, y=output_dimension, z=nr_of_digits_output)
eval_53 = Evaluate(F="round(x,z)", x=division_20, y=output_dimension, z=nr_of_digits_output)
eval_54 = Evaluate(F="round((x*2)/(y^3),z)", x=volume_3.Volume, y=output_dimension, z=nr_of_digits_output)
panel_29 = Panel("""Buoyant Volume
Total Volume
COB
COV Total
Cb_pp
Cb_wl""")
merge_10 = Merge(
    Data1=flatten(eval_51),
    Data2=flatten(eval_54),
    Data3=flatten(eval_52),
    Data4=flatten(eval_50),
    Data5=flatten(eval_53),
    Data6=flatten(eval_49))  # -> flatten(Result)
nullrep_4 = ReplaceNulls(Items=merge_10, Replacements=0)  # -> Items, Count
panel_30 = Panel("""m3
m3
m
m
-
-""")
rep_7 = ReplaceText(Text=nullrep_4.Items, Find="{", RecursiveReplace=False)
rep_8 = ReplaceText(Text=panel_30, Find="m", Replace=eval_3, RecursiveReplace=False)
case_4 = TextCase(Text="Volume Related Data (moulded)", Culture=127)  # -> UpperCase, LowerCase
rep_9 = ReplaceText(Text=rep_7, Find="}", RecursiveReplace=False)
concat_16 = Concatenate(FragmentB=panel_29, FragmentA=" [", FragmentC=rep_8, FragmentD="], ")
concat_17 = Concatenate(FragmentA=concat_16, FragmentB=rep_9)
concat_18 = Concatenate(FragmentA=panel_29, FragmentE=" ", FragmentB=rep_9, FragmentC=" ", FragmentD=rep_8)
volume_data = Panel([case_4.UpperCase, concat_17])
volume_data_2 = Panel([case_4.UpperCase, concat_18])

# ---- group: Volume Waterballast tank 2
# Volume waterballasttank 2
# Finds the water plane surface by the closest point
# to the water plane
# Set a value of 0 at empty lists
# Sums the  two areas
# (in case of a bulb)
# Number of section of ballast tank based on Lpp/3
# Manual number of sections of ballast tank (Manual if Z > 0)
equals_5 = Equality(FirstNumber=dam_13.DataB, SecondNumber=0)  # -> Equality, Inequality
sift_22 = SiftPattern(List=dam_12.DataB, SiftPattern=bool_volume_related_output)  # -> Output0, Output1
tank2_outline = ColourSwatch(SwatchColor=RGB(127, 255, 199))
int_z = Slider(0, range=0..10)
and_4 = GateAnd(A=button_show_cross_sections, B=toggle_show_tanks)
T_2 = Text("Tank 2")
sift_23 = SiftPattern(List=T_2, SiftPattern=and)  # -> Output0, Output1

# ---- group: Volume Waterballast tank 1
# Volume waterballasttank 1
# Finds the water plane surface by the closest point
# to the water plane
# Sums the  two areas
# (in case of a bulb)
# Set a value of 0 at empty lists
# Number of section of ballast tank based on Lpp/3
# Manual number of sections of ballast tank (Manual if Z > 0)
equals_6 = Equality(FirstNumber=dam_13.DataA, SecondNumber=0)  # -> Equality, Inequality
sift_24 = SiftPattern(List=dam_12.DataA, SiftPattern=bool_volume_related_output)  # -> Output0, Output1
tank1_outline = ColourSwatch(SwatchColor=RGB(0, 127, 0))
water_ballast = ColourSwatch(SwatchColor=RGBA(0, 187, 255, 62))
int_z_2 = Slider(0, range=0..10)
and_5 = GateAnd(A=button_show_cross_sections, B=toggle_show_tanks)
T_3 = Text("Tank 1")
sift_25 = SiftPattern(List=T_3, SiftPattern=and)  # -> Output0, Output1

# ---- group: Volume Waterballast tank 3
# Volume waterballasttank 3
# Finds the water plane surface by the closest point
# to the water plane
# Sums the  two areas
# (in case of a bulb)
# Set a value of 0 at empty lists
# Number of section of ballast tank based on Lpp/3
# Manual number of sections of ballast tank (Manual if Z > 0)
sift_26 = SiftPattern(List=dam_12.DataC, SiftPattern=bool_volume_related_output)  # -> Output0, Output1
equals_7 = Equality(FirstNumber=dam_13.DataC, SecondNumber=0)  # -> Equality, Inequality
tank3_outline = ColourSwatch(SwatchColor=RGB(0, 255, 255))
int_z_3 = Slider(0, range=0..10)
and_6 = GateAnd(A=button_show_cross_sections, B=toggle_show_tanks)
T_4 = Text("Tank 3")
sift_27 = SiftPattern(List=T_4, SiftPattern=and)  # -> Output0, Output1

# ---- group: Tanks Solids
# Tank solids
sint_10 = SolidIntersection(BrepsA=filter_3, BrepsB=sift_26.Output1)
sint_11 = SolidIntersection(BrepsA=filter_3, BrepsB=sift_22.Output1)
sint_12 = SolidIntersection(BrepsA=filter_3, BrepsB=sift_24.Output1)

# ----
sift_28 = SiftPattern(List=sint_11, SiftPattern=toggle_tank_diagrams_volume_data)  # -> Output0, Output1
sift_29 = SiftPattern(List=sint_12, SiftPattern=toggle_tank_diagrams_volume_data)  # -> Output0, Output1
sift_30 = SiftPattern(List=sint_10, SiftPattern=toggle_tank_diagrams_volume_data)  # -> Output0, Output1

solids_of_tanks = Brep([sint_12, sint_11, sint_10])

# ---- group: Volume Waterballast tank 3 (continued)
edges_3 = BrepEdges(Brep=sint_10)  # -> Naked, Interior, NonManifold
bang = ExplodeTree(Data=sint_10)  # -> _000000, Branch1, Branch2
sift_31 = SiftPattern(List=sint_10, SiftPattern=equals_7.Inequality)  # -> Output0, Output1
bang_2 = ExplodeTree(Data=sift_31.Output1)  # -> _000000, Branch1, Branch2
box_corners_11 = BoxCorners(Box=bang._000000)  # -> AMinXYZ, CornerB, CornerC, CornerD, CornerE, CornerF, GMaxXYZ, CornerH
boxprop_6 = BoxProperties(Box=bang._000000)  # -> Center, Diagonal, Area, Volume, Degeneracy
pdecon_23 = Deconstruct(Point=boxprop_6.Diagonal)  # -> XComponent, YComponent, ZComponent
pt2num_24 = PointsToNumbers(Points=box_corners_11.GMaxXYZ, Mask=11)
pt2num_25 = PointsToNumbers(Points=box_corners_11.GMaxXYZ, Mask=1)
pt2num_26 = PointsToNumbers(Points=box_corners_11.AMinXYZ, Mask=11)
pt2num_27 = PointsToNumbers(Points=box_corners_11.AMinXYZ, Mask=1)
eval_55 = Evaluate(F="H_tank*Filling/100+TankBottom", H_tank=pdecon_23.ZComponent, Filling=dam_13.DataC, TankBottom=pt2num_26)
Z_6 = UnitZ(Factor=eval_55)
xy_8 = XYPlane(Origin=Z_6)
sift_32 = SiftPattern(List=edges_3.Interior, SiftPattern=toggle_show_tanks)  # -> Output0, Output1
preview_12 = CustomPreview(Geometry=sift_32.Output1, Material=tank3_outline)
larger_2 = LargerThan(FirstNumber=pdecon_23.XComponent, SecondNumber=expr("x/3", filter_lpp_0_or_lpp_1))  # -> LargerThan, OrEqualTo

# ---- group: contour waterplanes Tank with trim and heel
num2pt = NumbersToPoints(Numbers=pt2num_24, Mask=11)
num2pt_2 = NumbersToPoints(Numbers=pt2num_26, Mask=11)
vec2pt = Vector2Pt(PointA=num2pt_2, PointB=num2pt, Unitize=False)  # -> Vector, Length
round_2 = Round(Number=pt2num_24)  # -> Nearest, Floor, Ceiling
subtraction_17 = Subtraction(A=vec2pt.Length, B=tankheight_deduction_for_tank_diagrams, C=tankheight_deduction_for_tank_diagrams)
subtraction_18 = Subtraction(A=round_2.Floor, B=tankheight_deduction_for_tank_diagrams)
round_3 = Round(Number=subtraction_17)  # -> Nearest, Floor, Ceiling
num2pt_3 = NumbersToPoints(Numbers=subtraction_18, Mask=11)
vrot = Rotate(Vector=vec2pt.Vector, Axis=Vector(1, 0, 0), Angle=dam_7.DataA)
division_22 = Division(A=round_3.Floor, B=dam)
vrot_2 = Rotate(Vector=vrot, Axis=Vector(0, 1, 0), Angle=expr("-x", dam_7.DataB))
contour = Contour(Shape=sift_30.Output1, Point=num2pt_3, Direction=vrot_2, Distance=division_22)
sift_33 = SiftPattern(List=contour, SiftPattern=toggle_show_wp_sections_for_tankdiagrams)  # -> Output0, Output1
preview_13 = CustomPreview(Geometry=sift_33.Output1, Material=tank3_outline)

# ---- group: Volume Waterballast tank 3 / waterplane tank at no even keel
pxs_5 = PlaneThroughShape(Plane=xy_8, Shape=bang_2._000000, Inflate=1, SectionLogic=False)
sec_4 = BrepPlane(Brep=bang_2._000000, Plane=pxs_5)  # -> Curves, Points
boundary_2 = BoundarySurfaces(Edges=sec_4.Curves)

# ---- group: Checks if curves are closed
cls = Closed(Curve=contour)  # -> Closed, Periodic
dispatch_6 = Dispatch(List=contour, DispatchPattern=cls.Closed)  # -> ListA, ListB
clean = CleanTree(RemoveNulls=True, RemoveInvalid=True, RemoveEmpty=True, Tree=dispatch_6.ListA)

# ---- group: Tankdigram data of Volume
planar = Planar(Curve=clean)  # -> Planar, Plane, Deviation
pxs_6 = PlaneThroughShape(Plane=planar.Plane, Shape=sift_30.Output1, Inflate=1, SectionLogic=False)
split_8 = SplitBrep(Brep=sift_30.Output1, Cutter=pxs_6)
boxprop_7 = BoxProperties(Box=split_8)  # -> Center, Diagonal, Area, Volume, Degeneracy
pt2num_28 = PointsToNumbers(Points=boxprop_7.Center, Mask=11)
sort_9 = SortList(Keys=pt2num_28, ValuesA=split_8, ValuesB=boxprop_7.Diagonal)  # -> Keys, ValuesA, ValuesB
item_17 = ListItem(List=sort_9.ValuesA, Index=0, Wrap=True)
cap_tankfilling_brep = CapHoles(Brep=item_17)
item_18 = ListItem(List=flatten(cap_tankfilling_brep), Index=Slider(0, range=0..10), Wrap=True)  # disabled
volume_4 = Volume(Geometry=simplify(cap_tankfilling_brep))  # -> Volume, Centroid
nullrep_5 = ReplaceNulls(Items=volume_4.Volume, Replacements=0)  # -> Items, Count

# ---- group: tankfilling (approx. when trim or heel)
end_12 = EndPoints(Curve=clean)  # -> Start, End
pdecon_24 = Deconstruct(Point=end_12.Start)  # -> XComponent, YComponent, ZComponent
subtraction_19 = Subtraction(A=pdecon_24.ZComponent, B=pt2num_26)
division_23 = Division(A=subtraction_19, B=pdecon_23.ZComponent)
multiplication_19 = Multiplication(A=division_23, B=100)
eval_56 = Evaluate(F="round(x,z)", x=multiplication_19, z=nr_of_digits_output)

# ---- group: Shows the curve of the progression of the center of volume of the tankdiagram
sift_34 = SiftPattern(List=volume_4.Centroid, SiftPattern=toggle_show_tank_cov_curves)  # -> Output0, Output1
intcrv = Interpolate(Vertices=flatten(sift_34.Output1), Degree=3, Periodic=False, KnotStyle=1)  # -> Curve, Length, Domain
dots = DotDisplay(Point=sift_34.Output1, Colour=tank3_outline, Size=100)
curve_preview = CustomCurvePreview(Curve=intcrv.Curve, Linetype=<geometry referenced from the Rhino model>, Colour=tank3_outline)

# ---- group: Tank crosses in top view
sift_35 = SiftPattern(List=[box_corners_11.CornerE, box_corners_11.CornerF], SiftPattern=toggle_show_tanks)  # -> Output0, Output1
sift_36 = SiftPattern(List=sint_10, SiftPattern=toggle_show_tanks)  # -> Output0, Output1
ln_8 = Line(StartPoint=sift_35.Output1, EndPoint=[box_corners_11.GMaxXYZ, box_corners_11.CornerH])
trim_2 = TrimWithBrep(Curve=ln_8, Brep=sift_36.Output1)  # -> Inside, Outside
curve_preview_2 = CustomCurvePreview(Curve=trim_2.Inside, Linetype=<geometry referenced from the Rhino model>, Colour=tank3_outline)

# ---- group: Eenheden conversie
eval_57 = Evaluate(F="round(x/(y^3),z)", x=nullrep_5.Items, y=output_dimension, z=nr_of_digits_output)
eval_58 = Evaluate(F="round(x/(y^1),z)", x=volume_4.Centroid, y=output_dimension, z=nr_of_digits_output)
eval_59 = Evaluate(F="round(x/(y^1),z)", x=subtraction_19, y=output_dimension, z=nr_of_digits_output)
comma = FragmentA(",")
pdecon_25 = Deconstruct(Point=eval_58)  # -> XComponent, YComponent, ZComponent
nullrep_6 = ReplaceNulls(Items=eval_59, Replacements=0)  # -> Items, Count
nullrep_7 = ReplaceNulls(Items=pdecon_25.YComponent, Replacements=0)  # -> Items, Count
nullrep_8 = ReplaceNulls(Items=pdecon_25.ZComponent, Replacements=0)  # -> Items, Count
nullrep_9 = ReplaceNulls(Items=pdecon_25.XComponent, Replacements=0)  # -> Items, Count
concat_19 = Concatenate(
    FragmentB=flatten(nullrep_6.Items),
    FragmentA=comma,
    FragmentC=flatten(eval_56),
    FragmentD=comma,
    FragmentE=flatten(eval_57),
    FragmentF=comma,
    FragmentG=flatten(nullrep_9.Items),
    FragmentH=comma,
    FragmentI=flatten(nullrep_7.Items),
    FragmentJ=comma,
    FragmentK=flatten(nullrep_8.Items))

# ---- group: Volume Waterballast tank 2 (continued)
sift_37 = SiftPattern(List=sint_11, SiftPattern=equals_5.Inequality)  # -> Output0, Output1
bang_3 = ExplodeTree(Data=sint_11)  # -> _000000, Branch1, Branch2
edges_4 = BrepEdges(Brep=sint_11)  # -> Naked, Interior, NonManifold
boxprop_8 = BoxProperties(Box=bang_3._000000)  # -> Center, Diagonal, Area, Volume, Degeneracy
box_corners_12 = BoxCorners(Box=bang_3._000000)  # -> AMinXYZ, CornerB, CornerC, CornerD, CornerE, CornerF, GMaxXYZ, CornerH
bang_4 = ExplodeTree(Data=sift_37.Output1)  # -> _000000, Branch1, Branch2
pt2num_29 = PointsToNumbers(Points=box_corners_12.GMaxXYZ, Mask=11)
pt2num_30 = PointsToNumbers(Points=box_corners_12.GMaxXYZ, Mask=1)
pdecon_26 = Deconstruct(Point=boxprop_8.Diagonal)  # -> XComponent, YComponent, ZComponent
pt2num_31 = PointsToNumbers(Points=box_corners_12.AMinXYZ, Mask=11)
pt2num_32 = PointsToNumbers(Points=box_corners_12.AMinXYZ, Mask=1)
eval_60 = Evaluate(F="H_tank*Filling/100+TankBottom", H_tank=pdecon_26.ZComponent, Filling=dam_13.DataB, TankBottom=pt2num_31)
Z_7 = UnitZ(Factor=eval_60)
xy_9 = XYPlane(Origin=Z_7)
sift_38 = SiftPattern(List=edges_4.Interior, SiftPattern=toggle_show_tanks)  # -> Output0, Output1
preview_14 = CustomPreview(Geometry=sift_38.Output1, Material=tank2_outline)
larger_3 = LargerThan(FirstNumber=pdecon_26.XComponent, SecondNumber=expr("x/3", filter_lpp_0_or_lpp_1))  # -> LargerThan, OrEqualTo

# ---- group: Volume Waterballast tank 2 / waterplane tank at no even keel
pxs_7 = PlaneThroughShape(Plane=xy_9, Shape=bang_4._000000, Inflate=1, SectionLogic=False)
sec_5 = BrepPlane(Brep=bang_4._000000, Plane=pxs_7)  # -> Curves, Points
boundary_3 = BoundarySurfaces(Edges=sec_5.Curves)

# ---- group: Tank crosses in top view
sift_39 = SiftPattern(List=[box_corners_12.CornerE, box_corners_12.CornerF], SiftPattern=toggle_show_tanks)  # -> Output0, Output1
sift_40 = SiftPattern(List=sint_11, SiftPattern=toggle_show_tanks)  # -> Output0, Output1
ln_9 = Line(StartPoint=sift_39.Output1, EndPoint=[box_corners_12.GMaxXYZ, box_corners_12.CornerH])
trim_3 = TrimWithBrep(Curve=ln_9, Brep=sift_40.Output1)  # -> Inside, Outside
curve_preview_3 = CustomCurvePreview(Curve=trim_3.Inside, Linetype=<geometry referenced from the Rhino model>, Colour=tank2_outline)

# ---- group: Volume Waterballast tank 1 (continued)
sift_41 = SiftPattern(List=sint_12, SiftPattern=equals_6.Inequality)  # -> Output0, Output1
bang_5 = ExplodeTree(Data=sint_12)  # -> _000000, Branch1, Branch2
edges_5 = BrepEdges(Brep=sint_12)  # -> Naked, Interior, NonManifold
box_corners_13 = BoxCorners(Box=bang_5._000000)  # -> AMinXYZ, CornerB, CornerC, CornerD, CornerE, CornerF, GMaxXYZ, CornerH
bang_6 = ExplodeTree(Data=sift_41.Output1)  # -> _000000, Branch1, Branch2
pt2num_33 = PointsToNumbers(Points=box_corners_13.GMaxXYZ, Mask=11)
pt2num_34 = PointsToNumbers(Points=box_corners_13.AMinXYZ, Mask=11)
pt2num_35 = PointsToNumbers(Points=box_corners_13.GMaxXYZ, Mask=1)
pt2num_36 = PointsToNumbers(Points=box_corners_13.AMinXYZ, Mask=1)
sift_42 = SiftPattern(List=edges_5.Interior, SiftPattern=toggle_show_tanks)  # -> Output0, Output1
preview_15 = CustomPreview(Geometry=sift_42.Output1, Material=tank1_outline)

# ----
boxprop_9 = BoxProperties(Box=bang_5._000000)  # -> Center, Diagonal, Area, Volume, Degeneracy
pdecon_27 = Deconstruct(Point=boxprop_9.Diagonal)  # -> XComponent, YComponent, ZComponent

# ---- group: contour waterplanes Tank with trim and heel
num2pt_4 = NumbersToPoints(Numbers=pt2num_33, Mask=11)
num2pt_5 = NumbersToPoints(Numbers=pt2num_34, Mask=11)
round_4 = Round(Number=pt2num_33)  # -> Nearest, expr("x-1", Floor), Ceiling
vec2pt_2 = Vector2Pt(PointA=num2pt_5, PointB=num2pt_4, Unitize=False)  # -> Vector, Length
subtraction_20 = Subtraction(A=vec2pt_2.Length, B=tankheight_deduction_for_tank_diagrams, C=tankheight_deduction_for_tank_diagrams)
subtraction_21 = Subtraction(A=round_4.Floor, B=tankheight_deduction_for_tank_diagrams)
vrot_3 = Rotate(Vector=vec2pt_2.Vector, Axis=Vector(1, 0, 0), Angle=dam_7.DataA)
num2pt_6 = NumbersToPoints(Numbers=subtraction_21, Mask=11)
round_5 = Round(Number=subtraction_20)  # -> Nearest, Floor, Ceiling
vrot_4 = Rotate(Vector=vrot_3, Axis=Vector(0, 1, 0), Angle=expr("-x", dam_7.DataB))
division_24 = Division(A=round_5.Floor, B=dam)
contour_2 = Contour(Shape=sift_29.Output1, Point=num2pt_6, Direction=vrot_4, Distance=division_24)
sift_43 = SiftPattern(List=contour_2, SiftPattern=toggle_show_wp_sections_for_tankdiagrams)  # -> Output0, Output1
preview_16 = CustomPreview(Geometry=sift_43.Output1, Material=tank1_outline)

# ---- group: Checks if curves are closed
cls_2 = Closed(Curve=contour_2)  # -> Closed, Periodic
dispatch_7 = Dispatch(List=contour_2, DispatchPattern=cls_2.Closed)  # -> ListA, ListB
clean_2 = CleanTree(RemoveNulls=True, RemoveInvalid=True, RemoveEmpty=True, Tree=dispatch_7.ListA)

# ----
item_19 = ListItem(List=flatten(contour_2), Index=Slider(6, range=0..10), Wrap=True)  # disabled

# ---- group: Tankdigram data of Volume
planar_2 = Planar(Curve=clean_2)  # -> Planar, Plane, Deviation
pxs_8 = PlaneThroughShape(Plane=planar_2.Plane, Shape=sift_29.Output1, Inflate=1, SectionLogic=False)
split_9 = SplitBrep(Brep=sift_29.Output1, Cutter=pxs_8)
boxprop_10 = BoxProperties(Box=split_9)  # -> Center, Diagonal, Area, Volume, Degeneracy
pt2num_37 = PointsToNumbers(Points=boxprop_10.Center, Mask=11)
sort_10 = SortList(Keys=pt2num_37, ValuesA=split_9, ValuesB=boxprop_10.Diagonal)  # -> Keys, ValuesA, ValuesB
item_20 = ListItem(List=sort_10.ValuesA, Index=0, Wrap=True)
cap_tankfilling_brep_2 = CapHoles(Brep=item_20)
item_21 = ListItem(List=flatten(cap_tankfilling_brep_2), Index=Slider(0, range=0..10), Wrap=True)  # disabled
volume_5 = Volume(Geometry=simplify(cap_tankfilling_brep_2))  # -> Volume, Centroid
nullrep_10 = ReplaceNulls(Items=volume_5.Volume, Replacements=0)  # -> Items, Count

# ---- group: tankfilling at area centers (approx. when trim or heel)
end_13 = EndPoints(Curve=clean_2)  # -> Start, End
pdecon_28 = Deconstruct(Point=end_13.Start)  # -> XComponent, YComponent, ZComponent
subtraction_22 = Subtraction(A=pdecon_28.ZComponent, B=pt2num_34)
division_25 = Division(A=subtraction_22, B=pdecon_27.ZComponent)
multiplication_20 = Multiplication(A=division_25, B=100)
eval_61 = Evaluate(F="round(x,z)", x=multiplication_20, z=nr_of_digits_output)

# ---- group: Shows the curve of the progression of the center of volume of the tankdiagram
sift_44 = SiftPattern(List=volume_5.Centroid, SiftPattern=toggle_show_tank_cov_curves)  # -> Output0, Output1
intcrv_2 = Interpolate(Vertices=flatten(sift_44.Output1), Degree=3, Periodic=False, KnotStyle=1)  # -> Curve, Length, Domain
pt_22 = Point(sift_44.Output1)  # disabled
curve_preview_4 = CustomCurvePreview(Curve=intcrv_2.Curve, Linetype=<geometry referenced from the Rhino model>, Colour=tank1_outline)
dots_2 = DotDisplay(Point=sift_44.Output1, Colour=tank1_outline, Size=100)

# ---- group: Tank crosses in top view
sift_45 = SiftPattern(List=[box_corners_13.CornerE, box_corners_13.CornerF], SiftPattern=toggle_show_tanks)  # -> Output0, Output1
sift_46 = SiftPattern(List=sint_12, SiftPattern=toggle_show_tanks)  # -> Output0, Output1
ln_10 = Line(StartPoint=sift_45.Output1, EndPoint=[box_corners_13.GMaxXYZ, box_corners_13.CornerH])
trim_4 = TrimWithBrep(Curve=ln_10, Brep=sift_46.Output1)  # -> Inside, Outside
curve_preview_5 = CustomCurvePreview(Curve=trim_4.Inside, Linetype=<geometry referenced from the Rhino model>, Colour=tank1_outline)

# ---- group: Eenheden conversie
nullrep_11 = ReplaceNulls(Items=nullrep_10.Items, Replacements=0)  # -> Items, Count
eval_62 = Evaluate(F="round(x/(y^1),z)", x=subtraction_22, y=output_dimension, z=nr_of_digits_output)
eval_63 = Evaluate(F="round(x/(y^3),z)", x=nullrep_11.Items, y=output_dimension, z=nr_of_digits_output)
eval_64 = Evaluate(F="round(x/(y^1),z)", x=volume_5.Centroid, y=output_dimension, z=nr_of_digits_output)
nullrep_12 = ReplaceNulls(Items=eval_62, Replacements=0)  # -> Items, Count
pdecon_29 = Deconstruct(Point=eval_64)  # -> XComponent, YComponent, ZComponent
comma_2 = FragmentA(",")
nullrep_13 = ReplaceNulls(Items=pdecon_29.YComponent, Replacements=0)  # -> Items, Count
nullrep_14 = ReplaceNulls(Items=pdecon_29.ZComponent, Replacements=0)  # -> Items, Count
nullrep_15 = ReplaceNulls(Items=pdecon_29.XComponent, Replacements=0)  # -> Items, Count
concat_20 = Concatenate(
    FragmentB=flatten(nullrep_12.Items),
    FragmentA=comma_2,
    FragmentC=flatten(eval_61),
    FragmentD=comma_2,
    FragmentE=flatten(eval_63),
    FragmentF=comma_2,
    FragmentG=flatten(nullrep_15.Items),
    FragmentH=comma_2,
    FragmentI=flatten(nullrep_13.Items),
    FragmentJ=comma_2,
    FragmentK=flatten(nullrep_14.Items))

# ---- group: Tank Diagram data of Volume
case_5 = TextCase(Text="TankDiagram Tnk 1 Volume data", Culture=127)  # -> UpperCase, LowerCase
concat_21 = Concatenate(FragmentB=case_5.UpperCase, FragmentA=concat_group_version_number)
eval_65 = Evaluate(
    F="\"Tankfilling [\"&dim&\"], Tankfilling [% of h_tank], Tankvolume [\"&dim&\"3], lcg [\"&dim&\"], tcg [\"&dim&\"], vcg [\"&dim&\"]\"",
    dim=eval_3)
tank_diagram_tnk_1_data_of_volume = Panel([concat_21, eval_65, concat_20])

case_6 = TextCase(Text="TankDiagram Tnk 3 Volume data", Culture=127)  # -> UpperCase, LowerCase
concat_22 = Concatenate(FragmentB=case_6.UpperCase, FragmentA=concat_group_version_number)
tank_diagram_tnk_3_data_of_volume = Panel([concat_22, eval_65, concat_19])

# ---- group: Tankdiagram data of waterplane area
sift_47 = SiftPattern(List=clean_2, SiftPattern=toggle_tank_diagrams_waterplane_data)  # -> Output0, Output1
amoments = AreaMoments(Geometry=sift_47.Output1)  # -> Area, Centroid, Inertia, Secondary, Gyration
eval_66 = Evaluate(F="round(x/(y^2),z)", x=amoments.Area, y=output_dimension, z=nr_of_digits_output)
eval_67 = Evaluate(F="round(x/(y^1),z)", x=amoments.Centroid, y=output_dimension, z=nr_of_digits_output)
eval_68 = Evaluate(F="round(x/(y^4),z)", x=amoments.Inertia, y=output_dimension, z=nr_of_digits_output)
pdecon_30 = Deconstruct(Point=eval_67)  # -> XComponent, YComponent, ZComponent
pdecon_31 = Deconstruct(Point=eval_68)  # -> XComponent, YComponent, ZComponent
comma_3 = FragmentA(",")
case_7 = TextCase(Text="TankDiagram Tnk 1 Waterplane data", Culture=127)  # -> UpperCase, LowerCase
concat_23 = Concatenate(
    FragmentB=nullrep_12.Items,
    FragmentA=comma_3,
    FragmentC=eval_61,
    FragmentD=comma_3,
    FragmentE=eval_66,
    FragmentF=comma_3,
    FragmentG=pdecon_30.XComponent,
    FragmentH=comma_3,
    FragmentI=pdecon_30.YComponent,
    FragmentJ=comma_3,
    FragmentK=pdecon_30.ZComponent,
    FragmentL=comma_3,
    FragmentM=pdecon_31.XComponent,
    FragmentN=comma_3,
    FragmentO=pdecon_31.YComponent,
    FragmentP=comma_3,
    FragmentQ=pdecon_31.ZComponent)
concat_24 = Concatenate(FragmentB=case_7.UpperCase, FragmentA=concat_group_version_number, FragmentC=", ")
eval_69 = Evaluate(
    F="\"Tankfilling [\"&dim&\"], Tankfilling [% of h_tank], Area [\"&dim&\"2], lca [\"&dim&\"],tca [\"&dim&\"],vca [\"&dim&\"], Inertia_x [\"&dim&\"4], Inertia_y [\"&dim&\"4], Inertia_z [\"&dim&\"4]\"",
    dim=eval_3)
sift_48 = SiftPattern(List=concat_23, SiftPattern=toggle_tank_diagrams_waterplane_data)  # -> Output0, Output1
nullrep_16 = ReplaceNulls(Items=sift_48.Output1, Replacements=0)  # -> Items, Count
tank_diagram_tnk_1_data_of_waterplane = Panel([nullrep_16.Items, concat_24, eval_69])

sift_49 = SiftPattern(List=clean, SiftPattern=toggle_tank_diagrams_waterplane_data)  # -> Output0, Output1
amoments_2 = AreaMoments(Geometry=sift_49.Output1)  # -> Area, Centroid, Inertia, Secondary, Gyration
eval_70 = Evaluate(F="round(x/(y^2),z)", x=amoments_2.Area, y=output_dimension, z=nr_of_digits_output)
eval_71 = Evaluate(F="round(x/(y^1),z)", x=amoments_2.Centroid, y=output_dimension, z=nr_of_digits_output)
eval_72 = Evaluate(F="round(x/(y^4),z)", x=amoments_2.Inertia, y=output_dimension, z=nr_of_digits_output)
pdecon_32 = Deconstruct(Point=eval_71)  # -> XComponent, YComponent, ZComponent
pdecon_33 = Deconstruct(Point=eval_72)  # -> XComponent, YComponent, ZComponent
comma_4 = FragmentA(",")
case_8 = TextCase(Text="TankDiagram Tnk 3 Waterplane data", Culture=127)  # -> UpperCase, LowerCase
concat_25 = Concatenate(
    FragmentB=nullrep_6.Items,
    FragmentA=comma_4,
    FragmentC=eval_56,
    FragmentD=comma_4,
    FragmentE=eval_70,
    FragmentF=comma_4,
    FragmentG=pdecon_32.XComponent,
    FragmentH=comma_4,
    FragmentI=pdecon_32.YComponent,
    FragmentJ=comma_4,
    FragmentK=pdecon_32.ZComponent,
    FragmentL=comma_4,
    FragmentM=pdecon_33.XComponent,
    FragmentN=comma_4,
    FragmentO=pdecon_33.YComponent,
    FragmentP=comma_4,
    FragmentQ=pdecon_33.ZComponent)
concat_26 = Concatenate(FragmentB=case_8.UpperCase, FragmentA=concat_group_version_number)
sift_50 = SiftPattern(List=concat_25, SiftPattern=toggle_tank_diagrams_waterplane_data)  # -> Output0, Output1
nullrep_17 = ReplaceNulls(Items=sift_50.Output1, Replacements=0)  # -> Items, Count
tank_diagram_tnk_3_data_of_waterplane = Panel([concat_26, eval_69, nullrep_17.Items])

# ---- group: Tankschotten van Tank 1, 2 en 3, dubbelingen met dek, spiegel en tankschotten zijn er uit gefilterd
# Tank Bulkheads Weight Data
splitmul = SplitBrepMultiple(Brep=[sift_24.Output1, sift_22.Output1, sift_26.Output1], Cutters=filter_3)

# ---- group: Deconstruct all hull surfaces of underwaterhull and calculates the Area data
# Wet Hull Surfaces
sift_51 = SiftPattern(List=sint_8, SiftPattern=bool_volume_related_output)  # -> Output0, Output1
debrep_3 = DeconstructBrep(Brep=sift_51.Output1)  # -> flatten(Faces), Edges, Vertices
boxprop_11 = BoxProperties(Box=debrep_3.Faces)  # -> Center, Diagonal, Area, Volume, Degeneracy
show_underwater_areas = BooleanToggle(False)
water_plane_area = ColourSwatch(SwatchColor=RGBA(0, 93, 255, 71))
wet_transom = ColourSwatch(SwatchColor=RGBA(255, 0, 0, 81))
buoyant_hull = ColourSwatch(SwatchColor=RGBA(255, 255, 255, 35))

# ----
# Wet Box shaped Surfaces
specific_items = Panel("""0
1
2
4""")
sift_52 = SiftPattern(List=sift_51.Output1, SiftPattern=dam_2)  # -> Output0, Output1
bbox_11 = BoundingBox(Content=sift_52.Output0, Plane=PlaneXY(0, 0, 0))  # -> Box, Box_2
debrep_4 = DeconstructBrep(Brep=bbox_11.Box)  # -> Faces, Edges, Vertices
item_22 = ListItem(List=flatten(debrep_4.Faces), Index=specific_items, Wrap=True)

# ---- group: checks if the mirror has a point below the waterline
pcx_4 = CurvePlane(Curve=move_15.Geometry, Plane=Plane(origin=(0, 0, 0), x=(0, 0, 1), y=(1, 0, 0)))  # -> Points, ParamsC, ParamsP
t_moulded = Number(eval_18)
tmirror = Number(eval_26)
pt2num_38 = PointsToNumbers(Points=pcx_4.Points, Mask=11)
smaller_2 = SmallerThan(FirstNumber=pt2num_38, SecondNumber=tmirror)  # -> SmallerThan, OrEqualTo
sift_53 = SiftPattern(List=debrep_3.Faces, SiftPattern=smaller_2.SmallerThan)  # -> Output0, Output1

# ----
sift_54 = SiftPattern(List=boxprop_11.Center, SiftPattern=smaller_2.SmallerThan)  # -> Output0, Output1

# ---- group: checks which box-centerpoint is closest the waterplane
pxs_9 = PlaneThroughShape(Plane=rotate_2.Geometry, Shape=p_n_c_ship_or_box, Inflate=1, SectionLogic=False)
srf_cp = SurfaceClosestPoint(Point=boxprop_11.Center, Surface=pxs_9)  # -> Point, UVPoint, Distance
sort_11 = SortList(Keys=srf_cp.Distance, ValuesA=debrep_3.Faces)  # -> Keys, ValuesA
item_23 = ListItem(List=sort_11.ValuesA, Index=0, Wrap=True)

# ---- group: checks wich box-centerpoint is closest to the transom plane
planar_3 = Planar(Curve=move_15.Geometry)  # -> Planar, Plane, Deviation
pxs_10 = PlaneThroughShape(Plane=planar_3.Plane, Shape=p_n_c_ship_or_box, Inflate=1, SectionLogic=False)
srf_cp_2 = SurfaceClosestPoint(Point=sift_54.Output1, Surface=pxs_10)  # -> Point, UVPoint, Distance
sort_12 = SortList(Keys=srf_cp_2.Distance, ValuesA=sift_53.Output1)  # -> Keys, ValuesA
item_24 = ListItem(List=sort_12.ValuesA, Index=0, Wrap=True)

# ---- group: Deconstruct all hull surfaces of half underwaterhull and calculates the area data
# Hull Surfaces
sift_55 = SiftPattern(List=sint_9, SiftPattern=bool_volume_related_output)  # -> Output0, Output1
debrep_5 = DeconstructBrep(Brep=sift_55.Output1)  # -> flatten(Faces), Edges, Vertices
boxprop_12 = BoxProperties(Box=debrep_5.Faces)  # -> Center, Diagonal, Area, Volume, Degeneracy
show_areas_blue_deck_white_shell_red_tra = BooleanToggle(False)  # "Show areas (blue=deck, white=shell, red=transom)"

# ----
# Box shaped Surfaces
sift_56 = SiftPattern(List=sift_55.Output1, SiftPattern=dam_2)  # -> Output0, Output1
group_2 = Group(Objects=sift_56.Output0)
specific_items_2 = Panel("""0
1
4""")
bbox_12 = BoundingBox(Content=group_2, Plane=PlaneXY(0, 0, 0))  # -> Box, Box_2
debrep_6 = DeconstructBrep(Brep=bbox_12.Box)  # -> Faces, Edges, Vertices
item_25 = ListItem(List=flatten(debrep_6.Faces), Index=specific_items_2, Wrap=True)

# ---- group: checks if the mirror has a point below the waterline
tmirror_2 = Number(eval_26)
t_moulded_2 = Number(eval_18)
pcx_5 = CurvePlane(Curve=move_15.Geometry, Plane=Plane(origin=(0, 0, 0), x=(0, 0, 1), y=(1, 0, 0)))  # -> Points, ParamsC, ParamsP
pt2num_39 = PointsToNumbers(Points=pcx_5.Points, Mask=11)
smaller_3 = SmallerThan(FirstNumber=pt2num_39, SecondNumber=depth)  # -> SmallerThan, OrEqualTo
sift_57 = SiftPattern(List=debrep_5.Faces, SiftPattern=smaller_3.SmallerThan)  # -> Output0, Output1

# ----
sift_58 = SiftPattern(List=boxprop_12.Center, SiftPattern=smaller_3.SmallerThan)  # -> Output0, Output1

# ---- group: selects non planar surfaces (shell ps&sb)
planar_4 = IsPlanar(Surface=debrep_5.Faces, Interior=True)  # -> Planar, Plane
sift_59 = SiftPattern(List=debrep_5.Faces, SiftPattern=planar_4.Planar)  # -> Output0, Output1
null_3 = NullItem(Item=sift_59.Output0)  # -> NullFlags, InvalidFlags, Description
dispatch_8 = Dispatch(List=sift_59.Output0, DispatchPattern=null_3.NullFlags)  # -> ListA, ListB
filter_4 = StreamFilter(Gate=dam_2, Stream0=item_25, Stream1=dispatch_8.ListB)
join_7 = BrepJoin(Breps=filter_4)  # -> Breps, Closed

# ---- group: checks which box-centerpoint is closest the depth
pxs_11 = PlaneThroughShape(Plane=xy_2, Shape=p_n_c_ship_or_box, Inflate=1, SectionLogic=False)
srf_cp_3 = SurfaceClosestPoint(Point=boxprop_12.Center, Surface=pxs_11)  # -> Point, UVPoint, Distance
sort_13 = SortList(Keys=srf_cp_3.Distance, ValuesA=debrep_5.Faces)  # -> Keys, ValuesA
item_26 = ListItem(List=sort_13.ValuesA, Index=0, Wrap=True)

# ---- group: checks wich box-centerpoint is closest to the transom plane
planar_5 = Planar(Curve=move_15.Geometry)  # -> Planar, Plane, Deviation
pxs_12 = PlaneThroughShape(Plane=planar_5.Plane, Shape=p_n_c_ship_or_box, Inflate=1, SectionLogic=False)
srf_cp_4 = SurfaceClosestPoint(Point=sift_58.Output1, Surface=pxs_12)  # -> Point, UVPoint, Distance
sort_14 = SortList(Keys=srf_cp_4.Distance, ValuesA=sift_57.Output1)  # -> Keys, ValuesA
item_27 = ListItem(List=sort_14.ValuesA, Index=0, Wrap=True)

# ----
sift_60 = SiftPattern(List=join_7.Breps, SiftPattern=show_areas_blue_deck_white_shell_red_tra)  # -> Output0, Output1
area_15 = Area(Geometry=join_7.Breps)  # -> expr("x*2", Area), Centroid

# ---- group: Selecteerd vlakken op basis van hoekpunten buiten de romp
debrep_7 = DeconstructBrep(Brep=splitmul)  # -> Faces, Edges, Vertices

# ---- group: Selecteerd vlakken op basis van hoekpunten buiten de romp / Relationship of shape to brep (0=inside, 1=intersecting, 2=outside)
srfpt = SurfacePoints(Surface=debrep_7.Faces)  # -> Points, Weights, Greville, UCount, VCount
shapein = ShapeInBrep(Brep=filter_3, Shape=debrep_7.Faces)

# ---- group: Selecteerd vlakken op basis van hoekpunten buiten de romp (continued)
equals_8 = Equality(FirstNumber=shapein, SecondNumber=2)  # -> Equality, Inequality
mm_3 = MassMultiplication(Input=equals_8.Inequality)  # -> Result, PartialResults
dispatch_9 = Dispatch(List=debrep_7.Faces, DispatchPattern=mm_3.Result)  # -> ListA, ListB

# ---- group: contour waterplanes Tank with trim and heel
num2pt_7 = NumbersToPoints(Numbers=pt2num_31, Mask=11)
num2pt_8 = NumbersToPoints(Numbers=pt2num_29, Mask=11)
vec2pt_3 = Vector2Pt(PointA=num2pt_7, PointB=num2pt_8, Unitize=False)  # -> Vector, Length
round_6 = Round(Number=pt2num_29)  # -> Nearest, Floor, Ceiling
subtraction_23 = Subtraction(A=round_6.Floor, B=tankheight_deduction_for_tank_diagrams)
vrot_5 = Rotate(Vector=vec2pt_3.Vector, Axis=Vector(1, 0, 0), Angle=dam_7.DataA)
num2pt_9 = NumbersToPoints(Numbers=subtraction_23, Mask=11)
vrot_6 = Rotate(Vector=vrot_5, Axis=Vector(0, 1, 0), Angle=expr("-x", dam_7.DataB))

# ----
subtraction_24 = Subtraction(A=vec2pt_3.Length, B=tankheight_deduction_for_tank_diagrams, C=tankheight_deduction_for_tank_diagrams)

# ---- group: contour waterplanes Tank with trim and heel (continued)
round_7 = Round(Number=subtraction_24)  # -> Nearest, Floor, Ceiling
division_26 = Division(A=round_7.Floor, B=dam)
contour_3 = Contour(Shape=sift_28.Output1, Point=num2pt_9, Direction=vrot_6, Distance=division_26)
sift_61 = SiftPattern(List=contour_3, SiftPattern=toggle_show_wp_sections_for_tankdiagrams)  # -> Output0, Output1
preview_17 = CustomPreview(Geometry=sift_61.Output1, Material=tank2_outline)

# ---- group: Checks if curves are closed
cls_3 = Closed(Curve=contour_3)  # -> Closed, Periodic
dispatch_10 = Dispatch(List=contour_3, DispatchPattern=cls_3.Closed)  # -> ListA, ListB
clean_3 = CleanTree(RemoveNulls=True, RemoveInvalid=True, RemoveEmpty=True, Tree=dispatch_10.ListA)

# ----
panel_31 = Panel(cls_3.Closed)
item_28 = ListItem(List=flatten(clean_3), Index=Slider(0, range=0..10), Wrap=True)  # disabled

# ---- group: tankfilling (approx. when trim or heel)
end_14 = EndPoints(Curve=clean_3)  # -> Start, End
pdecon_34 = Deconstruct(Point=end_14.Start)  # -> XComponent, YComponent, ZComponent
subtraction_25 = Subtraction(A=pdecon_34.ZComponent, B=pt2num_31)
division_27 = Division(A=subtraction_25, B=pdecon_26.ZComponent)
multiplication_21 = Multiplication(A=division_27, B=100)
eval_73 = Evaluate(F="round(x,z)", x=multiplication_21, z=nr_of_digits_output)

# ---- group: Tankdigram data of Volume
planar_6 = Planar(Curve=clean_3)  # -> Planar, Plane, Deviation
pxs_13 = PlaneThroughShape(Plane=planar_6.Plane, Shape=sift_28.Output1, Inflate=1, SectionLogic=False)
split_10 = SplitBrep(Brep=sift_28.Output1, Cutter=pxs_13)
boxprop_13 = BoxProperties(Box=split_10)  # -> Center, Diagonal, Area, Volume, Degeneracy
pt2num_40 = PointsToNumbers(Points=boxprop_13.Center, Mask=11)
sort_15 = SortList(Keys=pt2num_40, ValuesA=split_10, ValuesB=boxprop_13.Diagonal)  # -> Keys, ValuesA, ValuesB
item_29 = ListItem(List=sort_15.ValuesA, Index=0, Wrap=True)
cap_tankfilling_brep_3 = CapHoles(Brep=item_29)
item_30 = ListItem(List=flatten(cap_tankfilling_brep_3), Index=Slider(0, range=0..10), Wrap=True)  # disabled
volume_6 = Volume(Geometry=simplify(cap_tankfilling_brep_3))  # -> Volume, Centroid
nullrep_18 = ReplaceNulls(Items=volume_6.Volume, Replacements=0)  # -> Items, Count

# ---- group: Shows the curve of the progression of the center of volume of the tankdiagram
sift_62 = SiftPattern(List=volume_6.Centroid, SiftPattern=toggle_show_tank_cov_curves)  # -> Output0, Output1
intcrv_3 = Interpolate(Vertices=flatten(sift_62.Output1), Degree=3, Periodic=False, KnotStyle=1)  # -> Curve, Length, Domain
dots_3 = DotDisplay(Point=sift_62.Output1, Colour=tank2_outline, Size=100)
curve_preview_6 = CustomCurvePreview(Curve=intcrv_3.Curve, Linetype=<geometry referenced from the Rhino model>, Colour=tank2_outline)

# ---- group: Volume Waterballast tank 1 (continued)
eval_74 = Evaluate(F="H_tank*Filling/100+TankBottom", H_tank=pdecon_27.ZComponent, Filling=dam_13.DataA, TankBottom=pt2num_34)
Z_8 = UnitZ(Factor=eval_74)
xy_10 = XYPlane(Origin=Z_8)
larger_4 = LargerThan(FirstNumber=pdecon_27.XComponent, SecondNumber=expr("x/3", filter_lpp_0_or_lpp_1))  # -> LargerThan, OrEqualTo

# ---- group: Volume Waterballast tank 1 / waterplane tank at no even keel
pxs_14 = PlaneThroughShape(Plane=xy_10, Shape=bang_6._000000, Inflate=1, SectionLogic=False)
sec_6 = BrepPlane(Brep=bang_6._000000, Plane=pxs_14)  # -> Curves, Points
boundary_4 = BoundarySurfaces(Edges=sec_6.Curves)

# ---- group: Tankschotten van Tank 1, 2 en 3, dubbelingen met dek, spiegel en tankschotten zijn er uit gefilterd (continued)
flatten = FlattenTree(Tree=dispatch_9.ListA, Path="{0}")

# ---- group: selects non planar surfaces (shell ps&sb)
planar_7 = IsPlanar(Surface=debrep_3.Faces, Interior=True)  # -> Planar, Plane
sift_63 = SiftPattern(List=debrep_3.Faces, SiftPattern=planar_7.Planar)  # -> Output0, Output1
null_4 = NullItem(Item=sift_63.Output0)  # -> NullFlags, InvalidFlags, Description
dispatch_11 = Dispatch(List=sift_63.Output0, DispatchPattern=null_4.NullFlags)  # -> ListA, ListB

# ----
filter_5 = StreamFilter(Gate=dam_2, Stream0=item_22, Stream1=dispatch_11.ListB)

# ---- group: selects non planar surfaces (shell ps&sb) (continued)
join_8 = BrepJoin(Breps=filter_5)  # -> Breps, Closed

# ----
sift_64 = SiftPattern(List=join_8.Breps, SiftPattern=show_underwater_areas)  # -> Output0, Output1
area_16 = Area(Geometry=join_8.Breps)  # -> Area, Centroid

# ---- group: Tankschotten van Tank 1, 2 en 3, dubbelingen met dek, spiegel en tankschotten zijn er uit gefilterd / Split alle platen met elkaar en verwijderd alle oppervlakte dubbelingen op basis van dubbele zwaartepunten
splitmul_2 = SplitBrepMultiple(Brep=flatten, Cutters=flatten)  # -> flatten(Result)
planar_8 = IsPlanar(Surface=splitmul_2, Interior=True)  # -> Planar, Plane
cullpt = CullDuplicates(Points=planar_8.Plane, Tolerance=1, CullMode=1)  # -> Points, flatten(Indices), Valence

# ---- group: Bij een enkel schot wordt CullPt overgeslagen
lng_4 = ListLength(List=splitmul_2)
eval_75 = Evaluate(F="if(x=1,x-1,y)", x=lng_4, y=cullpt.Indices)

# ---- group: Tankschotten van Tank 1, 2 en 3, dubbelingen met dek, spiegel en tankschotten zijn er uit gefilterd / Split alle platen met elkaar en verwijderd alle oppervlakte dubbelingen op basis van dubbele zwaartepunten (continued)
item_31 = ListItem(List=splitmul_2, Index=eval_75, Wrap=True)

# ----
area_17 = Area(Geometry=item_31)  # -> Area, Centroid

# ---- group: Tankschotten van Tank 1, 2 en 3, dubbelingen met dek, spiegel en tankschotten zijn er uit gefilterd (continued)
box_corners_14 = BoxCorners(Box=item_31)  # -> CornerA, CornerB, CornerC, CornerD, CornerE, CornerF, CornerG, CornerH

# ---- group: samenvoegen van data en omzetting naar meters
pt2num_41 = PointsToNumbers(Points=box_corners_14.CornerG, Mask=1)
pt2num_42 = PointsToNumbers(Points=box_corners_14.CornerA, Mask=1)
eval_76 = Evaluate(F="round(x/(y^2),z)", x=area_17.Area, y=output_dimension, z=nr_of_digits_output)
eval_77 = Evaluate(F="round(x/(y^1),z)", x=area_17.Centroid, y=output_dimension, z=nr_of_digits_output)
eval_78 = Evaluate(F="round(x/(y^1),z)", x=pt2num_42, y=output_dimension, z=nr_of_digits_output)
eval_79 = Evaluate(F="round(x/(y^1),z)", x=pt2num_41, y=output_dimension, z=nr_of_digits_output)
rep_10 = ReplaceText(Text=eval_77, Find="{", RecursiveReplace=False)
rep_11 = ReplaceText(Text=rep_10, Find="}", RecursiveReplace=False)

# ---- group: Geeft schotten afstand voor een verdeelde belasting
# Speading distance to get a load distrubution for pointloads
distance_of_pointloads_m = Slider(0.5, range=0..1)
equals_9 = Equality(FirstNumber=eval_78, SecondNumber=eval_79)  # -> Equality, Inequality
eval_80 = Evaluate(F="if(x=TRUE,y,0)", x=equals_9.Equality, y=distance_of_pointloads_m)
subtraction_26 = Subtraction(A=eval_78, B=eval_80)
addition_6 = Addition(A=eval_79, B=eval_80)

# ---- group: Bij geen schot dan area=0 en lcg=0
nullrep_19 = ReplaceNulls(Items=rep_11, Replacements=0)  # -> Items, Count
nullrep_20 = ReplaceNulls(Items=eval_76, Replacements=0)  # -> Items, Count

# ---- group: Data ordening
comma_seperator = FragmentB(",")
concat_27 = Concatenate(
    FragmentA=nullrep_20.Items,
    FragmentB=comma_seperator,
    FragmentC=nullrep_19.Items,
    FragmentD=comma_seperator,
    FragmentE=subtraction_26,
    FragmentF=comma_seperator,
    FragmentG=addition_6)  # -> flatten(Result)

# ----
case_9 = TextCase(Text="Tank Bulkhead Data", Culture=127)  # -> UpperCase, LowerCase
eval_81 = Evaluate(
    F="\"BHD Area [\"&dim&\"2], lcg [\"&dim&\"], tcg [\"&dim&\"], vcg [\"&dim&\"], x_min [\"&dim&\"], x_max [\"&dim&\"]\"",
    dim=eval_3)
concat_28 = Concatenate(FragmentB=case_9.UpperCase, FragmentA=concat_group_version_number)
tank_bhd_data = Panel([concat_28, eval_81, concat_27])

srf_of_tank_bhd = Surface(item_31)

# ---- group: X division method 2: creates the division over the length of all cross sectional tables and curves including Xstern, X_app, Xwl_aft, XstartMidship, XstartForeship, X_tanks, Xwl_fwd, Xfpp, Xfwd_oa
x_app = Integer(0)
number_slider = Slider(4, range=2..24)

# ---- group: Volume Waterballast tank 3 (continued)
area_18 = Area(Geometry=boundary_2)  # -> Area, Centroid
eval_82 = Evaluate(F="IF(z>0,z,IF(x=FALSE,y,y*2))", x=larger_2.LargerThan, y=number_slider, z=int_z_3)

# ---- group: Volume Waterballast tank 3 / Waterline with trim and heel
yz_5 = YZPlane(Origin=area_18.Centroid)
rotate_6 = Rotate(Geometry=xy_8, Angle=dam_7.DataA, Plane=yz_5)  # -> Geometry, Transform
xz_3 = XZPlane(Origin=area_18.Centroid)
rotate_7 = Rotate(Geometry=rotate_6.Geometry, Angle=dam_7.DataB, Plane=xz_3)  # -> Geometry, Transform

# ---- group: Volume Waterballast tank 2 (continued)
area_19 = Area(Geometry=boundary_3)  # -> Area, Centroid
eval_83 = Evaluate(F="IF(z>0,z,IF(x=FALSE,y,y*2))", x=larger_3.LargerThan, y=number_slider, z=int_z)

# ---- group: Volume Waterballast tank 2 / Waterline with trim and heel
yz_6 = YZPlane(Origin=area_19.Centroid)
rotate_8 = Rotate(Geometry=xy_9, Angle=dam_7.DataA, Plane=yz_6)  # -> Geometry, Transform
xz_4 = XZPlane(Origin=area_19.Centroid)
rotate_9 = Rotate(Geometry=rotate_8.Geometry, Angle=dam_7.DataB, Plane=xz_4)  # -> Geometry, Transform

# ---- group: Deconstruct all hull surfaces of half underwaterhull and calculates the area data (continued)
brep_deck = Brep(item_26)
brep_transom = Brep(item_27)
preview_18 = CustomPreview(Geometry=sift_60.Output1, Shader=ColourSwatch(SwatchColor=RGBA(255, 255, 255, 35)))

# ----
area_20 = Area(Geometry=brep_deck)  # -> expr("x*2", Area), Centroid
area_21 = Area(Geometry=brep_transom)  # -> expr("x*2", Area), Centroid
sift_65 = SiftPattern(List=brep_transom, SiftPattern=show_areas_blue_deck_white_shell_red_tra)  # -> Output0, Output1
sift_66 = SiftPattern(List=brep_deck, SiftPattern=show_areas_blue_deck_white_shell_red_tra)  # -> Output0, Output1

# ---- group: Deconstruct all hull surfaces of half underwaterhull and calculates the area data (continued)
preview_19 = CustomPreview(Geometry=sift_66.Output1, Shader=ColourSwatch(SwatchColor=RGBA(0, 93, 255, 71)))
preview_20 = CustomPreview(Geometry=sift_65.Output1, Shader=ColourSwatch(SwatchColor=RGBA(255, 0, 0, 81)))

# ---- group: Zet de Y waarde van de COA op nul
M = Mask(3)
pt2num_43 = PointsToNumbers(Points=area_15.Centroid, Mask=M)
pt2num_44 = PointsToNumbers(Points=area_21.Centroid, Mask=M)
pt2num_45 = PointsToNumbers(Points=area_20.Centroid, Mask=M)
num2pt_10 = NumbersToPoints(Numbers=pt2num_43, Mask=M)
num2pt_11 = NumbersToPoints(Numbers=pt2num_44, Mask=M)
num2pt_12 = NumbersToPoints(Numbers=pt2num_45, Mask=M)

# ----
eval_84 = Evaluate(F="round(x/(y^1),z)", x=num2pt_12, y=output_dimension, z=nr_of_digits_output)
eval_85 = Evaluate(F="round(x/(y^2),z)", x=area_21.Area, y=output_dimension, z=nr_of_digits_output)
eval_86 = Evaluate(F="round(x/(y^1),z)", x=num2pt_11, y=output_dimension, z=nr_of_digits_output)
eval_87 = Evaluate(F="round(x/(y^2),z)", x=area_15.Area, y=output_dimension, z=nr_of_digits_output)
eval_88 = Evaluate(F="round(x/(y^1),z)", x=num2pt_10, y=output_dimension, z=nr_of_digits_output)
eval_89 = Evaluate(F="round(x/(y^2),z)", x=area_20.Area, y=output_dimension, z=nr_of_digits_output)
nullrep_21 = ReplaceNulls(Items=eval_89, Replacements=0)  # -> Items, Count
nullrep_22 = ReplaceNulls(Items=eval_84, Replacements=0)  # -> Items, Count
panel_32 = Panel("""Transom Area 
Shell Area 
Deck Area """)
nullrep_23 = ReplaceNulls(Items=eval_88, Replacements=0)  # -> Items, Count
nullrep_24 = ReplaceNulls(Items=eval_85, Replacements=0)  # -> Items, Count
nullrep_25 = ReplaceNulls(Items=eval_87, Replacements=0)  # -> Items, Count
nullrep_26 = ReplaceNulls(Items=eval_86, Replacements=0)  # -> Items, Count
concat_29 = Concatenate(FragmentA=nullrep_21.Items, FragmentC=", ", FragmentB=nullrep_22.Items)
concat_30 = Concatenate(FragmentA=nullrep_25.Items, FragmentC=", ", FragmentB=nullrep_23.Items)
concat_31 = Concatenate(FragmentA=nullrep_24.Items, FragmentC=", ", FragmentB=nullrep_26.Items)
merge_11 = Merge(Data1=flatten(concat_31), Data2=flatten(concat_30), Data3=flatten(concat_29))  # -> flatten(Result)
rep_12 = ReplaceText(Text=merge_11, Find="{", RecursiveReplace=False)
rep_13 = ReplaceText(Text=rep_12, Find="}", RecursiveReplace=False)
eval_90 = Evaluate(F="\"Name , Area [\"&dim&\"2], lca [\"&dim&\"], tca [\"&dim&\"], vca [\"&dim&\"]\"", dim=eval_3)
concat_32 = Concatenate(FragmentB="HULL AREA DATA", FragmentA=concat_group_version_number)
concat_33 = Concatenate(FragmentA=panel_32, FragmentC=", ", FragmentB=rep_13)
hull_area = Panel([concat_32, eval_90, concat_33])

concat_34 = Concatenate(FragmentA=panel_32, FragmentB=rep_13)
hull_area_2 = Panel(["HULL AREA DATA", eval_90, concat_33])

# ---- group: Deconstruct all hull surfaces of underwaterhull and calculates the Area data (continued)
brep_wet_transom_only_if_out_one_peace = Brep(item_24)
brep_waterplane = Brep(item_23)
preview_21 = CustomPreview(Geometry=sift_64.Output1, Shader=buoyant_hull)

# ----
sift_67 = SiftPattern(List=brep_wet_transom_only_if_out_one_peace, SiftPattern=show_underwater_areas)  # -> Output0, Output1
area_22 = Area(Geometry=brep_wet_transom_only_if_out_one_peace)  # -> Area, Centroid
sift_68 = SiftPattern(List=brep_waterplane, SiftPattern=show_underwater_areas)  # -> Output0, Output1

# ---- group: Deconstruct all hull surfaces of underwaterhull and calculates the Area data (continued)
null_5 = NullItem(Item=area_22.Area)  # -> NullFlags, InvalidFlags, Description
p_n_c = PickNChoose(Pattern=null_5.NullFlags, Stream0=area_22.Area, Stream1=0)
preview_22 = CustomPreview(Geometry=sift_68.Output1, Shader=water_plane_area)
preview_23 = CustomPreview(Geometry=sift_67.Output1, Shader=wet_transom)

# ----
# Determine waterline moment of inertia
amoments_3 = AreaMoments(Geometry=brep_waterplane)  # -> Area, Centroid, Inertia, Secondary, Gyration

# ---- group: Volume Waterballast tank 1 (continued)
area_23 = Area(Geometry=boundary_4)  # -> Area, Centroid
eval_91 = Evaluate(F="IF(z>0,z,IF(x=FALSE,y,y*2))", x=larger_4.LargerThan, y=number_slider, z=int_z_2)

# ---- group: Volume Waterballast tank 1 / Waterline with trim and heel
yz_7 = YZPlane(Origin=area_23.Centroid)
xz_5 = XZPlane(Origin=area_23.Centroid)
rotate_10 = Rotate(Geometry=xy_10, Angle=dam_7.DataA, Plane=yz_7)  # -> Geometry, Transform
rotate_11 = Rotate(Geometry=rotate_10.Geometry, Angle=dam_7.DataB, Plane=xz_5)  # -> Geometry, Transform
pxs_15 = PlaneThroughShape(Plane=rotate_11.Geometry, Shape=bang_6._000000, Inflate=1, SectionLogic=False)

# ---- group: Volume Waterballast tank 3 (continued)
pxs_16 = PlaneThroughShape(Plane=rotate_7.Geometry, Shape=bang_2._000000, Inflate=1, SectionLogic=False)
split_11 = SplitBrep(Brep=bang_2._000000, Cutter=pxs_16)
boxprop_14 = BoxProperties(Box=split_11)  # -> Center, Diagonal, Area, Volume, Degeneracy
pt2num_46 = PointsToNumbers(Points=boxprop_14.Center, Mask=11)
sort_16 = SortList(Keys=pt2num_46, ValuesA=split_11, ValuesB=boxprop_14.Diagonal)  # -> Keys, ValuesA, ValuesB
item_32 = ListItem(List=sort_16.ValuesA, Index=0, Wrap=True)
pt2num_47 = PointsToNumbers(Points=sort_16.ValuesB, Mask=1)
item_33 = ListItem(List=pt2num_47, Index=0, Wrap=True)  # -> Item, Item1

# ---- group: Volume Waterballast tank 2 (continued)
pxs_17 = PlaneThroughShape(Plane=rotate_9.Geometry, Shape=bang_4._000000, Inflate=1, SectionLogic=False)
split_12 = SplitBrep(Brep=bang_4._000000, Cutter=pxs_17)
boxprop_15 = BoxProperties(Box=split_12)  # -> Center, Diagonal, Area, Volume, Degeneracy
pt2num_48 = PointsToNumbers(Points=boxprop_15.Center, Mask=11)
sort_17 = SortList(Keys=pt2num_48, ValuesA=split_12, ValuesB=boxprop_15.Diagonal)  # -> Keys, ValuesA, ValuesB
item_34 = ListItem(List=sort_17.ValuesA, Index=0, Wrap=True)
pt2num_49 = PointsToNumbers(Points=sort_17.ValuesB, Mask=1)
item_35 = ListItem(List=pt2num_49, Index=0, Wrap=True)  # -> Item, Item1

# ---- group: Volume Waterballast tank 1 (continued)
split_13 = SplitBrep(Brep=bang_6._000000, Cutter=pxs_15)
boxprop_16 = BoxProperties(Box=split_13)  # -> Center, Diagonal, Area, Volume, Degeneracy
pt2num_50 = PointsToNumbers(Points=boxprop_16.Center, Mask=11)
sort_18 = SortList(Keys=pt2num_50, ValuesA=split_13, ValuesB=boxprop_16.Diagonal)  # -> Keys, ValuesA, ValuesB
item_36 = ListItem(List=sort_18.ValuesA, Index=0, Wrap=True)

# ---- group: Tank Filling
# Tank
# Filling
# Solids
cap_tankfilling_brep_4 = CapHoles(Brep=item_32)
cap_tankfilling_brep_5 = CapHoles(Brep=item_34)
cap_tankfilling_brep_6 = CapHoles(Brep=item_36)

# ---- group: selection of X division method
x_division_method_2 = Integer(x_division_method)

# ---- group: Volume Waterballast tank 3 (continued)
volume_7 = Volume(Geometry=cap_tankfilling_brep_4)  # -> Volume, Centroid
box_corners_15 = BoxCorners(Box=cap_tankfilling_brep_4)  # -> AMinXYZ, CornerB, CornerC, CornerD, CornerE, CornerF, GMaxXYZ, CornerH
sift_69 = SiftPattern(List=cap_tankfilling_brep_4, SiftPattern=toggle_show_tanks)  # -> Output0, Output1
debrep_8 = DeconstructBrep(Brep=cap_tankfilling_brep_4)  # -> flatten(Faces), Edges, Vertices
pt2num_51 = PointsToNumbers(Points=box_corners_15.AMinXYZ, Mask=1)
pt2num_52 = PointsToNumbers(Points=box_corners_15.GMaxXYZ, Mask=1)
pt2num_53 = PointsToNumbers(
    Points=[box_corners_15.AMinXYZ, box_corners_15.CornerB, box_corners_15.CornerC, box_corners_15.CornerD, box_corners_15.CornerE, box_corners_15.CornerF, box_corners_15.GMaxXYZ, box_corners_15.CornerH],
    Mask=1)
preview_24 = CustomPreview(Geometry=sift_69.Output1, Material=water_ballast)
boxprop_17 = BoxProperties(Box=debrep_8.Faces)  # -> Center, Diagonal, Area, Volume, Degeneracy
subtraction_27 = Subtraction(A=pt2num_52, B=pt2num_51)
srf_cp_5 = SurfaceClosestPoint(Point=flatten(boxprop_17.Center), Surface=pxs_16)  # -> Point, UVPoint, Distance
sort_19 = SortList(Keys=srf_cp_5.Distance, ValuesA=debrep_8.Faces)  # -> Keys, ValuesA
item_37 = ListItem(List=sort_19.ValuesA, Index=0, Wrap=True)
amoments_4 = AreaMoments(Geometry=item_37)  # -> Area, Centroid, Inertia, Secondary, Gyration
num2pt_13 = NumbersToPoints(Numbers=pt2num_51, Mask=1)
line_9 = LineSDL(Start=num2pt_13, Direction=Vector(1, 0, 0), Length=subtraction_27)
frm_6 = PerpFrames(Curve=line_9, Number=eval_82, Align=True)  # -> flatten(Frames), Parameters
sift_70 = SiftPattern(List=cap_tankfilling_brep_4, SiftPattern=and)  # -> Output0, Output1

# ----
eval_92 = Evaluate(F="round(x/(y^4),z)", x=amoments_4.Inertia, y=output_dimension, z=nr_of_digits_output)
eval_93 = Evaluate(F="round(x/(y^3),z)", x=volume_7.Volume, y=output_dimension, z=nr_of_digits_output)
eval_94 = Evaluate(F="round(x/(y^1),z)", x=boxprop_6.Diagonal, y=output_dimension, z=nr_of_digits_output)
eval_95 = Evaluate(F="round(x/(y^1),z)", x=amoments_4.Centroid, y=output_dimension, z=nr_of_digits_output)
eval_96 = Evaluate(F="round(x/(y^1),z)", x=volume_7.Centroid, y=output_dimension, z=nr_of_digits_output)
eval_97 = Evaluate(F="round(x/(y^2),z)", x=amoments_4.Area, y=output_dimension, z=nr_of_digits_output)
panel_33 = Panel("""Volume water ballast
COV WB
Height of WB
Tank lxbxh
Area WB plane
COA WB plane
Inertia WB plane""")
merge_12 = Merge(
    Data1=flatten(eval_93),
    Data2=flatten(eval_96),
    Data3=flatten(dam_13.DataC),
    Data4=flatten(eval_94),
    Data5=flatten(eval_97),
    Data6=flatten(eval_95),
    Data7=flatten(eval_92))  # -> flatten(Result)
nullrep_27 = ReplaceNulls(Items=merge_12, Replacements=0)  # -> Items, Count
panel_34 = Panel("""m3
m
% of h_tank
m
m2
m
m4""")
rep_14 = ReplaceText(Text=panel_34, Find="m", Replace=eval_3, RecursiveReplace=False)
rep_15 = ReplaceText(Text=nullrep_27.Items, Find="{", RecursiveReplace=False)
case_10 = TextCase(Text="WB Tank 3", Culture=127)  # -> UpperCase, LowerCase
concat_35 = Concatenate(FragmentB=panel_33, FragmentA=" [", FragmentC=rep_14, FragmentD="], ")
rep_16 = ReplaceText(Text=rep_15, Find="}", RecursiveReplace=False)
concat_36 = Concatenate(FragmentB=case_10.UpperCase, FragmentA=concat_group_version_number)
concat_37 = Concatenate(FragmentA=concat_35, FragmentB=rep_16)
concat_38 = Concatenate(FragmentA=panel_33, FragmentE=" ", FragmentB=rep_16, FragmentC=" ", FragmentD=rep_14)
volume_data_ballast_water_tank = Panel([concat_36, concat_37])
volume_data_ballast_water_tank_2 = Panel([case_10.UpperCase, concat_38])

# ---- group: Volume Waterballast tank 2 (continued)
volume_8 = Volume(Geometry=cap_tankfilling_brep_5)  # -> Volume, Centroid
box_corners_16 = BoxCorners(Box=cap_tankfilling_brep_5)  # -> AMinXYZ, CornerB, CornerC, CornerD, CornerE, CornerF, GMaxXYZ, CornerH
sift_71 = SiftPattern(List=cap_tankfilling_brep_5, SiftPattern=toggle_show_tanks)  # -> Output0, Output1
debrep_9 = DeconstructBrep(Brep=cap_tankfilling_brep_5)  # -> flatten(Faces), Edges, Vertices
pt2num_54 = PointsToNumbers(Points=box_corners_16.AMinXYZ, Mask=1)
pt2num_55 = PointsToNumbers(
    Points=[box_corners_16.AMinXYZ, box_corners_16.CornerB, box_corners_16.CornerC, box_corners_16.CornerD, box_corners_16.CornerE, box_corners_16.CornerF, box_corners_16.GMaxXYZ, box_corners_16.CornerH],
    Mask=1)
pt2num_56 = PointsToNumbers(Points=box_corners_16.GMaxXYZ, Mask=1)
preview_25 = CustomPreview(Geometry=sift_71.Output1, Material=water_ballast)
boxprop_18 = BoxProperties(Box=debrep_9.Faces)  # -> Center, Diagonal, Area, Volume, Degeneracy
subtraction_28 = Subtraction(A=pt2num_56, B=pt2num_54)
srf_cp_6 = SurfaceClosestPoint(Point=flatten(boxprop_18.Center), Surface=pxs_17)  # -> Point, UVPoint, Distance
sort_20 = SortList(Keys=srf_cp_6.Distance, ValuesA=debrep_9.Faces)  # -> Keys, ValuesA
item_38 = ListItem(List=sort_20.ValuesA, Index=0, Wrap=True)
amoments_5 = AreaMoments(Geometry=item_38)  # -> Area, Centroid, Inertia, Secondary, Gyration
num2pt_14 = NumbersToPoints(Numbers=pt2num_54, Mask=1)
line_10 = LineSDL(Start=num2pt_14, Direction=Vector(1, 0, 0), Length=subtraction_28)
frm_7 = PerpFrames(Curve=line_10, Number=eval_83, Align=True)  # -> flatten(Frames), Parameters
sift_72 = SiftPattern(List=cap_tankfilling_brep_5, SiftPattern=and)  # -> Output0, Output1

# ----
eval_98 = Evaluate(F="round(x/(y^3),z)", x=volume_8.Volume, y=output_dimension, z=nr_of_digits_output)
eval_99 = Evaluate(F="round(x/(y^1),z)", x=volume_8.Centroid, y=output_dimension, z=nr_of_digits_output)
eval_100 = Evaluate(F="round(x/(y^1),z)", x=boxprop_8.Diagonal, y=output_dimension, z=nr_of_digits_output)
eval_101 = Evaluate(F="round(x/(y^2),z)", x=amoments_5.Area, y=output_dimension, z=nr_of_digits_output)
eval_102 = Evaluate(F="round(x/(y^1),z)", x=amoments_5.Centroid, y=output_dimension, z=nr_of_digits_output)
eval_103 = Evaluate(F="round(x/(y^4),z)", x=amoments_5.Inertia, y=output_dimension, z=nr_of_digits_output)
panel_35 = Panel("""Volume WB
COV WB
Height of WB
Tank lxbxh
Area WB plane
COA WB plane
Inertia WB plane""")
merge_13 = Merge(
    Data1=flatten(eval_98),
    Data2=flatten(eval_99),
    Data3=flatten(dam_13.DataB),
    Data4=flatten(eval_100),
    Data5=flatten(eval_101),
    Data6=flatten(eval_102),
    Data7=flatten(eval_103))  # -> flatten(Result)
nullrep_28 = ReplaceNulls(Items=merge_13, Replacements=0)  # -> Items, Count
panel_36 = Panel("""m3
m
% of h_tank
m
m2
m
m4""")
rep_17 = ReplaceText(Text=panel_36, Find="m", Replace=eval_3, RecursiveReplace=False)
rep_18 = ReplaceText(Text=nullrep_28.Items, Find="{", RecursiveReplace=False)
case_11 = TextCase(Text="WB Tank 2", Culture=127)  # -> UpperCase, LowerCase
rep_19 = ReplaceText(Text=rep_18, Find="}", RecursiveReplace=False)
concat_39 = Concatenate(FragmentB=panel_35, FragmentA=" [", FragmentC=rep_17, FragmentD="], ")
concat_40 = Concatenate(FragmentB=case_11.UpperCase, FragmentA=concat_group_version_number)
concat_41 = Concatenate(FragmentA=concat_39, FragmentB=rep_19)
concat_42 = Concatenate(FragmentA=panel_35, FragmentE=" ", FragmentB=rep_19, FragmentC=" ", FragmentD=rep_17)
volume_data_ballast_water_tank_3 = Panel([concat_40, concat_41])
volume_data_ballast_water_tank_4 = Panel([case_11.UpperCase, concat_42])

# ---- group: Volume Waterballast tank 1 (continued)
sift_73 = SiftPattern(List=cap_tankfilling_brep_6, SiftPattern=toggle_show_tanks)  # -> Output0, Output1
volume_9 = Volume(Geometry=cap_tankfilling_brep_6)  # -> Volume, Centroid
box_corners_17 = BoxCorners(Box=cap_tankfilling_brep_6)  # -> AMinXYZ, CornerB, CornerC, CornerD, CornerE, CornerF, GMaxXYZ, CornerH
preview_26 = CustomPreview(Geometry=sift_73.Output1, Material=water_ballast)
debrep_10 = DeconstructBrep(Brep=cap_tankfilling_brep_6)  # -> flatten(Faces), Edges, Vertices
pt2num_57 = PointsToNumbers(Points=box_corners_17.AMinXYZ, Mask=1)
pt2num_58 = PointsToNumbers(Points=box_corners_17.GMaxXYZ, Mask=1)
pt2num_59 = PointsToNumbers(
    Points=[box_corners_17.AMinXYZ, box_corners_17.CornerB, box_corners_17.CornerC, box_corners_17.CornerD, box_corners_17.CornerE, box_corners_17.CornerF, box_corners_17.GMaxXYZ, box_corners_17.CornerH],
    Mask=1)
boxprop_19 = BoxProperties(Box=debrep_10.Faces)  # -> Center, Diagonal, Area, Volume, Degeneracy
subtraction_29 = Subtraction(A=pt2num_58, B=pt2num_57)
srf_cp_7 = SurfaceClosestPoint(Point=flatten(boxprop_19.Center), Surface=pxs_15)  # -> Point, UVPoint, Distance
sort_21 = SortList(Keys=srf_cp_7.Distance, ValuesA=debrep_10.Faces)  # -> Keys, ValuesA
item_39 = ListItem(List=sort_21.ValuesA, Index=0, Wrap=True)
amoments_6 = AreaMoments(Geometry=item_39)  # -> Area, Centroid, Inertia, Secondary, Gyration
num2pt_15 = NumbersToPoints(Numbers=pt2num_57, Mask=1)
line_11 = LineSDL(Start=num2pt_15, Direction=Vector(1, 0, 0), Length=subtraction_29)
frm_8 = PerpFrames(Curve=line_11, Number=eval_91, Align=True)  # -> flatten(Frames), Parameters
sift_74 = SiftPattern(List=cap_tankfilling_brep_6, SiftPattern=and)  # -> Output0, Output1

# ---- group: Schotten van de WB tanks
panel_37 = Panel([pt2num_59, pt2num_55, pt2num_53])

# ---- group: X division method 2: creates the division over the length of all cross sectional tables and curves including Xstern, X_app, Xwl_aft, XstartMidship, XstartForeship, X_tanks, Xwl_fwd, Xfpp, Xfwd_oa (continued)
sort_22 = SortList(Keys=flatten([subtraction_7, eval_21, addition_2, filter_lpp_0_or_lpp_1, pt2num_23, pt2num_22, x_app, panel_37]))  # -> Keys, ValuesA
num2pt_16 = NumbersToPoints(Numbers=sort_22.Keys, Mask=1)
cullpt_2 = CullDuplicates(Points=num2pt_16, Tolerance=0.1, CullMode=3)  # -> Points, Indices, Valence
shift = ShiftList(List=cullpt_2.Points, Shift=1, Wrap=False)
weave = Weave(Pattern=[0, 1], Stream0=graft(cullpt_2.Points), Stream1=graft(shift), NullGaps=False)
xstern_x_app_xwl_aft_xstartmidship_xstar = Panel(cullpt_2.Points)  # "Xstern, X_app, Xwl_aft, XstartMidship, XstartForeship, X_tanks, Xwl_fwd, Xfpp, Xfwd_oa"
item_40 = ListItem(List=weave, Index=0, Wrap=True)  # -> Item, Item1
ln_11 = Line(StartPoint=item_40.Item, EndPoint=item_40.Item1)
len = Length(Curve=ln_11)
larger_5 = LargerThan(FirstNumber=len, SecondNumber=expr("x/4", filter_lpp_0_or_lpp_1))  # -> LargerThan, OrEqualTo
eval_104 = Evaluate(F="IF(x=FALSE,y,y*2)", x=larger_5.LargerThan, y=number_slider)
frm_9 = PerpFrames(Curve=ln_11, Number=eval_104, Align=True)  # -> flatten(Frames), Parameters
cullpt_3 = CullDuplicates(Points=frm_9.Frames, Tolerance=0.1, CullMode=3)  # -> flatten(Points), Indices, Valence
yz_8 = YZPlane(Origin=cullpt_3.Points)

# ---- group: selection of X division method (continued)
filter_6 = StreamFilter(Gate=x_division_method_2, Stream1=frm_4.Frames, Stream2=yz_8)
filter_7 = StreamFilter(Gate=x_division_method_2, Stream1=frm_5.Frames, Stream2=yz_8)

# ----
sift_75 = SiftPattern(List=filter_6, SiftPattern=bool_volume_related_output)  # -> Output0, Output1
sift_76 = SiftPattern(List=filter_7, SiftPattern=bool_volume_related_output)  # -> Output0, Output1

# ---- group: Creation of frames for cross sectional areas
sift_77 = SiftPattern(List=filter_3, SiftPattern=toggle_cross_area_curves)  # -> Output0, Output1
sec_frames_2 = BrepPlane(Brep=sift_19.Output1, Plane=sift_76.Output1)  # -> Curves, Points
sec_frames_3 = BrepPlane(Brep=sift_77.Output1, Plane=sift_75.Output1)  # -> Curves, Points

# ---- group: selection of relevant cross sections
pt2num_60 = PointsToNumbers(Points=yz_8, Mask=1)
larger_6 = LargerThan(FirstNumber=pt2num_60, SecondNumber=expr("x-1", pt2num_27))  # -> LargerThan, OrEqualTo
smaller_4 = SmallerThan(FirstNumber=pt2num_60, SecondNumber=expr("x+1", pt2num_25))  # -> SmallerThan, OrEqualTo
and_7 = GateAnd(A=larger_6.LargerThan, B=smaller_4.SmallerThan)
dispatch_12 = Dispatch(List=yz_8, DispatchPattern=and_7)  # -> ListA, ListB

pt2num_61 = PointsToNumbers(Points=yz_8, Mask=1)
larger_7 = LargerThan(FirstNumber=pt2num_61, SecondNumber=expr("x-1", pt2num_32))  # -> LargerThan, OrEqualTo
smaller_5 = SmallerThan(FirstNumber=pt2num_61, SecondNumber=expr("x+1", pt2num_30))  # -> SmallerThan, OrEqualTo
and_8 = GateAnd(A=larger_7.OrEqualTo, B=smaller_5.OrEqualTo)
dispatch_13 = Dispatch(List=yz_8, DispatchPattern=and_8)  # -> ListA, ListB

pt2num_62 = PointsToNumbers(Points=yz_8, Mask=1)
larger_8 = LargerThan(FirstNumber=pt2num_62, SecondNumber=expr("x-1", pt2num_36))  # -> LargerThan, OrEqualTo
smaller_6 = SmallerThan(FirstNumber=pt2num_62, SecondNumber=expr("x+1", pt2num_35))  # -> SmallerThan, OrEqualTo
and_9 = GateAnd(A=larger_8.LargerThan, B=smaller_6.SmallerThan)
dispatch_14 = Dispatch(List=yz_8, DispatchPattern=and_9)  # -> ListA, ListB

# ----
eval_105 = Evaluate(F="round(x/(y^3),z)", x=volume_9.Volume, y=output_dimension, z=nr_of_digits_output)
eval_106 = Evaluate(F="round(x/(y^1),z)", x=volume_9.Centroid, y=output_dimension, z=nr_of_digits_output)
eval_107 = Evaluate(F="round(x/(y^4),z)", x=amoments_6.Inertia, y=output_dimension, z=nr_of_digits_output)
eval_108 = Evaluate(F="round(x/(y^1),z)", x=boxprop_9.Diagonal, y=output_dimension, z=nr_of_digits_output)
eval_109 = Evaluate(F="round(x/(y^2),z)", x=amoments_6.Area, y=output_dimension, z=nr_of_digits_output)
eval_110 = Evaluate(F="round(x/(y^1),z)", x=amoments_6.Centroid, y=output_dimension, z=nr_of_digits_output)
panel_38 = Panel("""Volume water ballast
COV WB
Height of WB
Tank lxbxh
Area WB plane
COA WB plane
Inertia WB plane""")
merge_14 = Merge(
    Data1=flatten(eval_105),
    Data2=flatten(eval_106),
    Data3=flatten(dam_13.DataA),
    Data4=flatten(eval_108),
    Data5=flatten(eval_109),
    Data6=flatten(eval_110),
    Data7=flatten(eval_107))  # -> flatten(Result)
nullrep_29 = ReplaceNulls(Items=merge_14, Replacements=0)  # -> Items, Count
panel_39 = Panel("""m3
m
% of h_tank
m
m2
m
m4""")
case_12 = TextCase(Text="WB Tank 1", Culture=127)  # -> UpperCase, LowerCase
rep_20 = ReplaceText(Text=nullrep_29.Items, Find="{", RecursiveReplace=False)
rep_21 = ReplaceText(Text=panel_39, Find="m", Replace=eval_3, RecursiveReplace=False)
rep_22 = ReplaceText(Text=rep_20, Find="}", RecursiveReplace=False)
concat_43 = Concatenate(FragmentB=panel_38, FragmentA=" [", FragmentC=rep_21, FragmentD="], ")
concat_44 = Concatenate(FragmentB=case_12.UpperCase, FragmentA=concat_group_version_number)
concat_45 = Concatenate(FragmentA=panel_38, FragmentE=" ", FragmentB=rep_22, FragmentC=" ", FragmentD=rep_21)
concat_46 = Concatenate(FragmentA=concat_43, FragmentB=rep_22)
volume_data_ballast_water_tank_5 = Panel([case_12.UpperCase, concat_45])
volume_data_ballast_water_tank_6 = Panel([concat_44, concat_46])

# ---- group: Voorste en hoogste punt van de centerlijn
sift_78 = SiftPattern(List=brep_ps_sb_shell_joined, SiftPattern=toggle_cross_area_curves)  # -> Output0, Output1
sec_7 = BrepPlane(Brep=sift_78.Output1, Plane=scale_6.Geometry)  # -> Centerline, Points
pcx_6 = CurvePlane(Curve=sec_7.Centerline, Plane=sift_75.Output1)  # -> Points, ParamsC, ParamsP

# ----
pdecon_35 = Deconstruct(Point=pcx_6.Points)  # -> XComponent, YComponent, ZComponent
sort_23 = SortList(Keys=pdecon_35.ZComponent, ValuesA=pcx_6.Points)  # -> Keys, ValuesA

# ---- group: Voorste en hoogste punt van de centerlijn (continued)
lng_5 = ListLength(List=sort_23.ValuesA)
item_41 = ListItem(List=pcx_6.Points, Index=lng_5, Wrap=True)
sift_79 = SiftPattern(List=item_41, SiftPattern=toggle_data_wrt_global_strength)  # -> Output0, Output1
pt2num_63 = PointsToNumbers(Points=sift_79.Output1, Mask=11)

# ---- group: Kiest punten bij een bulbboeg
item_42 = ListItem(List=pcx_6.Points, Index=0, Wrap=False)  # -> Item, Item1
null_6 = NullItem(Item=item_42.Item1)  # -> NullFlags, InvalidFlags, Description
dispatch_15 = Dispatch(List=item_42.Item1, DispatchPattern=null_6.NullFlags)  # -> ListA, ListB
pt2num_64 = PointsToNumbers(Points=dispatch_15.ListB, Mask=11)
pshift = ShiftPaths(Data=pt2num_64, Offset=-1)
nullrep_30 = ReplaceNulls(Items=dispatch_15.ListA, Replacements=eval_17)  # -> Items, Count

# ----
pt2num_65 = PointsToNumbers(Points=item_42.Item, Mask=11)

# ---- group: Curves of Cross sectional areas
# Curves of cross sectional areas
# Sums the  two areas
# (in case of a bulb)
# Set a value of 0 at empty lists
# Sums the  two areas
# (in case of a bulb)
scale_kvs = Slider(16203, range=1..20000)
scale_8 = Number(combine.Result)
cir = Circle(Plane=PlaneYZ(0, 0, 0), Radius=10000)
flip_4 = FlipCurve(Curve=sec_frames_3.Curves, Guide=cir)  # -> Curve, Flag
flip_5 = FlipCurve(Curve=sec_frames_2.Curves, Guide=cir)  # -> Curve, Flag
boundary_5 = BoundarySurfaces(Edges=simplify(flip_5.Curve))
boundary_6 = BoundarySurfaces(Edges=flip_4.Curve)
swatch = ColourSwatch(SwatchColor=RGBA(0, 0, 150, 147))
swatch_2 = ColourSwatch(SwatchColor=RGB(0, 116, 255))
division_28 = Division(A=scale_kvs, B=scale_8)
division_29 = Division(A=scale_kvs, B=scale_8)
pt_23 = PointOriented(FramePoints=sift_75.Output1, UComponent=0, VComponent=0, WComponent=0)
pt_24 = PointOriented(FramePoints=sift_76.Output1, UComponent=0, VComponent=0, WComponent=0)
pt2num_66 = PointsToNumbers(Points=pt_23, Mask=1)
pt2num_67 = PointsToNumbers(Points=pt_24, Mask=1)
pt_25 = ConstructPoint(XCoordinate=pt2num_66, YCoordinate=0, ZCoordinate=0)
pt_26 = ConstructPoint(XCoordinate=pt2num_67, YCoordinate=0, ZCoordinate=0)
T_5 = Text("Total Cross Section Areas")
T_6 = Text("Buoyant Cross Section Areas")
sift_80 = SiftPattern(List=T_5, SiftPattern=and)  # -> Output0, Output1
sift_81 = SiftPattern(List=T_6, SiftPattern=and)  # -> Output0, Output1

# ----
area_24 = Area(Geometry=boundary_6)  # -> Area, Centroid
sift_82 = SiftPattern(List=[flip_5.Curve, flip_4.Curve], SiftPattern=button_show_cross_sections)  # -> Output0, Output1

# ---- group: maakt plakjes huid mbv offset
sift_83 = SiftPattern(List=flip_4.Curve, SiftPattern=toggle_data_wrt_global_strength)  # -> Output0, Output1
larger_9 = LargerThan(FirstNumber=eval_9, SecondNumber=0)  # -> LargerThan, OrEqualTo
gate = StreamGate(Stream=sift_83.Output1, Gate=larger_9.LargerThan)  # -> Target0, Target1
offset = OffsetCurve(Curve=gate.Target1, Distance=eval_9, Plane=PlaneYZ(0, 0, 0), Corners=1)
pshift_2 = ShiftPaths(Data=offset, Offset=-1)
merge_15 = Merge(Data1=gate.Target1, Data2=pshift_2)
boundary_7 = BoundarySurfaces(Edges=merge_15)

# ----
sift_84 = SiftPattern(List=boundary_5, SiftPattern=button_show_cross_sections)  # -> Output0, Output1
area_25 = Area(Geometry=boundary_5)  # -> Area, Centroid

# ---- group: Volume Waterballast tank 2 (continued)
filter_8 = StreamFilter(Gate=x_division_method_2, Stream1=frm_7.Frames, Stream2=dispatch_13.ListA)
pt2num_68 = PointsToNumbers(Points=filter_8, Mask=1)
sec_frames_4 = BrepPlane(Brep=sift_72.Output1, Plane=filter_8)  # -> Curves, Points
flip_6 = FlipCurve(Curve=sec_frames_4.Curves, Guide=cir)  # -> Curve, Flag
boundary_8 = BoundarySurfaces(Edges=simplify(flip_6.Curve))
area_26 = Area(Geometry=boundary_8)  # -> Area, flatten(Centroid)
sift_85 = SiftPattern(List=boundary_8, SiftPattern=and_4)  # -> Output0, Output1
null_7 = NullItem(Item=area_26.Area)  # -> NullFlags, InvalidFlags, Description
lng_6 = ListLength(List=area_26.Area)
preview_27 = CustomPreview(Geometry=sift_85.Output1, Material=tank2_outline)
p_n_c_2 = PickNChoose(Pattern=null_7.NullFlags, Stream0=area_26.Area, Stream1=lng_6)
dispatch_16 = Dispatch(List=p_n_c_2, DispatchPattern=[True, False])  # -> ListA, ListB
addition_7 = Addition(A=dispatch_16.ListA, B=dispatch_16.ListB)  # -> flatten(Result)
division_30 = Division(A=scale_kvs, B=scale_8)
division_31 = Division(A=addition_7, B=division_30)
pt_27 = ConstructPoint(XCoordinate=pt2num_68, YCoordinate=0, ZCoordinate=0)
line_12 = LineSDL(Start=pt_27, Direction=Vector(0, 0, -1), Length=flatten(division_31))
end_15 = EndPoints(Curve=line_12)  # -> Start, flatten(End)
intcrv_4 = Interpolate(Vertices=end_15.End, Degree=3, Periodic=False, KnotStyle=1)  # -> Curve, Length, Domain
end_16 = EndPoints(Curve=intcrv_4.Curve)  # -> Start, End
pt2num_69 = PointsToNumbers(Points=end_16.Start, Mask=1)
pt2num_70 = PointsToNumbers(Points=end_16.End, Mask=1)
midpt_4 = CurveMiddle(Curve=intcrv_4.Curve)
num2pt_17 = NumbersToPoints(Numbers=pt2num_69, Mask=1)
num2pt_18 = NumbersToPoints(Numbers=pt2num_70, Mask=1)
xz_6 = XZPlane(Origin=midpt_4)
ln_12 = Line(StartPoint=num2pt_17, EndPoint=num2pt_18)
join_9 = JoinCurves(Curves=[intcrv_4.Curve, ln_12], Preserve=False)
sift_86 = SiftPattern(List=[join_9, line_12], SiftPattern=and)  # -> Output0, Output1
preview_28 = CustomPreview(Geometry=sift_86.Output1, Shader=tank2_outline)
tag = TextTag3D(Location=xz_6, Text=sift_23.Output1, Size=eval_4, Colour=tank2_outline, Justification=2)

# ---- group: Volume Waterballast tank 1 (continued)
filter_9 = StreamFilter(Gate=x_division_method_2, Stream1=frm_8.Frames, Stream2=dispatch_14.ListA)
sec_frames_5 = BrepPlane(Brep=sift_74.Output1, Plane=filter_9)  # -> Curves, Points
clean_4 = CleanTree(RemoveNulls=True, RemoveInvalid=True, RemoveEmpty=True, Tree=sec_frames_5.Curves)  # disabled
flip_7 = FlipCurve(Curve=sec_frames_5.Curves, Guide=cir)  # -> Curve, Flag
boundary_9 = BoundarySurfaces(Edges=simplify(flip_7.Curve))
area_27 = Area(Geometry=boundary_9)  # -> Area, flatten(Centroid)
pt_28 = PointOriented(FramePoints=area_27.Centroid, UComponent=0, VComponent=0, WComponent=0)  # disabled
sift_87 = SiftPattern(List=boundary_9, SiftPattern=and_5)  # -> Output0, Output1
null_8 = NullItem(Item=area_27.Area)  # -> NullFlags, InvalidFlags, Description
lng_7 = ListLength(List=area_27.Area)
preview_29 = CustomPreview(Geometry=sift_87.Output1, Material=tank1_outline)
p_n_c_3 = PickNChoose(Pattern=null_8.NullFlags, Stream0=area_27.Area, Stream1=lng_7)
dispatch_17 = Dispatch(List=p_n_c_3, DispatchPattern=[True, False])  # -> ListA, ListB
addition_8 = Addition(A=dispatch_17.ListA, B=dispatch_17.ListB)  # -> flatten(Result)
division_32 = Division(A=scale_kvs, B=scale_8)
division_33 = Division(A=addition_8, B=division_32)
pt2num_71 = PointsToNumbers(Points=filter_9, Mask=1)
pt_29 = ConstructPoint(XCoordinate=pt2num_71, YCoordinate=0, ZCoordinate=0)
line_13 = LineSDL(Start=pt_29, Direction=Vector(0, 0, -1), Length=flatten(division_33))
end_17 = EndPoints(Curve=line_13)  # -> Start, flatten(End)
intcrv_5 = Interpolate(Vertices=end_17.End, Degree=3, Periodic=False, KnotStyle=1)  # -> Curve, Length, Domain
end_18 = EndPoints(Curve=intcrv_5.Curve)  # -> Start, End
pt2num_72 = PointsToNumbers(Points=end_18.Start, Mask=1)
pt2num_73 = PointsToNumbers(Points=end_18.End, Mask=1)
midpt_5 = CurveMiddle(Curve=intcrv_5.Curve)
num2pt_19 = NumbersToPoints(Numbers=pt2num_72, Mask=1)
num2pt_20 = NumbersToPoints(Numbers=pt2num_73, Mask=1)
xz_7 = XZPlane(Origin=midpt_5)
ln_13 = Line(StartPoint=num2pt_19, EndPoint=num2pt_20)
join_10 = JoinCurves(Curves=[intcrv_5.Curve, ln_13], Preserve=False)
sift_88 = SiftPattern(List=[join_10, line_13], SiftPattern=and)  # -> Output0, Output1
preview_30 = CustomPreview(Geometry=[sift_88.Output1, intcrv_2.Curve], Shader=tank1_outline)
tag_2 = TextTag3D(Location=xz_7, Text=sift_25.Output1, Size=eval_4, Colour=tank1_outline, Justification=2)

# ---- group: Volume Waterballast tank 3 (continued)
filter_10 = StreamFilter(Gate=x_division_method_2, Stream1=frm_6.Frames, Stream2=dispatch_12.ListA)
sec_frames_6 = BrepPlane(Brep=sift_70.Output1, Plane=filter_10)  # -> Curves, Points
pt2num_74 = PointsToNumbers(Points=filter_10, Mask=1)
clean_5 = CleanTree(RemoveNulls=True, RemoveInvalid=True, RemoveEmpty=True, Tree=sec_frames_6.Curves)  # disabled
flip_8 = FlipCurve(Curve=sec_frames_6.Curves, Guide=cir)  # -> Curve, Flag
boundary_10 = BoundarySurfaces(Edges=simplify(flip_8.Curve))
sift_89 = SiftPattern(List=boundary_10, SiftPattern=and_6)  # -> Output0, Output1
area_28 = Area(Geometry=boundary_10)  # -> Area, flatten(Centroid)
null_9 = NullItem(Item=area_28.Area)  # -> NullFlags, InvalidFlags, Description
lng_8 = ListLength(List=area_28.Area)
preview_31 = CustomPreview(Geometry=sift_89.Output1, Material=tank3_outline)
p_n_c_4 = PickNChoose(Pattern=null_9.NullFlags, Stream0=area_28.Area, Stream1=lng_8)
dispatch_18 = Dispatch(List=p_n_c_4, DispatchPattern=[True, False])  # -> ListA, ListB
addition_9 = Addition(A=dispatch_18.ListA, B=dispatch_18.ListB)  # -> flatten(Result)
division_34 = Division(A=scale_kvs, B=scale_8)
division_35 = Division(A=addition_9, B=division_34)
pt_30 = ConstructPoint(XCoordinate=pt2num_74, YCoordinate=0, ZCoordinate=0)
line_14 = LineSDL(Start=pt_30, Direction=Vector(0, 0, -1), Length=flatten(division_35))
end_19 = EndPoints(Curve=line_14)  # -> Start, flatten(End)
intcrv_6 = Interpolate(Vertices=end_19.End, Degree=3, Periodic=False, KnotStyle=1)  # -> Curve, Length, Domain
end_20 = EndPoints(Curve=intcrv_6.Curve)  # -> Start, End
pt2num_75 = PointsToNumbers(Points=end_20.Start, Mask=1)
pt2num_76 = PointsToNumbers(Points=end_20.End, Mask=1)
midpt_6 = CurveMiddle(Curve=intcrv_6.Curve)
num2pt_21 = NumbersToPoints(Numbers=pt2num_75, Mask=1)
num2pt_22 = NumbersToPoints(Numbers=pt2num_76, Mask=1)
xz_8 = XZPlane(Origin=midpt_6)
ln_14 = Line(StartPoint=num2pt_21, EndPoint=num2pt_22)
join_11 = JoinCurves(Curves=[intcrv_6.Curve, ln_14], Preserve=False)
sift_90 = SiftPattern(List=[join_11, line_14], SiftPattern=and)  # -> Output0, Output1
preview_32 = CustomPreview(Geometry=sift_90.Output1, Shader=tank3_outline)
tag_3 = TextTag3D(Location=xz_8, Text=sift_27.Output1, Size=eval_4, Colour=tank3_outline, Justification=2)

# ----
preview_33 = CustomPreview(Geometry=sift_84.Output1, Material=swatch)
preview_34 = CustomPreview(Geometry=sift_82.Output1, Material=swatch_2)

# ---- group: Curves of Cross sectional areas (continued)
null_10 = NullItem(Item=area_25.Area)  # -> NullFlags, InvalidFlags, Description
lng_9 = ListLength(List=area_25.Area)
p_n_c_5 = PickNChoose(Pattern=null_10.NullFlags, Stream0=area_25.Area, Stream1=lng_9)
null_11 = NullItem(Item=area_24.Area)  # -> NullFlags, InvalidFlags, Description
lng_10 = ListLength(List=area_24.Area)
p_n_c_6 = PickNChoose(Pattern=null_11.NullFlags, Stream0=area_24.Area, Stream1=lng_10)
dispatch_19 = Dispatch(List=p_n_c_5, DispatchPattern=[True, False])  # -> ListA, ListB
dispatch_20 = Dispatch(List=p_n_c_6, DispatchPattern=[True, False])  # -> ListA, ListB
addition_10 = Addition(A=dispatch_20.ListA, B=dispatch_20.ListB)  # -> flatten(Result)
addition_11 = Addition(A=dispatch_19.ListA, B=dispatch_19.ListB)  # -> flatten(Result)
division_36 = Division(A=addition_10, B=division_28)
division_37 = Division(A=addition_11, B=division_29)
line_15 = LineSDL(Start=pt_26, Direction=Vector(0, 0, -1), Length=flatten(division_37))
line_16 = LineSDL(Start=pt_25, Direction=Vector(0, 0, -1), Length=flatten(division_36))
end_21 = EndPoints(Curve=line_15)  # -> Start, flatten(End)
end_22 = EndPoints(Curve=line_16)  # -> Start, flatten(End)
intcrv_7 = Interpolate(Vertices=end_22.End, Degree=3, Periodic=False, KnotStyle=1)  # -> Curve, Length, Domain
intcrv_8 = Interpolate(Vertices=end_21.End, Degree=3, Periodic=False, KnotStyle=1)  # -> Curve, Length, Domain
end_23 = EndPoints(Curve=intcrv_7.Curve)  # -> Start, End
end_24 = EndPoints(Curve=intcrv_8.Curve)  # -> Start, End
midpt_7 = CurveMiddle(Curve=intcrv_7.Curve)
pt2num_77 = PointsToNumbers(Points=end_23.Start, Mask=1)
pt2num_78 = PointsToNumbers(Points=end_23.End, Mask=1)
pt2num_79 = PointsToNumbers(Points=end_24.Start, Mask=1)
pt2num_80 = PointsToNumbers(Points=end_24.End, Mask=1)
midpt_8 = CurveMiddle(Curve=intcrv_8.Curve)
num2pt_23 = NumbersToPoints(Numbers=pt2num_77, Mask=1)
num2pt_24 = NumbersToPoints(Numbers=pt2num_78, Mask=1)
num2pt_25 = NumbersToPoints(Numbers=pt2num_79, Mask=1)
num2pt_26 = NumbersToPoints(Numbers=pt2num_80, Mask=1)
xz_9 = XZPlane(Origin=midpt_7)
xz_10 = XZPlane(Origin=midpt_8)
ln_15 = Line(StartPoint=num2pt_23, EndPoint=num2pt_24)
ln_16 = Line(StartPoint=num2pt_25, EndPoint=num2pt_26)
join_12 = JoinCurves(Curves=[intcrv_7.Curve, ln_15], Preserve=False)
join_13 = JoinCurves(Curves=[intcrv_8.Curve, ln_16], Preserve=False)
sift_91 = SiftPattern(List=[join_13, line_15], SiftPattern=and)  # -> Output0, Output1
sift_92 = SiftPattern(List=[join_12, line_16], SiftPattern=and)  # -> Output0, Output1
tag_4 = TextTag3D(Location=xz_9, Text=sift_80.Output1, Size=eval_4, Colour=swatch_2, Justification=2)
tag_5 = TextTag3D(Location=xz_10, Text=sift_81.Output1, Size=eval_4, Colour=swatch, Justification=2)
preview_35 = CustomPreview(Geometry=sift_91.Output1, Shader=swatch)
preview_36 = CustomPreview(Geometry=sift_92.Output1, Shader=swatch_2)

# ----
offset_2 = OffsetCurve(Curve=gate.Target1, Distance=expr("x/2", eval_9), Plane=PlaneYZ(0, 0, 0), Corners=1)

# ---- group: Data of Inertia wrt longitudinal bending
len_2 = Length(Curve=offset_2)
box_corners_18 = BoxCorners(Box=boundary_7)  # -> AMinXYZ, CornerB, CornerC, CornerD, CornerE, CornerF, GMaxXYZ, CornerH; disabled
amoments_7 = AreaMoments(Geometry=boundary_7)  # -> Area, Centroid, Inertia, Secondary, Gyration
pt2num_81 = PointsToNumbers(Points=box_corners_18.GMaxXYZ, Mask=11)  # disabled
pt2num_82 = PointsToNumbers(Points=box_corners_18.AMinXYZ, Mask=11)  # disabled
null_12 = NullItem(Item=len_2)  # -> NullFlags, InvalidFlags, Description
null_13 = NullItem(Item=pt2num_81)  # -> NullFlags, InvalidFlags, Description; disabled
null_14 = NullItem(Item=pt2num_82)  # -> NullFlags, InvalidFlags, Description; disabled
merge_16 = Merge(Data1=nullrep_30.Items, Data2=pshift)
p_n_c_7 = PickNChoose(Pattern=null_12.NullFlags, Stream0=len_2, Stream1=0)
p_n_c_8 = PickNChoose(Pattern=null_13.NullFlags, Stream0=pt2num_81, Stream1=0)  # disabled
p_n_c_9 = PickNChoose(Pattern=null_14.NullFlags, Stream0=pt2num_82, Stream1=pt2num_63)  # disabled

null_15 = NullItem(Item=amoments_7.Area)  # -> NullFlags, InvalidFlags, Description
null_16 = NullItem(Item=amoments_7.Centroid)  # -> NullFlags, InvalidFlags, Description
null_17 = NullItem(Item=amoments_7.Inertia)  # -> NullFlags, InvalidFlags, Description
p_n_c_10 = PickNChoose(Pattern=null_16.NullFlags, Stream0=amoments_7.Centroid, Stream1=sift_79.Output1)
p_n_c_11 = PickNChoose(Pattern=null_15.NullFlags, Stream0=amoments_7.Area, Stream1=0)
p_n_c_12 = PickNChoose(Pattern=null_17.NullFlags, Stream0=amoments_7.Inertia, Stream1=Point(0, 0, 0))

# ----
# Calculation of Am
sort_24 = SortList(Keys=addition_11)  # -> Keys, ValuesA
lng_11 = ListLength(List=sort_24.Keys)  # -> expr("x-1", Length)
item_43 = ListItem(List=sort_24.Keys, Index=lng_11, Wrap=True)

# ---- group: Curve of Inertia wrt longitudinal bending
panel_40 = Panel("Data of shell plating with respect to Global Strength (Inertia around centroid)")
pt_31 = Point(Point(0, 0, 0))
eval_111 = Evaluate(F="if(t=0,y,x)", x=p_n_c_10, t=eval_9, y=pt_31)
int_2 = Integer(0)
eval_112 = Evaluate(F="if(t=0,y,x)", x=p_n_c_7, t=eval_9, y=int_2)
eval_113 = Evaluate(F="round(x/(y^1),z)", x=eval_111, y=output_dimension, z=nr_of_digits_output)
eval_114 = Evaluate(F="round(x/(y^1),z)", x=pt2num_65, y=output_dimension, z=nr_of_digits_output)
eval_115 = Evaluate(F="round(x/(y^4),z)", x=p_n_c_12, y=output_dimension, z=nr_of_digits_output)
eval_116 = Evaluate(F="round(x/(y^1),z)", x=eval_112, y=output_dimension, z=nr_of_digits_output)
eval_117 = Evaluate(F="round(x/(y^2),z)", x=p_n_c_11, y=output_dimension, z=nr_of_digits_output)
nullrep_31 = ReplaceNulls(Items=eval_113, Replacements=0)  # -> Items, Count
eval_118 = Evaluate(F="round(x/(y^1),z)", x=merge_16, y=output_dimension, z=nr_of_digits_output)
pt2num_83 = PointsToNumbers(Points=eval_113, Mask=1)
txt = Text(",")
concat_47 = Concatenate(FragmentA="Mean shell thickness [mm]", FragmentC=",", FragmentB=eval_9)
concat_48 = Concatenate(FragmentA="[", FragmentB=eval_3, FragmentC="]", FragmentD=",")
concat_49 = Concatenate(FragmentA="[", FragmentB=eval_3, FragmentC="2]", FragmentD=",")
case_13 = TextCase(Text=panel_40, Culture=127)  # -> UpperCase, LowerCase
concat_50 = Concatenate(FragmentA="[", FragmentB=eval_3, FragmentC="4]", FragmentD=",")
concat_51 = Concatenate(
    FragmentI=pt2num_83,
    FragmentH=txt,
    FragmentA=eval_116,
    FragmentB=txt,
    FragmentC=eval_117,
    FragmentD=txt,
    FragmentE=nullrep_31.Items,
    FragmentF=txt,
    FragmentG=eval_115,
    FragmentJ=txt,
    FragmentK=eval_114,
    FragmentL=txt,
    FragmentM=eval_118)
concat_52 = Concatenate(FragmentA=case_13.UpperCase, FragmentB=concat_group_version_number, FragmentC=", ", FragmentD=concat_47)
concat_53 = Concatenate(
    FragmentR="X ",
    FragmentQ=concat_48,
    FragmentO="OUTLINE LENGTH ",
    FragmentP=concat_48,
    FragmentA="CROSS SECTION AREA OF SHELL PLATING ",
    FragmentF=concat_49,
    FragmentC="CENTROID_X",
    FragmentD=concat_48,
    FragmentE="CENTROID_Y",
    FragmentB=concat_48,
    FragmentG="CENTROID_Z",
    FragmentH=concat_48,
    FragmentI="INERTIA_X",
    FragmentJ=concat_50,
    FragmentK="INERTIA_Y",
    FragmentL=concat_50,
    FragmentM="INERTIA_Z",
    FragmentN=concat_50,
    FragmentS="Z_Keel",
    FragmentT=concat_48,
    FragmentU="Z_DECK",
    FragmentV=concat_48)
rep_23 = ReplaceText(Text=concat_51, Find="{", RecursiveReplace=False)
rep_24 = ReplaceText(Text=rep_23, Find="}", RecursiveReplace=False)
buoyant_cross_section_areas = Panel([concat_52, concat_53, rep_24])

# ---- group: Export of Curves of cross sectional areas
eval_119 = Evaluate(F="round(x/(y^2),z)", x=addition_7, y=output_dimension, z=nr_of_digits_output)
eval_120 = Evaluate(F="round(x/(y^1),z)", x=pt2num_68, y=output_dimension, z=nr_of_digits_output)
eval_121 = Evaluate(F="round(x/(y^1),z)", x=pt2num_74, y=output_dimension, z=nr_of_digits_output)
eval_122 = Evaluate(F="round(x/(y^2),z)", x=addition_10, y=output_dimension, z=nr_of_digits_output)
eval_123 = Evaluate(F="round(x/(y^1),z)", x=pt2num_66, y=output_dimension, z=nr_of_digits_output)
eval_124 = Evaluate(F="round(x/(y^2),z)", x=addition_9, y=output_dimension, z=nr_of_digits_output)
eval_125 = Evaluate(F="round(x/(y^2),z)", x=addition_8, y=output_dimension, z=nr_of_digits_output)
eval_126 = Evaluate(F="round(x/(y^1),z)", x=pt2num_71, y=output_dimension, z=nr_of_digits_output)
eval_127 = Evaluate(F="\"x_in_\"&dim&\", crossarea_in_\"&dim&\"2\"", dim=eval_3)
eval_128 = Evaluate(F="round(x/(y^2),z)", x=addition_11, y=output_dimension, z=nr_of_digits_output)
eval_129 = Evaluate(F="round(x/(y^1),z)", x=pt2num_67, y=output_dimension, z=nr_of_digits_output)
nullrep_32 = ReplaceNulls(Items=eval_119, Replacements=0)  # -> Items, Count
nullrep_33 = ReplaceNulls(Items=eval_120, Replacements=0)  # -> Items, Count
nullrep_34 = ReplaceNulls(Items=eval_121, Replacements=0)  # -> Items, Count
nullrep_35 = ReplaceNulls(Items=eval_124, Replacements=0)  # -> Items, Count
nullrep_36 = ReplaceNulls(Items=eval_126, Replacements=0)  # -> Items, Count
nullrep_37 = ReplaceNulls(Items=eval_125, Replacements=0)  # -> Items, Count
case_14 = TextCase(Text="Buoyant Cross Section Areas", Culture=127)  # -> UpperCase, LowerCase
case_15 = TextCase(Text="Tank 1 Filling Cross Section Areas", Culture=127)  # -> UpperCase, LowerCase
case_16 = TextCase(Text="Total Cross Section Areas", Culture=127)  # -> UpperCase, LowerCase
case_17 = TextCase(Text="Tank 2 Filling Cross Section Areas", Culture=127)  # -> UpperCase, LowerCase
case_18 = TextCase(Text="Tank 3 Filling Cross Section Areas", Culture=127)  # -> UpperCase, LowerCase
concat_54 = Concatenate(FragmentA=nullrep_36.Items, FragmentC=",", FragmentB=nullrep_37.Items)
concat_55 = Concatenate(FragmentA=case_14.UpperCase, FragmentB=concat_group_version_number)
concat_56 = Concatenate(FragmentA=eval_129, FragmentC=",", FragmentB=eval_128)
concat_57 = Concatenate(FragmentA=case_16.UpperCase, FragmentB=concat_group_version_number)
concat_58 = Concatenate(FragmentA=eval_123, FragmentC=",", FragmentB=eval_122)
concat_59 = Concatenate(FragmentA=case_15.UpperCase, FragmentB=concat_group_version_number)
concat_60 = Concatenate(FragmentA=case_17.UpperCase, FragmentB=concat_group_version_number)
concat_61 = Concatenate(FragmentA=nullrep_33.Items, FragmentC=",", FragmentB=nullrep_32.Items)
concat_62 = Concatenate(FragmentA=case_18.UpperCase, FragmentB=concat_group_version_number)
concat_63 = Concatenate(FragmentA=nullrep_34.Items, FragmentC=",", FragmentB=nullrep_35.Items)
tank_1_filling_cross_section_areas = Panel([concat_59, eval_127, concat_54])
tank_2_filling_cross_section_areas = Panel([concat_60, eval_127, concat_61])
tank_3_filling_cross_section_areas = Panel([concat_62, eval_127, concat_63])
total_cross_section_areas = Panel([concat_57, eval_127, concat_58])
buoyant_cross_section_areas_2 = Panel([concat_55, eval_127, concat_56])

# ----
eval_130 = Evaluate(F="round(x/(y^1),z)", x=amoments_3.Centroid, y=output_dimension, z=nr_of_digits_output)
eval_131 = Evaluate(F="round(x/(y^2),z)", x=amoments_3.Area, y=output_dimension, z=nr_of_digits_output)
eval_132 = Evaluate(F="round(x/(y^2),z)", x=area_16.Area, y=output_dimension, z=nr_of_digits_output)
eval_133 = Evaluate(F="round(x/(y^4),z)", x=amoments_3.Inertia, y=output_dimension, z=nr_of_digits_output)
eval_134 = Evaluate(F="round(x/(y^2),z)", x=p_n_c, y=output_dimension, z=nr_of_digits_output)
eval_135 = Evaluate(F="round(x/(y^2),z)", x=item_43, y=output_dimension, z=nr_of_digits_output)
panel_41 = Panel("""Water Plane Area
COF
Inertia WPA around COF
Wetted Shell Area
Wetted Transom Area
Am""")
merge_17 = Merge(
    Data1=flatten(eval_131),
    Data2=flatten(eval_130),
    Data3=flatten(eval_133),
    Data4=flatten(eval_132),
    Data5=flatten(eval_134),
    Data6=flatten(eval_135))  # -> flatten(Result)
nullrep_38 = ReplaceNulls(Items=merge_17, Replacements=0)  # -> Items, Count
panel_42 = Panel("""m2
m
m4
m2
m2
m2""")
rep_25 = ReplaceText(Text=nullrep_38.Items, Find="{", RecursiveReplace=False)
case_19 = TextCase(Text="Data of underwater areas (moulded)", Culture=127)  # -> UpperCase, LowerCase
rep_26 = ReplaceText(Text=panel_42, Find="m", Replace=eval_3, RecursiveReplace=False)
rep_27 = ReplaceText(Text=rep_25, Find="}", RecursiveReplace=False)
concat_64 = Concatenate(FragmentB=panel_41, FragmentA=" [", FragmentC=rep_26, FragmentD="], ")
concat_65 = Concatenate(FragmentA=concat_64, FragmentB=rep_27)
data_waterplane = Panel([case_19.UpperCase, concat_65])

concat_66 = Concatenate(FragmentA=panel_41, FragmentE=" ", FragmentB=rep_27, FragmentC=" ", FragmentD=rep_26)
data_waterplane_2 = Panel([case_19.UpperCase, "(Waterplane=blue, shell=white, transom=red)", concat_66])

# ---- group: Curve of Inertia around centroid of the shell plating
pdecon_36 = Deconstruct(Point=p_n_c_12)  # -> XComponent, YComponent, ZComponent
scaling = Slider(3.471, range=1..10)
T_7 = Text("Inertia around centroid of the shell plating")
swatch_3 = ColourSwatch(SwatchColor=RGB(0, 255, 81))

# ---- group: Z-Centroid of the shell plating
pdecon_37 = Deconstruct(Point=p_n_c_10)  # -> XComponent, YComponent, ZComponent
swatch_4 = ColourSwatch(SwatchColor=RGB(255, 0, 153))
T_8 = Text("Z-Centroid of the shell plating")

# ---- group: Curve of cross section areas of shell plating
division_38 = Division(A=scale_kvs, B=1)
sqr = Square(Value=division_38)
division_39 = Division(A=p_n_c_11, B=sqr)
T_9 = Text("Cross section areas of shell plating")
swatch_5 = ColourSwatch(SwatchColor=RGB(255, 136, 0))

# ----
# Curve of Shell Inertia around centroud
multiplication_22 = Multiplication(A=scale_kvs, B=scaling)
sift_93 = SiftPattern(List=sift_75.Output1, SiftPattern=toggle_data_wrt_global_strength)  # -> Output0, Output1

# ---- group: Curve of Inertia around centroid of the shell plating (continued)
sqr_2 = Square(Value=multiplication_22)
division_40 = Division(A=pdecon_36.ZComponent, B=sqr_2)
pt_32 = PointOriented(FramePoints=sift_93.Output1, UComponent=0, VComponent=0, WComponent=0)
pt2num_84 = PointsToNumbers(Points=pt_32, Mask=1)
pt_33 = ConstructPoint(XCoordinate=pt2num_84, YCoordinate=0, ZCoordinate=0)
line_17 = LineSDL(Start=pt_33, Direction=Vector(0, 0, -1), Length=flatten(division_40))
end_25 = EndPoints(Curve=line_17)  # -> Start, flatten(End)
intcrv_9 = Interpolate(Vertices=end_25.End, Degree=3, Periodic=False, KnotStyle=1)  # -> Curve, Length, Domain
end_26 = EndPoints(Curve=intcrv_9.Curve)  # -> Start, End
midpt_9 = CurveMiddle(Curve=intcrv_9.Curve)
pt2num_85 = PointsToNumbers(Points=end_26.Start, Mask=1)
pt2num_86 = PointsToNumbers(Points=end_26.End, Mask=1)
num2pt_27 = NumbersToPoints(Numbers=pt2num_85, Mask=1)
num2pt_28 = NumbersToPoints(Numbers=pt2num_86, Mask=1)
xz_11 = XZPlane(Origin=midpt_9)
ln_17 = Line(StartPoint=num2pt_27, EndPoint=num2pt_28)
join_14 = JoinCurves(Curves=[intcrv_9.Curve, ln_17], Preserve=False)
tag_6 = TextTag3D(Location=xz_11, Text=T_7, Size=eval_4, Colour=swatch_3, Justification=2)
preview_37 = CustomPreview(Geometry=[join_14, line_17], Shader=swatch_3)

# ---- group: Z-Centroid of the shell plating (continued)
pt_34 = PointOriented(FramePoints=sift_93.Output1, UComponent=0, VComponent=0, WComponent=0)
pt2num_87 = PointsToNumbers(Points=pt_34, Mask=1)
pt_35 = ConstructPoint(XCoordinate=pt2num_87, YCoordinate=0, ZCoordinate=0)
line_18 = LineSDL(Start=pt_35, Direction=Vector(0, 0, 1), Length=flatten(pdecon_37.ZComponent))
end_27 = EndPoints(Curve=line_18)  # -> Start, flatten(End)
intcrv_10 = Interpolate(Vertices=end_27.End, Degree=3, Periodic=False, KnotStyle=1)  # -> Curve, Length, Domain
end_28 = EndPoints(Curve=intcrv_10.Curve)  # -> Start, End
midpt_10 = CurveMiddle(Curve=intcrv_10.Curve)
pt2num_88 = PointsToNumbers(Points=end_28.Start, Mask=1)
pt2num_89 = PointsToNumbers(Points=end_28.End, Mask=1)
num2pt_29 = NumbersToPoints(Numbers=pt2num_88, Mask=1)
num2pt_30 = NumbersToPoints(Numbers=pt2num_89, Mask=1)
xz_12 = XZPlane(Origin=midpt_10)
ln_18 = Line(StartPoint=num2pt_29, EndPoint=num2pt_30)
join_15 = JoinCurves(Curves=[intcrv_10.Curve, ln_18], Preserve=False)
preview_38 = CustomPreview(Geometry=join_15, Shader=swatch_4)
tag_7 = TextTag3D(Location=xz_12, Text=T_8, Size=eval_4, Colour=swatch_4, Justification=8)

# ---- group: Curve of cross section areas of shell plating (continued)
pt_36 = PointOriented(FramePoints=sift_93.Output1, UComponent=0, VComponent=0, WComponent=0)
pt2num_90 = PointsToNumbers(Points=pt_36, Mask=1)
pt_37 = ConstructPoint(XCoordinate=pt2num_90, YCoordinate=0, ZCoordinate=0)
line_19 = LineSDL(Start=pt_37, Direction=Vector(0, 0, -1), Length=flatten(division_39))
end_29 = EndPoints(Curve=line_19)  # -> Start, flatten(End)
intcrv_11 = Interpolate(Vertices=end_29.End, Degree=3, Periodic=False, KnotStyle=1)  # -> Curve, Length, Domain
end_30 = EndPoints(Curve=intcrv_11.Curve)  # -> Start, End
pt2num_91 = PointsToNumbers(Points=end_30.Start, Mask=1)
pt2num_92 = PointsToNumbers(Points=end_30.End, Mask=1)
num2pt_31 = NumbersToPoints(Numbers=pt2num_91, Mask=1)
num2pt_32 = NumbersToPoints(Numbers=pt2num_92, Mask=1)
ln_19 = Line(StartPoint=num2pt_31, EndPoint=num2pt_32)
join_16 = JoinCurves(Curves=[intcrv_11.Curve, ln_19], Preserve=False)
preview_39 = CustomPreview(Geometry=join_16, Shader=swatch_5)

# ----
midpt_11 = CurveMiddle(Curve=intcrv_11.Curve)

# ---- group: Curve of cross section areas of shell plating (continued)
xz_13 = XZPlane(Origin=midpt_11)
tag_8 = TextTag3D(Location=xz_13, Text=T_9, Size=eval_4, Colour=swatch_5, Justification=2)

# ----
# Holtrop & Mennen resistance prediction
panel_43 = Panel("""1. 
2. 
3. 
4. 
5. 
6. 
7. 
8. 
9. 
10. 
11. 
12. """)
panel_44 = Panel("""Lwl
B
T_loading
Displ_m
Am
Awp
COB
S
IE
At
Ta
Tf""")
division_41 = Division(A=pdecon_21.XComponent, B=1000)
displ_moulded = Number(volume_2.Volume)
tf = Number(eval_28)
doa = Number(eval_6)
at = Number(p_n_c)
ta = Number(eval_27)
lwl = Number(dist)
ie = Number(eval_35)
t_loading = Number(eval_18)
awp = Number(amoments_3.Area)
S = Number(area_16.Area)
am = Number(item_43)
cob = Data(division_41)
B = Number(eval_19)
merge_18 = Merge(
    Data1=flatten(lwl),
    Data2=flatten(B),
    Data3=flatten(t_loading),
    Data4=flatten(displ_moulded),
    Data5=flatten(am),
    Data6=flatten(awp),
    Data7=flatten(cob),
    Data8=flatten(S),
    Data9=flatten(ie),
    Data10=flatten(at),
    Data11=flatten(ta),
    Data12=flatten(tf))  # -> flatten(Result)
subtraction_30 = Subtraction(A=doa, B=ta)
larger_10 = LargerThan(FirstNumber=ta, SecondNumber=doa)  # -> LargerThan, OrEqualTo
subtraction_31 = Subtraction(A=doa, B=tf)
larger_11 = LargerThan(FirstNumber=tf, SecondNumber=doa)  # -> LargerThan, OrEqualTo
or = GateOr(A=larger_10.LargerThan, B=larger_11.LargerThan)
min_2 = Minimum(A=subtraction_30, B=subtraction_31)
and_10 = GateAnd(A=toggle_holtrop_mennen_prediction, B=toggle_volume_related_output)
filter_11 = StreamFilter(Gate=manual_input, Stream0=merge_18, Stream1=merge)
eval_136 = Evaluate(F="IF(x=TRUE,\"Deck is submerged\",\"Deck is \"&round(y,2)&\" mm from WL\")", x=or, y=min_2)
sift_94 = SiftPattern(List=filter_11, SiftPattern=and_10)  # -> Output0, Output1
panel_45 = Panel(eval_136)
nullrep_39 = ReplaceNulls(Items=sift_94.Output1, Replacements=0)  # -> Items, Count
panel_46 = Panel(nullrep_39.Count)
concat_67 = Concatenate(FragmentE="D", FragmentD=panel_43, FragmentA=panel_44, FragmentC=",", FragmentF=" ", FragmentB=nullrep_39.Items)
controle_invoer_waarden = Panel(concat_67)
eval_137 = Evaluate(F="(x-6)/(1/z)", x=design_speed_kn, z=steps_per_knot_kn)
panel_47 = Panel("RESISTANCE ESTIMATION BY METHOD HOLTROP & MENNEN 1982 & 1984")
panel_48 = Panel("V [kn], V [m/s], Fn,  Rtot [N], R_visc [N], R_app [N], R_w [N], R_TR [N], R_b [N], R_A [N], R_BTO [N], w[-], t[-]")

# ----
# Geschreven op basis van informatie uit de volgende papers:
# Holtrop, J. , & Mennen, G. G. J. (1978). A statistical power prediction method. International Shipbuilding Progress, 25(290). Geraadpleegd van http://resolver.tudelft.nl/uuid:62c40df8-18cc-4225-a65a-54ff5c1609fb
# Holtrop, J., & Mennen, G. G. J. (1982). An approximate power prediction method. International Shipbuilding Progress, ISP, 29(335). Geraadpleegd van http://resolver.tudelft.nl/uuid:ee370fed-4b4f-4a70-af77-e14c3e692fd4
python_h_m_mt1458 = GhPythonScript(
    manual=manual_input,
    V_max_kn=addition,
    dt=steps_per_knot_kn,
    S_Selectie=eval_2,
    Datastream_in=nullrep_39.Items,
    C_Stern=afterbody_form_coefficient_cstern,
    k2=python.k2,
    S_app=python.S_app,
    COB=cob,
    bulb_toggle=bulb,
    A_BT=transverse_oppervlak_bulb_m2,
    h_b=hoogteligging_van_zwaartepunt_transverse,
    boegschroef_toggle=bow_thruster,
    n_boegschroef=nr_of_bow_thrusters,
    C_BTO=resistance_coefficient_bow_thruster,
    d_boegschroef=diameter_bow_thruster_tunnel_m,
    prop_D=diameter_prop_m,
    n_prop=nr_of_props,
    A_T=at,
    i_e_selectie=eval,
    deck_check=panel_45)  # -> out, Waarschuwing_paneel, Uitvoer_check, i_e_HMT1984, i_e_HMT1978, S_HMT_benadering, HMT_coefficienten; inputs Datastream_in: list
# ---------- python_h_m_mt1458: Python ----------
__author__ = "Jelle Woudstra"
__version__ = "2020.03.25"

import rhinoscriptsyntax as rs
import math
import sys

if manual==False:
    #Importeren van data
    Lwl=Datastream_in[0]/10**3      #Lengte waterlijn
    B=Datastream_in[1]/10**3         #Breedte op waterlijn
    T_a=Datastream_in[10]/10**3     #Diepgang achter
    T_f=Datastream_in[11]/10**3     #Diepgang voor
    T=(T_a+T_f)/2           #Diepgang op 1/2 Lpp
    Displ=Datastream_in[3]/10**9  #Totale waterverplaatsing
    A_m=Datastream_in[4]/10**6    #Oppervlak mainframe
    A_wp=Datastream_in[5]/10**6   #Waterlijn oppervlak
    S=Datastream_in[7]/10**6      #Totaal nat oppervlak romp
    A_t=Datastream_in[9]/10**6    #Transom oppervlak
    A_BT=A_BT/10**6         #Transversaal oppervlak bulb verschalen naar m2
    h_b=h_b                 #Hoogteligging bulb zwaartepunt van mm naar m
    LCB_percentage=100*((COB)-0.5*Lwl)/(Lwl)
    #Berekeningen
    Cm= A_m/(B*T)                #Mainframe coefficient
    Cwp = A_wp/(Lwl*B)          #Waterlijn prismatische coefficient
    Cb= Displ/(Lwl*B*T)         #Blokcoefficient
    Cp=Displ/(A_m*Lwl)          #Prismatische coefficient
    
    
else:
    #Importeren van handmatig ingevoerde data
    Lwl=Datastream_in[0]       #Lengte waterlijn
    B=Datastream_in[1]         #Breedte op waterlijn
    T_a=Datastream_in[2]       #Diepgang achter
    T_f=Datastream_in[3]       #Diepgang voor
    T=(T_a+T_f)/2              #Diepgang op 1/2 Lpp
    Displ=Datastream_in[4]     #Totale waterverplaatsing
    Cm=Datastream_in[5]       #Mainframe coefficient
    A_wp=Datastream_in[6]      #Waterlijn oppervlak
    LCB_percentage=Datastream_in[7] #Lengteligging LCB als % Lwl
    S=Datastream_in[8]         #Totaal nat oppervlak romp
    i_entrance=Datastream_in[9]
    A_t=Datastream_in[10]       #Transom oppervlak
    A_BT=Datastream_in[11]        #Transversaal oppervlak bulb verschalen naar m2
    h_b=Datastream_in[12]
    #Berekeningen
    Cwp = A_wp/(Lwl*B)          #Waterlijn prismatische coefficient
    Cb= Displ/(Lwl*B*T)         #Blokcoefficient
    Cp= Displ/(Lwl*B*T*Cm)      #Prismatische coefficient

#Constanten
g=9.81                       #Zwaartekracht versnelling
rho_zeewater=1025            #Dichtheid van zeewater
water_temp=15                #Temperatuur van water
k_s=150                      #Hull roughness in micrometer
#Kinematische viscositeitscoefficient zeewater bij 15 graden
kin_visc=10**-9*(59046.64-206.7255*(273.14+water_temp)-0.161635*(273.14+water_temp)*rho_zeewater+0.000581097*(273.14+water_temp)**2*rho_zeewater)

S_HMT_benadering=(Lwl*(2*T+B)*math.sqrt(Cm)*(0.453+0.4425*Cb-0.2862*Cm-0.003467*(B/T) + 0.3696*Cwp) +2.38*A_BT/Cb) #Gebruiken voor nat oppervlak benadering volgens HMT

if S_Selectie=="S_wet from Rhino model":
    S=S
elif S_Selectie=="S_Wet HM regressive approach":
    S=S_HMT_benadering

V_max_kn_int=int(V_max_kn)
dt=int(dt)
Waarschuwing_paneel=[]
V_s=[]
V_s_range=[]

#Berekening afbreken check
if (1-Cp-0.0225*LCB_percentage)<0:
    Waarschuwing_paneel.append("Position of LCB too far FWD")
####     sys.exit('Position of LCB too far FWD')
# sys.exit uit gezet om met de IE uit Rhino verder te kunnen rekenen. Zie ook regel 130. Bas Goris 

for V_s_range in range(6,(V_max_kn_int)*dt-(6*(dt-1)-1)):
    V_s_kn= 6+ (V_s_range-6)*(1/dt)
    V_s=(V_s_kn*(1.852/3.6))                                                 #Berekenen snelheid in m/s
    Fn= V_s/math.sqrt(9.81*Lwl)                                                 #Froude getal
    #Viskeuze weerstand
    if V_s ==0:
        Rn=0
        Cf=0
    else:
        Rn=(V_s*Lwl)/kin_visc                                                   #Reynolds getal
        Cf=(0.075)/(((math.log10(Rn))-2)**2)                                    #Weerstandscoefficient
    R_f=0.5*rho_zeewater*Cf*S*(V_s**2)                                          #Wrijvingsweerstand
    
    if T/Lwl<= 0.02:
        c12=0.479948
    elif T/Lwl<= 0.05:
        c12=48.20*(T/Lwl - 0.02)**2.078 + 0.479948
    else:
        c12=(T/Lwl)**0.2228446
    c13= 1+0.003*C_Stern
    L_R=(1-Cp +(0.06*Cp*LCB_percentage)/(4*Cp-1))*Lwl
    
    #Oude benadering k1=-1 + (c13*(0.93 + (c12*(B/L_R)**0.92497)*((0.95-Cp)**-0.521448)*(1-Cp + 0.0225*LCB_percentage)**0.6906))
    k1=-1 + 0.93+0.487118*(1+0.011*C_Stern)*(B/Lwl)**1.06806*(T/Lwl)**0.46106*(Lwl/L_R)**0.121563*(Lwl**3/Displ)**0.36486*(1-Cp)**-0.604247
    #Appendage weerstand voor MT1458 hoeft dit niet
    """
    Voor de berekening van 1+k2 wordt gerefereerd naar tabel 2 op blz 2 van de paper "An Approximate 
    Power Prediction Method" van J. Holtrop en G.G.J Mennen. Om het programma overzichtelijkheid te 
    behouden is ervoor gekozen om te refereren naar de volgorde van de soorten appendages in de lijst.
    Alles met table1 refereert naar de eerste regel in de tabel; 'rudder behind skeg'. Deze methodiek
    is door de rest van de berekening van k2 gebruikt
    """
    R_app= 0.5*rho_zeewater*(V_s**2)*Cf*S_app*(1+k2)
    S_tot=S+S_app
    
    #Weerstand ten gevolge van boegschroef koker
    if boegschroef_toggle==True:
        R_BTO=rho_zeewater*V_s**2*d_boegschroef**2*math.pi*C_BTO*n_boegschroef
    else:
        R_BTO=0
    
    #Golfmakende weerstand
    c3=(0.56*A_BT**1.5)/(B*T*(0.31*math.sqrt(A_BT)+T_f-h_b))
    c2 =math.exp(-1.89*math.sqrt(c3))
    c5=1-0.8*A_t/(B*T*Cm)
    if B/Lwl<0.11:
        c7=0.229577*(B/Lwl)**0.33333
    elif B/Lwl< 0.25:
        c7=B/Lwl
    else:
        c7=0.5-0.0625*(Lwl/B)
    
    if (1-Cp-0.0225*LCB_percentage)>0:   #if functie toegevoegd als LCB te veel afwijkt, waardoor IE niet meer uit de regressie formulrs berekend kan worden. Bas Goris
        i_e_HMT1984=1+89*math.exp(-(Lwl/B)**0.80856*(1-Cwp)**0.30484*(1-Cp-0.0225*LCB_percentage)**0.6367*(L_R/B)**0.34574*(100*Displ/Lwl**3)**0.16302)
        i_e_HMT1978=125.67*B/Lwl - 162.25*Cp**2 + 234.32*Cp**3 + 0.1551*(LCB_percentage + 6.8*(T_a-T_f)/T)**3
    else:
        i_e_selectie== "IE from Rhino model" #else functie als LCB te veel afwijkt, waardoor IE niet meer uit de regressie formulrs berekend kan worden. Bas Goris
    if i_e_selectie== "IE regressive approach 1984":
        i_entrance=i_e_HMT1984 #Benadering voor entreehoek van waterlijn
    if i_e_selectie== "IE regressive approach 1978":
        i_entrance=i_e_HMT1978
    if i_e_selectie== "IE from Rhino model":
        i_entrance=Datastream_in[8]       #Halve entreehoek waterlijn
    if manual==True:
        i_entrance=Datastream_in[9]
    
    
    c1=2223105*(c7**3.78613)*(T/B)**1.07961*(90-i_entrance)**-1.37565
    c17=6919.3*Cm**-1.3346*(Displ/Lwl**3)**2.00977*(Lwl/B-2)**1.40692
    m3=-7.2035*(B/Lwl)**0.326869*(T/B)**0.605375
    d=-0.9
    
    if Lwl/B<12:
        lambda1= 1.446*Cp -0.03*Lwl/B
    else:
        lambda1= 1.446*Cp -0.36
    
    if Cp<0.8:
        c16=8.07981*Cp - 13.8673*Cp**2 + 6.984388*Cp**3
    else:
        c16=1.73014- 0.7067*Cp
    
    if Lwl**3/Displ<512:
        c15=-1.69385
    elif Lwl**3/Displ>512 and Lwl**3/Displ<1727: #Hier is een aanpassing gemaakt
        c15=-1.69385 + (Lwl/(Displ**(1/3))- 8)/2.36
    else:
        c15=0
    m1=0.0140407*(Lwl/T) - (1.75254*Displ**(0.33333))/Lwl -4.79323*B/Lwl -c16
    if Fn==0:
        m2=c15*0.4*(math.exp(-0.034*Fn**-3.29))    #Staat in HMT Excel als m4
    else:
        m2=c15*0.4*(math.exp(-0.034*Fn**-3.29))    #Staat in HMT Excel als m4
    
    if Fn==0:
        R_w=0
    elif Fn<0.4:
        R_w=c1*c2*c5*Displ*rho_zeewater*g*math.exp(m1*Fn**d + m2*math.cos(lambda1*Fn**-2))
    elif 0.4>=Fn<=0.55:
        Rwa=c1*c2*c5*Displ*rho_zeewater*g*math.exp(m1*0.4**d + m2*math.cos(lambda1*0.4**-2))
        Rwb=c1*c2*c5*Displ*rho_zeewater*g*math.exp(m1*0.55**d + m2*math.cos(lambda1*0.55**-2))
        R_w= Rwa+ (10*Fn-4)*(Rwb-Rwa)/1.5
    elif Fn>0.55:
        R_w=c17*c2*c5*Displ*rho_zeewater*g*math.exp(m3*Fn**d + m2*math.cos(lambda1*Fn**-2))
    
    #print(m1)
    
    #Weerstand van bulb
    if bulb_toggle== True:
        Fn_i=V_s/(math.sqrt(g*(T_f-h_b-0.25*math.sqrt(A_BT))+0.15*V_s**2))
        P_b=0.56*math.sqrt(A_BT)/(T_f-1.5*h_b)+0.0000000001
        R_b=(0.11*(math.exp((-3*P_b**-2)))*(Fn_i**3)*(A_BT**1.5)*rho_zeewater*g)/(1+Fn_i**2)
    else:
        R_b=0
    
    #Weerstand van transom area
    if A_t==0:
        R_TR=0
    else:
        Fn_t=V_s/(math.sqrt((2*g*A_t)/(B+B*Cwp)))
        if Fn_t<5:
            c6=0.2*(1-0.2*Fn_t)
        else:
            c6=0
        R_TR= 0.5*rho_zeewater*V_s**2*A_t*c6
    
    #Model-ship correlation resistance: Air resistance
    if T_f/Lwl<=0.04:
        c4=T_f/Lwl
    else:
        c4=0.04
    delta_C_A=(0.105*(k_s/1000000)**0.33333-0.005579)/Lwl**0.33333 #roughness allowance
    C_A=0.006*(Lwl+100)**-0.16 -0.00205 + 0.003*math.sqrt(Lwl/7.5)*Cb**4*c2*(0.04-c4)+delta_C_A
    R_A=0.5*rho_zeewater*V_s**2*S*C_A
    
    #Wake en thrust deduction bepalen
    if n_prop==1: #Formules voor enkel schroef schip
        #Wake factor
        if B/T_a < 5:
            c8=(B*S)/(Lwl*prop_D*T_a)
        elif B/T_a >5:
            c8=S*(7*B/T_a - 25)/(Lwl*prop_D*(B/T_a-3))
        
        if c8<28:
            c9=c8
        elif c8>28:
            c9=32- 16/(c8-24)
        
        if T_a/prop_D<2:
           c11=T_a/prop_D
        elif T_a/prop_D>2:
           c11= 0.083333333*(T_a/prop_D)**3 + 1.3333
        
        if Cp<0.7:
            c19= 0.12997/(0.95-Cb)-0.11056/(0.95-Cp)
        elif Cp>0.7:
            c19=0.18567/(1.3571-Cm) - 0.71276 +0.38648*Cp
        
        c20= 1+0.015*C_Stern
        Cp1=1.45*Cp -0.315 -0.0225*LCB_percentage
        k=(1+k1)+(1+k2-(1+k1))*S_app/S_tot -1
        Cv=(1+k)*Cf +C_A
        if (B/(Lwl*(1-Cp1))) > 0:
           w= c9*c20*Cv*(Lwl/T_a)*(0.050776 + 0.93405*c11*(Cv/(1-Cp1))) + 0.27915*c20*math.sqrt(B/(Lwl*(1-Cp1)))+c19*c20
        else:
           w = 9999
        
        #Thrust Deduction
        if (0.25014*(B/Lwl)**0.28956*(math.sqrt(B*T)/prop_D)**0.2624)/(1-Cp+0.0225*LCB_percentage) > 0:
           t= (0.25014*(B/Lwl)**0.28956*(math.sqrt(B*T)/prop_D)**0.2624)/(1-Cp+0.0225*LCB_percentage)**0.01762+0.0015*C_Stern
        else: 
           t=9999
    else: 
        #Formules voor meerdere schroeven op schip
        w=0.3095*Cb+10*Cv*Cb - 0.23*prop_D/(math.sqrt(B*T))
        t=0.325*Cb-0.1885*prop_D/(math.sqrt(B*T))
    
    #Totale Weerstand berekenen
    if Fn==0:
        R_total=0
    else:
        R_total=R_f*(1+k1)+ R_w + R_app +R_BTO +R_TR + R_b + R_A 
    if dt==1 or dt==2:
        print(V_s_kn, V_s, Fn, R_total, (R_f*(1+k1)), R_app, R_w, R_TR, R_b, R_A, R_BTO, w, t  )
    else:
        print(V_s_kn, V_s, Fn, R_total, (R_f*(1+k1)), R_app, R_w, R_TR, R_b, R_A, R_BTO, w, t  )
    #    print("%.1f" %V_s_kn,"%.3f" %V_s ,"%.3f" %Fn,"%.0f" %R_total,"%.0f" %(R_f*(1+k1)),"%.0f" %R_app,"%.0f" %R_w,"%.0f" %R_TR,"%.2f" %R_b,"%.2f" %R_A,"%.0f" %R_BTO, "%.4f" %w , "%.4f" %t)
    #else:
    #    print("%.3f" %V_s_kn,"%.3f" %V_s ,"%.3f" %Fn,"%.0f" %R_total,"%.0f" %(R_f*(1+k1)),"%.0f" %R_app,"%.0f" %R_w,"%.0f" %R_TR,"%.2f" %R_b,"%.2f" %R_A,"%.0f" %R_BTO, "%.4f" %w, "%.4f" %t  )

#Check of invoerwaarden voldoen aan beperkingen van het model
if 0.01<= lambda1 <= 1.07:
    pass
else:
    Waarschuwing_paneel.append("Ship does not adhere to 0.01< lambda <1.07 requirement")
if 0.55<= Cp <= 0.85:
    pass
else:
    Waarschuwing_paneel.append("Ship does not adhere to 0.55< Cp < 0.85 requirement")
if 0<= h_b <= 0.6*T_f:
    pass
else:
    Waarschuwing_paneel.append("Ship does not adhere to bulb surface area limitation between 0 and 0.6 of T_f")
if 1<= i_entrance <=90:
    pass
else:
    Waarschuwing_paneel.append("Ship does not adhere to Half waterline entrance angle limitation between 1 and 90 deg")
if -5<= LCB_percentage <=5:
    pass
else:
    Waarschuwing_paneel.append("Ship does not adhere to LCB between -5% and +5% of 0.5Lwl")
if 3.9<= (Lwl/B) <=14.9:
    pass
else:
    Waarschuwing_paneel.append("Ship does not adhere to Lwl/B ratio limitation between 3.9 and 14.9")
if 2.1<= B/T <=4:
    pass
else:
    Waarschuwing_paneel.append("Ship does not adhere to B/T ratio limitation between 2.1 and 4")
if deck_check=="Deck is submerged":
    Waarschuwing_paneel.append("Deck is submerged, aprroach not valid")
else:
    pass
if n_prop>2:
    Waarschuwing_paneel.append("Twin screw regressive approach used to estimate wake and thrust deduction factor, may not be accurate")
else:
    pass
if w == 9999:
    Waarschuwing_paneel.append("Wake factor is outside range and can not be calculated. Wake set to 9999")
else:
    pass
if t == 9999:
    Waarschuwing_paneel.append("Thrust deduction is outside range and can not be calculated. Thrust set to 9999")
else:
    pass
if Waarschuwing_paneel:
    pass
else:
    Waarschuwing_paneel.append("No Warnings")

#Geselecteerde instellingen
Uitvoer_check=[]
Uitvoer_check.append("Selected step size (dt), %.2f" %(1/dt))
if S_Selectie== "S_wet from Rhino model":
    Uitvoer_check.append("Wetted surface area measured from Rhino model")
if S_Selectie== "S_Wet HM regressive approach":
    Uitvoer_check.append("Wetted surface area calculated with HM approximation")
if i_e_selectie== "IE regressive approach 1984":
    Uitvoer_check.append("Half waterline entrance angle calculated using HMT 1984 method")
if i_e_selectie== "IE regressive approach 1978":
    Uitvoer_check.append("Half waterline entrance angle calculated using HMT 1978 method")
if i_e_selectie== "IE from Rhino model":
    Uitvoer_check.append("Half waterline entrance angle measured from Rhino model")
Uitvoer_check.append("Wake and thrust deduction factor calculated using HMT 1984 method")
Uitvoer_check.append("Number of propellers, %r" %n_prop)
Uitvoer_check.append("Propeller diameter, %r" %prop_D)
Uitvoer_check.append("Chosen stern coefficient, %r" %C_Stern)
if bulb_toggle==True:
    Uitvoer_check.append("Bulb:")
    Uitvoer_check.append("Transverse area:%.3f" %A_BT)
    Uitvoer_check.append("Height bulb:%.3f" %h_b)
else:
    Uitvoer_check.append("No bulb")
if boegschroef_toggle==True:
    if n_boegschroef==1:
        Uitvoer_check.append("Nr of bow or stern thrusters: 1")
    else:
        Uitvoer_check.append("Nr of bowstern thrusters: %r" %n_boegschroef)
    Uitvoer_check.append("Resistance coefficient bow/stern thrusters:%r" %C_BTO)
    Uitvoer_check.append("Diameter bow/stern thrusters:%r" %d_boegschroef)
else:
    Uitvoer_check.append("No bow/stern thrusters")
"""
#Coefficienten uitvoer
HMT_coefficienten=[]
HMT_coefficienten.append(Lwl: %r"" %Lwl)"
HMT_coefficienten.append("B: %r" %B)
HMT_coefficienten.append("Tapp: %r" %T_a)
HMT_coefficienten.append("Tfpp: %r" %T_f)
HMT_coefficienten.append("Displacement: %r" %Displ)
HMT_coefficienten.append("Cm: %r" %Cm)
HMT_coefficienten.append("Awp: %r" %A_wp)
HMT_coefficienten.append("Cwp: %r" %Cwp)
HMT_coefficienten.append("LCB percentage: %r" %LCB_percentage)
HMT_coefficienten.append("S: %r" %S)
HMT_coefficienten.append("i Entrance: %r" %i_entrance)
HMT_coefficienten.append("A BT: %r" %A_BT)
HMT_coefficienten.append("hb: %r" %h_b)
HMT_coefficienten.append("A transom: %r" %A_t)
HMT_coefficienten.append("C stern: %r" %C_Stern)
HMT_coefficienten.append("Sapp: %r" %S_app)
HMT_coefficienten.append("1+k2: %r" %(1+k2))
HMT_coefficienten.append("Bowthruster diameter: %r" %d_boegschroef)
HMT_coefficienten.append("C BTO: %r" %C_BTO)
HMT_coefficienten.append("Prop D: %r" %prop_D)
HMT_coefficienten.append("Cb: %r" %Cb)
HMT_coefficienten.append("Cp: %r" %Cp)
HMT_coefficienten.append("Cp1: %r" %Cwp)
HMT_coefficienten.append("Lr: %r" %L_R)
HMT_coefficienten.append("1+k1: %r" %(1+k1))
HMT_coefficienten.append("1+k: %r" %(1+k))
HMT_coefficienten.append("S total: %r" %S_tot)
#HMT_coefficienten.append("PB: %r" %P_b)
HMT_coefficienten.append("C A: %r" %C_A)
HMT_coefficienten.append("lambda: %r" %lambda1)
HMT_coefficienten.append("c1: %r" %c1)
HMT_coefficienten.append("c2: %r" %c2)
HMT_coefficienten.append("c3: %r" %c3)
HMT_coefficienten.append("c4: %r" %c4)
HMT_coefficienten.append("c5: %r" %c5)
HMT_coefficienten.append("c7: %r" %c7)
HMT_coefficienten.append("c8: %r" %c8)
HMT_coefficienten.append("c9: %r" %c9)
HMT_coefficienten.append("c11: %r" %c11)
HMT_coefficienten.append("c15: %r" %c15)
HMT_coefficienten.append("c16: %r" %c16)
HMT_coefficienten.append("c17: %r" %c17)
HMT_coefficienten.append("c19: %r" %c19)
HMT_coefficienten.append("c20: %r" %c20)
HMT_coefficienten.append("m1: %r" %m1)
HMT_coefficienten.append("m3: %r" %m3)
"""
# ---------- end python_h_m_mt1458 ----------

expression_2 = Expression(x=S, Expression="Format(\"{0}\", Round(x/1000000,2))")
expression_3 = Expression(x=python_h_m_mt1458.i_e_HMT1984, Expression="Format(\"{0}\", Round(x,2))")
expression_4 = Expression(x=python_h_m_mt1458.i_e_HMT1978, Expression="Format(\"{0}\", Round(x,2))")
expression_5 = Expression(x=python_h_m_mt1458.S_HMT_benadering, Expression="Format(\"{0}\", Round(x,2))")

# ---- group: IE compare
round_8 = Round(Number=expr("x*100", ie))  # -> Nearest, Floor, Ceiling
nullrep_40 = ReplaceNulls(Items=ie, Replacements=0)  # -> Items, Count
txt_2 = Text("Holtrop78")
division_42 = Division(A=round_8.Nearest, B=100)
txt_3 = Text("Holtrop84")
eval_138 = Evaluate(
    F="Format(\"WARNING ENTRANCE ANGLE: The percentage of the IE by the Rhino model compared to the IE from the regressive approach of HM84 is , {0:0}\"&\"%\" ,IE_model/IE_HM84*100)",
    IE_model=nullrep_40.Items,
    IE_HM84=python_h_m_mt1458.i_e_HMT1984,
    IE_HM78=python_h_m_mt1458.i_e_HMT1978,
    x=method_selection_half_entrance_angle_ie,
    text1=txt_2,
    text2=txt_3)  # -> flatten(r)
concat_68 = Concatenate(FragmentA="IE by Rhino model = ,", FragmentB=division_42)

# ---- group: S compare
nullrep_41 = ReplaceNulls(Items=S, Replacements=0)  # -> Items, Count
eval_139 = Evaluate(
    F="Format(\"WARNING WETTED AREA: The percentage of S_wet by the Rhino model compared to the S_wet by regressive approach from Holtrop84 is , {0:0}\"&\"%\",Swet_model/1000000/S_HMT*100)",
    Swet_model=nullrep_41.Items,
    S_HMT=python_h_m_mt1458.S_HMT_benadering,
    x=method_selection_wet_shell_area,
    text2=txt_3)
concat_69 = Concatenate(FragmentA="Swet by Rhino model = ,", FragmentB=expression_2)

# ----
concat_70 = Concatenate(FragmentC="IE by regression HM84 = ,", FragmentD=expression_3)
concat_71 = Concatenate(FragmentE="IE by regression HM78 = ,", FragmentF=expression_4)
concat_72 = Concatenate(FragmentC="Swet by regression HM84 = ,", FragmentD=expression_5)

ie_hmt_1984 = Panel(python_h_m_mt1458.i_e_HMT1984)
ie_hmt1978 = Panel(python_h_m_mt1458.i_e_HMT1978)
s_hmt_approach = Panel(python_h_m_mt1458.S_HMT_benadering)
rep_28 = ReplaceText(Text=python_h_m_mt1458.out, Find="(", RecursiveReplace=False)
rep_29 = ReplaceText(Text=rep_28, Find=")", RecursiveReplace=False)
case_20 = TextCase(Text=python_h_m_mt1458.Waarschuwing_paneel, Culture=127)  # -> UpperCase, LowerCase
rep_30 = ReplaceText(Text=rep_29, Find="'", RecursiveReplace=False)
item_44 = ListItem(List=rep_30, Index=eval_137, Wrap=False)
split_14 = TextSplit(Text=item_44, Separators=",")
designspeed_v_kn_v_m_s_fn_rtot_n_r_visc = Panel(item_44)  # "DESIGNSPEED V [kn], V [m/s], Fn, Rtot [N], R_visc [N], R_app [N], R_w [N], R_TR [N], R_b [N], R_A [N], R_BTO [N]"
v_kn_v_m_s_fn_rtot_n_r_visc_n_r_app_n_r = Panel(rep_30)  # "V [kn], V [m/s], Fn, Rtot [N], R_visc [N], R_app [N], R_w [N], R_TR [N], R_b [N], R_A [N], R_BTO [N], w [-], t [-]"
designspeed_v_kn_v_m_s_fn_rtot_n_r_visc_2 = Panel(split_14)  # "DESIGNSPEED V [kn], V [m/s], Fn, Rtot [N], R_visc [N], R_app [N], R_w [N], R_TR [N], R_b [N], R_A [N], R_BTO [N]"
merge_19 = Merge(
    Data1=flatten("WARNINGS:"),
    Data2=flatten(case_20.UpperCase),
    Data3=flatten(eval_138),
    Data4=flatten(eval_139),
    Data5=flatten("INTERMEDIATE VALUES:"),
    Data6=flatten(concat_68),
    Data7=flatten(concat_70),
    Data8=flatten(concat_71),
    Data9=flatten(concat_69),
    Data10=flatten(concat_72),
    Data11=flatten("SETTINGS:"),
    Data12=flatten(eval_136),
    Data13=flatten(python_h_m_mt1458.Uitvoer_check))
python_2 = GhPythonScript(HMT_toggle=toggle_holtrop_mennen_prediction, Calculation_warning=merge_19, Manual_input=manual_input)  # -> flatten(out), Message_panel; inputs Calculation_warning: list
# ---------- python_2: Python ----------
__author__ = "jlwou"
__version__ = "2021.02.15"

import rhinoscriptsyntax as rs
import math
import sys

Message_panel=[]

if HMT_toggle==False and Manual_input==False:
    print("H&M calculation is turned OFF")
    pass
if HMT_toggle==True and Manual_input==False:
    for k in range(len(Calculation_warning)):
        print(Calculation_warning[k])
    pass
if Manual_input==True:
    print("H&M calculation using manual input")
    for k in range(len(Calculation_warning)):
        print(Calculation_warning[k])
    pass
# ---------- end python_2 ----------
item_45 = ListItem(List=designspeed_v_kn_v_m_s_fn_rtot_n_r_visc_2, Index=0, Wrap=True)  # -> Item, Item1, Item2, Item3
rtot_kn = Number(expr("x/1000", item_45.Item3))
v_kn = Number(item_45.Item)
v_mps = Number(item_45.Item1)
fn = Number(item_45.Item2)
panel_49 = Panel(python_2.out)
panel_50 = Panel(python_h_m_mt1458.HMT_coefficienten)
eval_140 = Evaluate(F="Format(\"Rtot {0:0.00} kN at v of {1:0.0} kn\", R,v)", v=v_kn, R=rtot_kn)
panel_51 = Panel(eval_140)
merge_20 = Merge(
    Data1=flatten(panel_47),
    Data2=flatten("DESIGN SPEED DATA"),
    Data3=flatten(panel_48),
    Data4=flatten(designspeed_v_kn_v_m_s_fn_rtot_n_r_visc),
    Data5=flatten("RESISTANCE TABLE BY METHOD HOLTROP & MENNEN 1982 & 1984"),
    Data7=flatten(panel_48),
    Data8=flatten(v_kn_v_m_s_fn_rtot_n_r_visc_n_r_app_n_r),
    Data9=flatten("NOTES & WARNINGS H&M CALCULATION"),
    Data10=flatten(panel_49),
    Data11=flatten(concat_group_version_number))

panel_52 = Panel(python_h_m_mt1458.Uitvoer_check)

# ---- group: shows IE by regressive approach by HM
eval_141 = Evaluate(F="if(x=2,\"{0:0.00}° by HM78\",\"{0:0.00}° by HM84\")", x=method_selection_half_entrance_angle_ie)
eval_142 = Evaluate(F="if(x=2,y,z)", x=method_selection_half_entrance_angle_ie, y=ie_hmt1978, z=ie_hmt_1984)
rad_4 = Radians(Degrees=eval_142)
xy_11 = XYPlane(Origin=eval_34.Point)
rotate_12 = Rotate(Geometry=line_6, Angle=rad_4, Plane=xy_11)  # -> Geometry, Transform
midpt_12 = CurveMiddle(Curve=rotate_12.Geometry)
angledim_2 = AngularDimension(Center=eval_34.Point, PointA=end_11.End, PointB=midpt_12, Reflex=False, Text=eval_141, Size=expr("x/1.5", eval_4))

# ---- group: Add values in the resistence graph
split_15 = TextSplit(Text=designspeed_v_kn_v_m_s_fn_rtot_n_r_visc, Separators=",")
z_move_of_values = Slider(2000, range=0..2000)
kd = Diffuse(graft([RGB(0, 0, 0), RGB(0, 128, 128), RGB(255, 128, 0), RGB(255, 0, 0), RGB(192, 192, 0), RGB(0, 128, 0), RGB(0, 0, 255), RGB(0, 0, 192), RGB(192, 0, 192), RGB(192, 192, 192)]))
material = CreateMaterial(Diffuse=kd, Specular=RGB(255, 255, 255), Emission=RGB(0, 0, 0), Transparency=0, Shine=0)
Z_9 = UnitZ(Factor=z_move_of_values)

# ---- group: Creates a resistence graph in Rhino scaled to Lpp and 2H
split_16 = TextSplit(Text=panel_48, Separators=",")
split_17 = TextSplit(Text=rep_30, Separators=",")
x_unit_for_resistance_graph = Slider(0, range=0..2)
eval_143 = Evaluate(F="if(x=0,\"V [knots]\",If(x=1,\"V [m/s]\",\"Froude number [-]\"))", x=x_unit_for_resistance_graph)
panel_53 = Panel(eval_143)
scale_graph_hoa = Slider(2.5, range=1..10)
move_graph_hoa = Slider(1.3, range=1..5)
hoa = Integer(eval_17)
multiplication_23 = Multiplication(A=move_graph_hoa, B=hoa)
Z_10 = UnitZ(Factor=multiplication_23)
kd_2 = Diffuse(graft([RGB(0, 0, 0), RGB(0, 128, 128), RGB(255, 128, 0), RGB(255, 0, 0), RGB(192, 192, 0), RGB(0, 128, 0), RGB(0, 0, 255), RGB(0, 0, 192), RGB(192, 0, 192), RGB(192, 192, 192)]))
material_2 = CreateMaterial(Diffuse=kd_2, Specular=RGB(255, 255, 255), Emission=RGB(0, 0, 0), Transparency=0, Shine=0)

# ----
lng_12 = ListLength(List=split_16)  # -> expr("x-2", Length)
split_18 = SplitList(List=split_15, Index=lng_12)  # -> ListA, ListB
split_19 = SplitList(List=split_17, Index=lng_12)  # -> ListA, ListB
split_20 = SplitList(List=split_16, Index=lng_12)  # -> ListA, ListB

# ---- group: Creates a resistence graph in Rhino scaled to Lpp and 2H (continued)
split_21 = SplitList(List=split_19.ListA, Index=3)  # -> ListA, ListB
split_22 = SplitList(List=split_20.ListA, Index=3)  # -> ListA, graft(ListB)
item_46 = ListItem(List=split_21.ListA, Index=x_unit_for_resistance_graph, Wrap=True)  # -> flatten(Item)
simplify = SimplifyTree(Tree=split_21.ListB, Front=False)
item_47 = ListItem(List=item_46, Index=-1, Wrap=True)
flip_9 = FlipMatrix(Data=simplify)
division_43 = Division(Lpp=filter_lpp_0_or_lpp_1, B=item_47)
sort_25 = SortList(Keys=flatten(flip_9))  # -> Keys, ValuesA
item_48 = ListItem(List=sort_25.Keys, Index=-1, Wrap=True)
division_44 = Division(A=hoa, B=item_48)
multiplication_24 = Multiplication(A=flip_9, B=division_44, C=scale_graph_hoa)
multiplication_25 = Multiplication(A=item_46, B=division_43)
pt_38 = ConstructPoint(XCoordinate=multiplication_25, YCoordinate=0, ZCoordinate=multiplication_24)
intcrv_12 = Interpolate(Vertices=pt_38, Degree=3, Periodic=False, KnotStyle=1)  # -> simplify(Curve), Length, Domain
move_19 = Move(Geometry=intcrv_12.Curve, Motion=Z_10)  # -> Geometry, Transform
end_31 = EndPoints(Curve=move_19.Geometry)  # -> Start, End
preview_40 = CustomPreview(Geometry=move_19.Geometry, Material=material_2)
tag_9 = TextTag(Location=end_31.End, Text=split_22.ListB, Colour=kd_2)

# ---- group: Add values in the resistence graph (continued)
split_23 = SplitList(List=split_18.ListA, Index=3)  # -> ListA, ListB
item_49 = ListItem(List=split_23.ListA, Index=x_unit_for_resistance_graph, Wrap=True)  # -> flatten(Item)
simplify_2 = SimplifyTree(Tree=split_23.ListB, Front=False)
flip_10 = FlipMatrix(Data=simplify_2)
multiplication_26 = Multiplication(A=flip_10, B=division_44, C=scale_graph_hoa)
multiplication_27 = Multiplication(A=item_49, B=division_43)
pt_39 = ConstructPoint(XCoordinate=multiplication_27, YCoordinate=0, ZCoordinate=multiplication_26)
round_9 = Round(Number=flatten(flip_10))  # -> Nearest, Floor, Ceiling
move_20 = Move(Geometry=pt_39, Motion=Z_10)  # -> Geometry, Transform
move_21 = Move(Geometry=move_20.Geometry, Motion=Z_9)  # -> Geometry, Transform
preview_41 = CustomPreview(Geometry=move_20.Geometry, Material=material)
tag_10 = TextTag(Location=flatten(move_21.Geometry), Text=flatten(round_9.Nearest), Colour=flatten(kd))

# ---- group: H&M speed setting
equals_10 = Equality(FirstNumber=x_unit_for_resistance_graph, SecondNumber=0)  # -> Equality, Inequality
and_11 = GateAnd(B=equals_10.Equality)
sift_95 = SiftPattern(HMKnots=design_speed_kn, SiftPattern=and_11)  # -> Output0, Output1
multiplication_28 = Multiplication(A=item_49, B=division_43)
multiplication_29 = Multiplication(A=item_48, B=division_44, C=scale_graph_hoa)
pt_40 = ConstructPoint(XCoordinate=multiplication_28, YCoordinate=0, ZCoordinate=0)
pt_41 = ConstructPoint(XCoordinate=multiplication_28, YCoordinate=0, ZCoordinate=multiplication_29)
ln_20 = Line(StartPoint=pt_40, EndPoint=pt_41)
sift_96 = SiftPattern(List=ln_20, SiftPattern=and_11)  # -> Output0, Output1
round_10 = Round(Number=expr("10*x", item_49))  # -> Nearest, Floor, Ceiling
kd_3 = Diffuse(RGB(64, 64, 64))
move_22 = Move(Geometry=sift_96.Output1, Motion=Z_10)  # -> Geometry, Transform
multiplication_30 = Multiplication(A=round_10.Nearest, B=0.1)
material_3 = CreateMaterial(Diffuse=kd_3, Specular=RGB(255, 255, 255), Emission=RGB(0, 0, 0), Transparency=0, Shine=0)
concat_73 = Concatenate(FragmentA=panel_53, FragmentB=" ", FragmentC=multiplication_30)
end_32 = EndPoints(Curve=move_22.Geometry)  # -> Start, End
tag_11 = TextTag(Location=end_32.End, Text=concat_73, Colour=kd_3)
preview_42 = CustomPreview(Geometry=move_22.Geometry, Material=material_3)

# ---- group: Eenheden conversie
eval_144 = Evaluate(F="round(x/(y^3),z)", x=nullrep_18.Items, y=output_dimension, z=nr_of_digits_output)
eval_145 = Evaluate(F="round(x/(y^1),z)", x=volume_6.Centroid, y=output_dimension, z=nr_of_digits_output)
eval_146 = Evaluate(F="round(x/(y^1),z)", x=subtraction_25, y=output_dimension, z=nr_of_digits_output)
pdecon_38 = Deconstruct(Point=eval_145)  # -> XComponent, YComponent, ZComponent
comma_5 = FragmentA(",")

# ----
nullrep_42 = ReplaceNulls(Items=eval_146, Replacements=0)  # -> Items, Count
nullrep_43 = ReplaceNulls(Items=pdecon_38.YComponent, Replacements=0)  # -> Items, Count
nullrep_44 = ReplaceNulls(Items=pdecon_38.XComponent, Replacements=0)  # -> Items, Count
nullrep_45 = ReplaceNulls(Items=pdecon_38.ZComponent, Replacements=0)  # -> Items, Count

# ---- group: Eenheden conversie (continued)
concat_74 = Concatenate(
    FragmentB=flatten(nullrep_42.Items),
    FragmentA=comma_5,
    FragmentC=flatten(eval_73),
    FragmentD=comma_5,
    FragmentE=flatten(eval_144),
    FragmentF=comma_5,
    FragmentG=flatten(nullrep_44.Items),
    FragmentH=comma_5,
    FragmentI=flatten(nullrep_43.Items),
    FragmentJ=comma_5,
    FragmentK=flatten(nullrep_45.Items))

# ---- group: Tankdiagram data of waterplane area
sift_97 = SiftPattern(List=clean_3, SiftPattern=toggle_tank_diagrams_waterplane_data)  # -> Output0, Output1
amoments_8 = AreaMoments(Geometry=sift_97.Output1)  # -> Area, Centroid, Inertia, Secondary, Gyration
eval_147 = Evaluate(F="round(x/(y^2),z)", x=amoments_8.Area, y=output_dimension, z=nr_of_digits_output)
eval_148 = Evaluate(F="round(x/(y^1),z)", x=amoments_8.Centroid, y=output_dimension, z=nr_of_digits_output)
eval_149 = Evaluate(F="round(x/(y^4),z)", x=amoments_8.Inertia, y=output_dimension, z=nr_of_digits_output)
pdecon_39 = Deconstruct(Point=eval_149)  # -> XComponent, YComponent, ZComponent
pdecon_40 = Deconstruct(Point=eval_148)  # -> XComponent, YComponent, ZComponent
comma_6 = FragmentA(",")
case_21 = TextCase(Text="TankDiagram Tnk 2 Waterplane data", Culture=127)  # -> UpperCase, LowerCase
concat_75 = Concatenate(
    FragmentB=nullrep_42.Items,
    FragmentA=comma_6,
    FragmentC=eval_73,
    FragmentD=comma_6,
    FragmentE=eval_147,
    FragmentF=comma_6,
    FragmentG=pdecon_40.XComponent,
    FragmentH=comma_6,
    FragmentI=pdecon_40.YComponent,
    FragmentJ=comma_6,
    FragmentK=pdecon_40.ZComponent,
    FragmentL=comma_6,
    FragmentM=pdecon_39.XComponent,
    FragmentN=comma_6,
    FragmentO=pdecon_39.YComponent,
    FragmentP=comma_6,
    FragmentQ=pdecon_39.ZComponent)
concat_76 = Concatenate(FragmentB=case_21.UpperCase, FragmentA=concat_group_version_number)
sift_98 = SiftPattern(List=concat_75, SiftPattern=toggle_tank_diagrams_waterplane_data)  # -> Output0, Output1
nullrep_46 = ReplaceNulls(Items=sift_98.Output1, Replacements=0)  # -> Items, Count
tank_diagram_tnk_2_data_of_waterplane = Panel([concat_76, eval_69, nullrep_46.Items])

# ---- group: Tank Diagram data of Volume
case_22 = TextCase(Text="TankDiagram Tnk 2 Volume data", Culture=127)  # -> UpperCase, LowerCase
concat_77 = Concatenate(FragmentB=case_22.UpperCase, FragmentA=concat_group_version_number)
tank_diagram_tnk_2_data_of_volume = Panel([concat_77, eval_65, concat_74])

# ----
merge_21 = Merge(
    Data1=flatten(main_dimensions_2),
    Data2=flatten(loading_condition),
    Data3=flatten(waterline_entrance_angle),
    Data4=flatten(volume_data),
    Data5=flatten(data_waterplane),
    Data6=flatten(hull_area),
    Data7=flatten(volume_data_ballast_water_tank_6),
    Data8=flatten(volume_data_ballast_water_tank_3),
    Data9=flatten(volume_data_ballast_water_tank),
    Data10=flatten(tank_bhd_data),
    Data11=flatten(buoyant_cross_section_areas_2),
    Data12=flatten(total_cross_section_areas),
    Data13=flatten(tank_1_filling_cross_section_areas),
    Data14=flatten(tank_2_filling_cross_section_areas),
    Data15=flatten(tank_3_filling_cross_section_areas),
    Data16=flatten(buoyant_cross_section_areas),
    Data17=flatten(tank_diagram_tnk_1_data_of_volume),
    Data18=flatten(tank_diagram_tnk_1_data_of_waterplane),
    Data19=flatten(tank_diagram_tnk_2_data_of_volume),
    Data20=flatten(tank_diagram_tnk_2_data_of_waterplane),
    Data21=flatten(tank_diagram_tnk_3_data_of_volume),
    Data22=flatten(tank_diagram_tnk_3_data_of_waterplane),
    Data23=flatten(input_data_2),
    Data24=flatten(merge_20))  # disabled

output_all_data_use_copy_data_only = Panel(merge_21)

# ---- group: EXPORT to TXT file
# DATA CSV EXPORT
title_of_the_txt_file = Panel("HullAreaData")
dam_17 = DataDam(DataA=hull_area, BufferDelay=20000000, BufferMode=2)
title_of_the_txt_file_2 = Panel("Tank1_CSA")
title_of_the_txt_file_3 = Panel("Tank2_CSA")
title_of_the_txt_file_4 = Panel("Tank3_CSA")
title_of_the_txt_file_5 = Panel("Shell_CSA")
title_of_the_txt_file_6 = Panel("Tank1_Diagram_Volume")
title_of_the_txt_file_7 = Panel("TankData")
title_of_the_txt_file_8 = Panel("Tank2_Diagram_Volume")
title_of_the_txt_file_9 = Panel("Tank1_Diagram_Waterplane")
title_of_the_txt_file_10 = Panel("Tank2_Diagram_Waterplane")
title_of_the_txt_file_11 = Panel("Total_CSA")
title_of_the_txt_file_12 = Panel("Buoyant_CSA")
title_of_the_txt_file_13 = Panel("Tank3_Diagram_Volume")
title_of_the_txt_file_14 = Panel("TankBHD_Data")
title_of_the_txt_file_15 = Panel("Tank3_Diagram_Waterplane")
title_of_the_txt_file_16 = Panel("InputData")
title_of_the_txt_file_17 = Panel("AllData")
dam_18 = DataDam(DataA=tank_2_filling_cross_section_areas, BufferDelay=10000000, BufferMode=2)
dam_19 = DataDam(DataA=tank_3_filling_cross_section_areas, BufferDelay=10000000, BufferMode=2)
title_of_the_txt_file_18 = Panel("MainShipParticulars")
dam_20 = DataDam(DataA=buoyant_cross_section_areas, BufferDelay=10000000, BufferMode=2)
title_of_the_txt_file_19 = Panel("ResistanceData")
dam_21 = DataDam(DataA=input_data_2, BufferDelay=10000000, BufferMode=2)
dam_22 = DataDam(DataA=tank_diagram_tnk_1_data_of_volume, BufferDelay=20000000, BufferMode=2)
dam_23 = DataDam(DataA=tank_diagram_tnk_2_data_of_volume, BufferDelay=20000000, BufferMode=2)
dam_24 = DataDam(
    DataA=[volume_data_ballast_water_tank_6, volume_data_ballast_water_tank_3, volume_data_ballast_water_tank],
    BufferDelay=20000000,
    BufferMode=2)
dam_25 = DataDam(DataA=tank_diagram_tnk_1_data_of_waterplane, BufferDelay=20000000, BufferMode=2)
dam_26 = DataDam(DataA=tank_diagram_tnk_2_data_of_waterplane, BufferDelay=20000000, BufferMode=2)
dam_27 = DataDam(DataA=tank_diagram_tnk_3_data_of_volume, BufferDelay=20000000, BufferMode=2)
dam_28 = DataDam(DataA=tank_bhd_data, BufferDelay=20000000, BufferMode=2)
dam_29 = DataDam(DataA=tank_diagram_tnk_3_data_of_waterplane, BufferDelay=20000000, BufferMode=2)
dam_30 = DataDam(DataA=buoyant_cross_section_areas_2, BufferDelay=10000000, BufferMode=2)
py3 = Python3Script(
    relative=relative,
    files=item_3,
    lines=flatten(dam_19),
    write=write_csv_files,
    overwrite=overwrite,
    append=append,
    Group=dam_14,
    version=dam_15,
    subversion=subversion,
    title=title_of_the_txt_file_4)  # -> out, a; inputs lines: list, Group: Int32, version: Int32, subversion: Int32
# ---------- py3: Python ----------
import os

# Instellingen
k = 0
v = int(version)
s = int(subversion)
t = title
f = files  # file type like .txt or .csv
Group = int(Group)

# Zorg dat de extensie begint met een punt
if not f.startswith("."):
    f = "." + f
print("Bestand", t, "is weggeschreven naar:")

if write:
    # Pad van het Grasshopper-document
    gh_path = ghdoc.Path
    base_dir = os.path.dirname(os.path.realpath(gh_path))

    # Maak de 'Data' map aan als deze niet bestaat
    data_dir = os.path.join(base_dir, "Data")
    if not os.path.exists(data_dir):
        os.makedirs(data_dir)

    # Bestandsnaam opbouwen
    file_name = f"{t}_Gr{Group}_V{v}.{s}{f}"
    full_path = os.path.join(data_dir, file_name)

    # Bestand schrijven
    if not os.path.exists(full_path) or os.stat(full_path).st_size == 0 or overwrite:
        with open(full_path, "w") as file:
            for line in lines:
                file.write(line + '\n')

print(full_path)
# ---------- end py3 ----------
dam_31 = DataDam(
    DataA=[main_dimensions_2, loading_condition, waterline_entrance_angle, volume_data, data_waterplane],
    BufferDelay=10000000,
    BufferMode=2)
dam_32 = DataDam(DataA=total_cross_section_areas, BufferDelay=10000000, BufferMode=2)
py3_2 = Python3Script(
    relative=relative,
    files=item_3,
    lines=flatten(dam_20),
    write=write_csv_files,
    overwrite=overwrite,
    append=append,
    Group=dam_14,
    version=dam_15,
    subversion=subversion,
    title=title_of_the_txt_file_5)  # -> out, a; inputs lines: list, Group: Int32, version: Int32, subversion: Int32; same code as py3
dam_33 = DataDam(DataA=tank_1_filling_cross_section_areas, BufferDelay=10000000, BufferMode=2)
py3_3 = Python3Script(
    relative=relative,
    files=item_3,
    lines=flatten(dam_26),
    write=write_csv_files,
    overwrite=overwrite,
    append=append,
    Group=dam_14,
    version=dam_15,
    subversion=subversion,
    title=title_of_the_txt_file_10)  # -> out, a; inputs lines: list, Group: Int32, version: Int32, subversion: Int32; same code as py3
dam_34 = DataDam(DataA=merge_21, BufferDelay=20000000, BufferMode=2)
py3_4 = Python3Script(
    relative=relative,
    files=item_3,
    lines=flatten(dam_23),
    write=write_csv_files,
    overwrite=overwrite,
    append=append,
    Group=dam_14,
    version=dam_15,
    subversion=subversion,
    title=title_of_the_txt_file_8)  # -> out, a; inputs lines: list, Group: Int32, version: Int32, subversion: Int32; same code as py3
py3_5 = Python3Script(
    relative=relative,
    files=item_3,
    lines=flatten(dam_21),
    write=write_csv_files,
    overwrite=overwrite,
    append=append,
    Group=dam_14,
    version=dam_15,
    subversion=subversion,
    title=title_of_the_txt_file_16)  # -> out, a; inputs lines: list, Group: Int32, version: Int32, subversion: Int32; same code as py3
dam_35 = DataDam(DataA=merge_20, BufferDelay=10000000, BufferMode=2)
py3_6 = Python3Script(
    relative=relative,
    files=item_3,
    lines=flatten(dam_24),
    write=write_csv_files,
    overwrite=overwrite,
    append=append,
    Group=dam_14,
    version=dam_15,
    subversion=subversion,
    title=title_of_the_txt_file_7)  # -> out, a; inputs lines: list, Group: Int32, version: Int32, subversion: Int32; same code as py3
py3_7 = Python3Script(
    relative=relative,
    files=item_3,
    lines=flatten(dam_25),
    write=write_csv_files,
    overwrite=overwrite,
    append=append,
    Group=dam_14,
    version=dam_15,
    subversion=subversion,
    title=title_of_the_txt_file_9)  # -> out, a; inputs lines: list, Group: Int32, version: Int32, subversion: Int32; same code as py3
py3_8 = Python3Script(
    relative=relative,
    files=item_3,
    lines=flatten(dam_29),
    write=write_csv_files,
    overwrite=overwrite,
    append=append,
    Group=dam_14,
    version=dam_15,
    subversion=subversion,
    title=title_of_the_txt_file_15)  # -> out, a; inputs lines: list, Group: Int32, version: Int32, subversion: Int32; same code as py3
py3_9 = Python3Script(
    relative=relative,
    files=item_3,
    lines=flatten(dam_27),
    write=write_csv_files,
    overwrite=overwrite,
    append=append,
    Group=dam_14,
    version=dam_15,
    subversion=subversion,
    title=title_of_the_txt_file_13)  # -> out, a; inputs lines: list, Group: Int32, version: Int32, subversion: Int32; same code as py3
py3_10 = Python3Script(
    relative=relative,
    files=item_3,
    lines=flatten(dam_28),
    write=write_csv_files,
    overwrite=overwrite,
    append=append,
    Group=dam_14,
    version=dam_15,
    subversion=subversion,
    title=title_of_the_txt_file_14)  # -> out, a; inputs lines: list, Group: Int32, version: Int32, subversion: Int32; same code as py3
py3_11 = Python3Script(
    relative=relative,
    files=item_3,
    lines=flatten(dam_22),
    write=write_csv_files,
    overwrite=overwrite,
    append=append,
    Group=dam_14,
    version=dam_15,
    subversion=subversion,
    title=title_of_the_txt_file_6)  # -> out, a; inputs lines: list, Group: Int32, version: Int32, subversion: Int32; same code as py3
py3_12 = Python3Script(
    relative=relative,
    files=item_3,
    lines=flatten(dam_30),
    write=write_csv_files,
    overwrite=overwrite,
    append=append,
    Group=dam_14,
    version=dam_15,
    subversion=subversion,
    title=title_of_the_txt_file_12)  # -> out, a; inputs lines: list, Group: Int32, version: Int32, subversion: Int32; same code as py3
py3_13 = Python3Script(
    relative=relative,
    files=item_3,
    lines=flatten(dam_17),
    write=write_csv_files,
    overwrite=overwrite,
    append=append,
    Group=dam_14,
    version=dam_15,
    subversion=subversion,
    title=title_of_the_txt_file)  # -> out, a; inputs lines: list, Group: Int32, version: Int32, subversion: Int32; same code as py3
py3_14 = Python3Script(
    relative=relative,
    files=item_3,
    lines=flatten(dam_18),
    write=write_csv_files,
    overwrite=overwrite,
    append=append,
    Group=dam_14,
    version=dam_15,
    subversion=subversion,
    title=title_of_the_txt_file_3)  # -> out, a; inputs lines: list, Group: Int32, version: Int32, subversion: Int32; same code as py3
py3_15 = Python3Script(
    relative=relative,
    files=item_3,
    lines=flatten(dam_33),
    write=write_csv_files,
    overwrite=overwrite,
    append=append,
    Group=dam_14,
    version=dam_15,
    subversion=subversion,
    title=title_of_the_txt_file_2)  # -> out, a; inputs lines: list, Group: Int32, version: Int32, subversion: Int32; same code as py3
py3_16 = Python3Script(
    relative=relative,
    files=item_3,
    lines=flatten(dam_32),
    write=write_csv_files,
    overwrite=overwrite,
    append=append,
    Group=dam_14,
    version=dam_15,
    subversion=subversion,
    title=title_of_the_txt_file_11)  # -> out, a; inputs lines: list, Group: Int32, version: Int32, subversion: Int32; same code as py3
py3_17 = Python3Script(
    relative=relative,
    files=item_3,
    lines=flatten(dam_35),
    write=write_csv_files,
    overwrite=overwrite,
    append=append,
    Group=dam_14,
    version=dam_15,
    subversion=subversion,
    title=title_of_the_txt_file_19)  # -> out, a; inputs lines: list, Group: Int32, version: Int32, subversion: Int32; same code as py3
py3_18 = Python3Script(
    relative=relative,
    files=item_3,
    lines=flatten(dam_31),
    write=write_csv_files,
    overwrite=overwrite,
    append=append,
    Group=dam_14,
    version=dam_15,
    subversion=subversion,
    title=title_of_the_txt_file_18)  # -> out, a; inputs lines: list, Group: Int32, version: Int32, subversion: Int32; same code as py3
txt_writer = TextDocumentWriter(
    relative=relative,
    files=item_3,
    lines=flatten(dam_34),
    write=write_csv_files,
    overwrite=overwrite,
    append=append,
    Group=dam_14,
    version=dam_15,
    subversion=subversion,
    title=title_of_the_txt_file_17)  # -> out, s; inputs lines: list, append: list; disabled
#   port relative: Set to 'True' to create a new Text File using relative path. This file will live in the same directory as the Grasshopper document.
# ---------- txt_writer: Python ----------
ghenv.Component.Name = "Text Document Writer"
ghenv.Component.NickName = 'TXT-Writer'

import Grasshopper as gh
import os
k=0
v=int(version)
s=int(subversion)
t=title
print(v)
print(s)
print(t)
Group=int(Group)

if write==True:
    gh_path = ghdoc.Path # Get GH document's file path
    name = gh_path.split(".")[0]
    new = name.split("\\")
#    file_name = t + "_Gr%r" %Group + "_V%r.txt" %v # Create text file name
    file_name = t + "_Gr%r" %Group + "_V%r" %v + ".%r.txt" %s # Create text file name, with format:version 1.1
    dir = os.path.dirname(os.path.realpath(gh_path))
    file = os.path.join(dir, file_name) # Create text file path
    filePath = open(file, "w+") # Open text file to create it
    if os.stat(file).st_size == 0: # Check to see if file has any data and continue if it's empty
        filePath = open(file, "w") # Open the file
        for line in lines: # Iterate through lines
            filePath.write(lines[k] + '\n') # Write separate lines
            k=k+1
        filePath.close() # Close the file
    elif os.stat(file).st_size >= 1 and overwrite == True: # If file has data and 'overwrite' set to True continue
        filePath = open(file, "w") # Open the file
        for line in lines: # Iterate through lines
            filePath.write(lines[k] + '\n') # Write separate lines
            k=k+1
        filePath.close() # Close the file

print(gh_path)
# ---------- end txt_writer ----------
txt_writer_oud = TextDocumentWriter(
    relative=relative,
    files=item_3,
    lines=flatten(dam_31),
    write=write_csv_files,
    overwrite=overwrite,
    append=append,
    Group=dam_14,
    version=dam_15,
    subversion=subversion,
    title=title_of_the_txt_file_18)  # -> out, s; inputs lines: list, append: list; disabled
#   port relative: Set to 'True' to create a new Text File using relative path. This file will live in the same directory as the Grasshopper document.
# ---------- txt_writer_oud: Python ----------
ghenv.Component.Name = "Text Document Writer"
ghenv.Component.NickName = 'TXT-Writer'

import Grasshopper as gh
import os
k=0
v=int(version)
s=int(subversion)
t=title
f=files #file type like .txt or .csv
if not f.startswith("."):
    f = "." + f
print(v)
print(s)
print(t)
print(f)
Group=int(Group)

if write==True:
    gh_path = ghdoc.Path # Get GH document's file path
    name = gh_path.split(".")[0]
    new = name.split("\\")
#    file_name = t + "_Gr%r" %Group + "_V%r.txt" %v # Create text file name
    file_name = "%s_Gr%d_V%d.%d%s" % (t, Group, v, s, f)  # Create text file name, with format:version 1.1.txt
    dir = os.path.dirname(os.path.realpath(gh_path))
    file = os.path.join(dir, file_name) # Create text file path
    filePath = open(file, "w+") # Open text file to create it
    if os.stat(file).st_size == 0: # Check to see if file has any data and continue if it's empty
        filePath = open(file, "w") # Open the file
        for line in lines: # Iterate through lines
            filePath.write(lines[k] + '\n') # Write separate lines
            k=k+1
        filePath.close() # Close the file
    elif os.stat(file).st_size >= 1 and overwrite == True: # If file has data and 'overwrite' set to True continue
        filePath = open(file, "w") # Open the file
        for line in lines: # Iterate through lines
            filePath.write(lines[k] + '\n') # Write separate lines
            k=k+1
        filePath.close() # Close the file

print(gh_path)
# ---------- end txt_writer_oud ----------

# ----
panel_54 = Panel(py3_18.out)
# Help: Set all toggles on true, otherwise some data will be missing. Right mouse click in the output panel below and choose 'Copy Data Only' and paste this in spreadsheet or a text file.
# Use the function Text to Columns in Excel>Tab Data. Use comma (,) as delimiter and a point (.) as decimal qualifier.
output_all_data_use_copy_data_only_2 = Panel(merge_21)

# ----
# DATA JSON EXPORT
# Checklist van de Grasshopper JSON Export met Units en XYZ-ondersteuning: Checklist van de Grasshopper JSON Export met Units en XYZ-ondersteuning
# 
# Invoer in Grasshopper
# 
# dict_titles → List Access: lijst van namen voor de dictionaries (bijv. MainDimensions, DraughtData…).
# 
# keys → Tree Access: per branch een lijst van keys (variabelenamen) voor elke dictionary.
# 
# values → Tree Access: per branch een lijst van waarden, waarbij XYZ-waarden als string in de vorm {x, y, z} kunnen worden ingevoerd.
# 
# key_units → Tree Access: per branch een lijst van units die horen bij elke key (bijv. "m", "deg", "%Bwl").
# 
# Conversie van Grasshopper Data Trees
# 
# Helper tree_to_list_of_lists zet GH Data Trees om naar lijsten van lijsten, zodat ze makkelijk in Python verwerkt kunnen worden.
# 
# Bouw JSON-data
# 
# Voor elke dictionary (branch) wordt een dict(zip(keys, values)) gemaakt.
# 
# Strings die het XYZ-formaat {x, y, z} hebben, worden omgezet naar Python-lijsten [x, y, z].
# 
# Alleen de keys zonder units gaan in deze JSON.
# 
# Export-informatie
# 
# Elke JSON krijgt _export_info met:
# 
# Aanmaakdatum (created)
# 
# Bronbestand (source_file)
# 
# group, version en subversion
# 
# Bestandsnaam en pad
# 
# Veilige bestandsnaam wordt opgebouwd uit:
# 
# Titel (title)
# 
# Group (Group)
# 
# Version & Subversion (version, subversion)
# 
# Bestandsnaam voorbeeld: MainShipParticulars_Gr10_V15.99.json
# 
# JSON wordt opgeslagen in dezelfde map als het GH-bestand.
# 
# GH_panel output
# 
# Combineert key + unit in een leesbare vorm.
# 
# XYZ-waarden worden compact weergegeven: x,y,z op één regel, met unit erachter.
# 
# Secties (dictionaries) krijgen hoofdletter titels.
# 
# Output is geschikt voor “Publish to Remote Panel” in Grasshopper.
# 
# Example JSON
# 
# JSON met samengevoegde keys en units voor externe verwerking of testdoeleinden.
# 
# Bevat dezelfde _export_info.
# 
# Uitvoerpoorten
# 
# out → Volledig pad van het weggeschreven JSON-bestand.
# 
# example → JSON-tekst als string (samengevoegd met units).
# 
# GH_panel → Tekst geschikt voor het GH-panel.
panel_55 = Panel([panel_24, case_2.UpperCase, case_3.UpperCase, case_4.UpperCase, case_19.UpperCase])
entwine = Entwine(Branch00=panel_26, Branch01=panel_23, Branch02=panel_28, Branch03=panel_30, Branch04=panel_42, FlattenInputs=True)
entwine_2 = Entwine(
    Branch00=eval_33,
    Branch01=eval_32,
    Branch02=nullrep_3.Items,
    Branch03=nullrep_4.Items,
    Branch04=nullrep_38.Items,
    FlattenInputs=True)
entwine_3 = Entwine(Branch00=panel_25, Branch01=panel_22, Branch02=panel_27, Branch03=panel_29, Branch04=panel_41, FlattenInputs=True)
panel_56 = Panel([case_12.UpperCase, case_11.UpperCase, case_10.UpperCase])
entwine_4 = Entwine(Branch00=panel_39, Branch01=panel_36, Branch02=panel_34, FlattenInputs=True)
entwine_5 = Entwine(Branch00=nullrep_29.Items, Branch01=nullrep_28.Items, Branch02=nullrep_27.Items, FlattenInputs=True)
entwine_6 = Entwine(Branch00=panel_38, Branch01=panel_35, Branch02=panel_33, FlattenInputs=True)
panel_57 = Panel(case.UpperCase)
panel_58 = Panel(entwine_3)
panel_59 = Panel(entwine_2)
entwine_7 = Entwine(Branch00=panel_11, FlattenInputs=True)
entwine_8 = Entwine(Branch00=eval_25, FlattenInputs=True)
entwine_9 = Entwine(Branch00=filter_lpp1_of_lpp2, FlattenInputs=True)
panel_60 = Panel(entwine)
py3_19 = Python3Script(
    write=write_csv_files,
    keys=entwine_6,
    key_units=entwine_4,
    values=entwine_5,
    title=title_of_the_txt_file_7,
    dict_titles=panel_56,
    Group=dam_14,
    version=dam_15,
    subversion=subversion)  # -> out, example, GH_panel, a; inputs keys: tree of String, key_units: tree, values: tree of String, title: String, dict_titles: list of String, version: Int32
# ---------- py3_19: Python ----------
"""Grasshopper JSON Export met directe dictionary-opbouw en eenheden in keys"""
import Grasshopper as gh
from Grasshopper import DataTree
from Grasshopper.Kernel.Data import GH_Path
import os
import json
import scriptcontext as sc
import re
import datetime

# Lokale tijd met offset (aan te raden voor audits)
created = datetime.datetime.now().astimezone().isoformat()

 # --- Helperfunctie: zet Grasshopper Data Trees om in lijsten van lijsten ---
def tree_to_list_of_lists(tree):
    return [list(branch) for branch in tree.Branches]

# --- Helperfunctie: converteer een waarde naar juiste JSON-compatibele vorm ---
def convert_value(val):
    if isinstance(val, str):
        val = val.strip()
        # Als string een komma bevat -> lijst van floats
        if ',' in val:
            try:
                return [float(x.strip()) for x in val.split(',')]
            except:
                return val
        else:
            try:
                return float(val)
            except:
                return val
    elif isinstance(val, tuple):
        return list(val)  # tuple -> lijst
    else:
        return val  # float/int etc. gewoon teruggeven

# --- Helperfunctie: markeerd lege eenheden in Key_units ---
def normalize_unit(u):
    if u is None:
        return ''
    us = str(u).strip()
    if us.lower() in {'', '-', '–', '—', 'n/a', 'na', 'none', 'null'}:
        return ''

    # Speciale gevallen
    if us == '%':
        return 'pct'

    # Unicode & symbolen
    us = us.replace('²', '2').replace('³', '3')   # m² -> m2
    us = us.replace('°', 'deg')                   # ° -> deg
    us = us.replace('µ', 'u')                     # µ -> u

    # Delers/vermenigvuldigers
    us = re.sub(r'\s*/\s*', '_per_', us)         # / -> _per_
    us = us.replace('·', '_').replace('∙', '_').replace('•', '_').replace('×', '_')

    # Spaties en carets
    us = re.sub(r'\s+', '_', us)                 # spaties -> _
    us = re.sub(r'\^([0-9]+)', r'\1', us)        # ^2 -> 2

    # Opruimen
    us = re.sub(r'_+', '_', us).strip('_')
    return us



# --- MAIN CODE ---

if write==False:
    out="Toggle -Write txt files- is off"
    print(out)
else:
    # --- Converteer inputs ---
    keys_tree = keys
    values_tree = values
    units_tree = key_units

    keys = tree_to_list_of_lists(keys)
    values = tree_to_list_of_lists(values)
    key_units = tree_to_list_of_lists(key_units)

    if not (len(keys) == len(values) == len(key_units) == len(dict_titles)):
       raise ValueError("Mismatch in aantal branches tussen keys/values/units/titles.")

    if not isinstance(dict_titles, list):
        dict_titles = [dict_titles]

    # --- Controleer of GH-bestand is opgeslagen ---
    if not ghdoc.Path:
        raise ValueError("Sla eerst je Grasshopper-bestand op voordat je JSON kunt exporteren.")

    # --- Bouw dictionary zo dat het naar een json geschreven kan worden ---
    hull_data = {}
    for t, k_list, v_list, u_list in zip(dict_titles, keys, values, key_units):
        section = {}
        for k, v, u in zip(k_list, v_list, u_list):
            #key_name = f"{k.replace(' ', '_')}_{u}" if u else k.replace(' ', '_')
            unit_clean = normalize_unit(u)
            key_base = k.replace(' ', '_')
            key_name = f"{key_base}_{unit_clean}" if unit_clean else key_base
            section[key_name] = convert_value(v)
        hull_data[t] = section

    # --- Voeg exportinformatie toe ---
    hull_data["_export_info"] = {
        #"created": datetime.datetime.now().isoformat(),
        "created": datetime.datetime.now().astimezone().isoformat(),
        "source_file": os.path.basename(ghdoc.Path),
        "group": Group,
        "version": version,
        "subversion": subversion
    }

    # --- Bouw veilige bestandsnaam ---
    v = int(version)
    s = int(subversion)
    grp = int(Group)
    safe_title = re.sub(r'[<>:\"/\\|?*]', '_', title)
    file_name = f"{safe_title}_Gr{grp}_V{v}.{s}.json"
    # dirr = os.path.dirname(os.path.realpath(ghdoc.Path))
    # gh_path_file = os.path.join(dirr, file_name)

        # --- Vind basisdirectory en maak Data-map ---
    dirr = os.path.dirname(os.path.realpath(ghdoc.Path))
    data_dir = os.path.join(dirr, "Data")
    if not os.path.exists(data_dir):
        os.makedirs(data_dir)

    # --- Volledige pad naar bestand in Data-map ---
    gh_path_file = os.path.join(data_dir, file_name)

    # --- Schrijf JSON weg ---
    try:
        with open(gh_path_file, 'w+', encoding='utf-8') as f:
            json.dump(hull_data, f, indent=4, ensure_ascii=False)
        out = gh_path_file
    except Exception as e:
        out = f"Fout bij schrijven van JSON: {e}"

    print(out)

    # --- GH-panel voorbeeld (zelfde data, alleen als string) ---
    example = json.dumps(hull_data, indent=4, ensure_ascii=False)

    # --- Bouw GH-panel met behoud van branches ---
    GH_panel = DataTree[str]()
    for idx, (path, k_list, v_list, u_list) in enumerate(zip(keys_tree.Paths, keys, values, key_units)):
        lines = [dict_titles[idx].upper()]
        for k, v, u in zip(k_list, v_list, u_list):
            val_converted = convert_value(v)
            val_str = ",".join(str(x) for x in val_converted) if isinstance(val_converted, list) else str(val_converted)
            #key_name = f"{k}_{u}" if u else k
            unit_clean = normalize_unit(u)
            key_name = f"{k}_{unit_clean}" if unit_clean else k

            lines.append(f"{key_name} {val_str}")
        for line in lines:
            GH_panel.Add(line, path)
# ---------- end py3_19 ----------
py3_20 = Python3Script(
    write=write_csv_files,
    keys=entwine_9,
    key_units=entwine_7,
    values=entwine_8,
    title=title_of_the_txt_file_16,
    dict_titles=panel_57,
    Group=dam_14,
    version=dam_15,
    subversion=subversion)  # -> out, example, GH_panel, a; inputs keys: tree of String, key_units: tree, values: tree of String, title: String, dict_titles: list of String, version: Int32; same code as py3_19
panel_61 = Panel(py3_19.out)
panel_62 = Panel(py3_19.example)
panel_63 = Panel(py3_20.out)
panel_64 = Panel(py3_20.example)

py3_21 = Python3Script(
    write=write_csv_files,
    keys=entwine_3,
    key_units=entwine,
    values=entwine_2,
    title=title_of_the_txt_file_18,
    dict_titles=panel_55,
    Group=dam_14,
    version=dam_15,
    subversion=subversion)  # -> out, example, GH_panel, a; inputs keys: tree of String, key_units: tree, values: tree of String, title: String, dict_titles: list of String, version: Int32; same code as py3_19

example_json_file = Panel(py3_21.example)
panel_65 = Panel(py3_21.out)
main_particulars = Panel(py3_21.GH_panel)

py3_22 = Python3Script(
    write=write_csv_files,
    keys=entwine_3,
    key_units=entwine,
    values=entwine_2,
    title=title_of_the_txt_file_18,
    dict_titles=panel_55,
    Group=dam_14,
    version=dam_15,
    subversion=subversion)  # -> out, example, GH_panel, a; inputs keys: tree of String, key_units: tree, values: tree of String, title: String, dict_titles: list of String, version: Int32; disabled
# ---------- py3_22: Python ----------
"""Grasshopper JSON Export met directe dictionary-opbouw en eenheden in keys"""
import Grasshopper as gh
from Grasshopper import DataTree
from Grasshopper.Kernel.Data import GH_Path
import os
import json
import scriptcontext as sc
import re
import datetime


 # --- Helperfunctie: zet Grasshopper Data Trees om in lijsten van lijsten ---
def tree_to_list_of_lists(tree):
    return [list(branch) for branch in tree.Branches]

# --- Helperfunctie: converteer een waarde naar juiste JSON-compatibele vorm ---
def convert_value(val):
    if isinstance(val, str):
        val = val.strip()
        # Als string een komma bevat -> lijst van floats
        if ',' in val:
            try:
                return [float(x.strip()) for x in val.split(',')]
            except:
                return val
        else:
            try:
                return float(val)
            except:
                return val
    elif isinstance(val, tuple):
        return list(val)  # tuple -> lijst
    else:
        return val  # float/int etc. gewoon teruggeven


if write==False:
    out="Toggle -Write txt files- is off"
    print(out)
else:
    # --- Converteer inputs ---
    keys_tree = keys
    values_tree = values
    units_tree = key_units

    keys = tree_to_list_of_lists(keys)
    values = tree_to_list_of_lists(values)
    key_units = tree_to_list_of_lists(key_units)

    if not isinstance(dict_titles, list):
        dict_titles = [dict_titles]

    # --- Controleer of GH-bestand is opgeslagen ---
    if not ghdoc.Path:
        raise ValueError("Sla eerst je Grasshopper-bestand op voordat je JSON kunt exporteren.")

    # --- Bouw dictionary zo dat het naar een json geschreven kan worden ---
    hull_data = {}
    for t, k_list, v_list, u_list in zip(dict_titles, keys, values, key_units):
        section = {}
        for k, v, u in zip(k_list, v_list, u_list):
            key_name = f"{k.replace(' ', '_')}_{u}" if u else k.replace(' ', '_')
            section[key_name] = convert_value(v)
        hull_data[t] = section

    # --- Voeg exportinformatie toe ---
    hull_data["_export_info"] = {
        "created": datetime.datetime.now().isoformat(),
        "source_file": os.path.basename(ghdoc.Path),
        "group": Group,
        "version": version,
        "subversion": subversion
    }

    # --- Bouw veilige bestandsnaam ---
    v = int(version)
    s = int(subversion)
    grp = int(Group)
    safe_title = re.sub(r'[<>:\"/\\|?*]', '_', title)
    file_name = f"{safe_title}_Gr{grp}_V{v}.{s}.json"
    dirr = os.path.dirname(os.path.realpath(ghdoc.Path))
    gh_path_file = os.path.join(dirr, file_name)

    # --- Schrijf JSON weg ---
    try:
        with open(gh_path_file, 'w+', encoding='utf-8') as f:
            json.dump(hull_data, f, indent=4, ensure_ascii=False)
        out = gh_path_file
    except Exception as e:
        out = f"Fout bij schrijven van JSON: {e}"

    print(out)

    # --- GH-panel voorbeeld (zelfde data, alleen als string) ---
    example = json.dumps(hull_data, indent=4, ensure_ascii=False)

    # --- Bouw GH-panel met behoud van branches ---
    GH_panel = DataTree[str]()
    for idx, (path, k_list, v_list, u_list) in enumerate(zip(keys_tree.Paths, keys, values, key_units)):
        lines = [dict_titles[idx].upper()]
        for k, v, u in zip(k_list, v_list, u_list):
            val_converted = convert_value(v)
            val_str = ",".join(str(x) for x in val_converted) if isinstance(val_converted, list) else str(val_converted)
            key_name = f"{k}_{u}" if u else k
            lines.append(f"{key_name} {val_str}")
        for line in lines:
            GH_panel.Add(line, path)
# ---------- end py3_22 ----------
